# Grasshopper definition line_examples.ghx (Grasshopper 0.9.76)

series = Series(Start=0, Step=Slider(7, range=0..22), Count=Slider(8, range=0..20))
construct_point = ConstructPoint(XCoordinate=series, YCoordinate=graft(series), ZCoordinate=0)  # -> flatten(Point)
construct_domain = ConstructDomain(DomainStart=Slider(1, range=0..1), DomainEnd=Slider(12, range=0..100))
list_length = ListLength(List=construct_point)
random = Random(Range=construct_domain, Number=list_length, Seed=2)
# Grasshopper Challenges
# By Dan Taeyoung, 2016. https://github.com/provolot/GrasshopperChallenges
# Challenges G - custom line ideas and examples
circle = Circle(Plane=construct_point, Radius=random)

# ---- group: This component automatically grabs all the geometry on given layers. Double-click or right-click to set detailed controls.
# Challenge G0- Sketching with Geometry Pipeline.
geometry_pipeline = GeometryPipeline(
    GroupByLayer=False,
    GroupByType=False,
    IncludeHidden=True,
    IncludeLocked=True,
    LayerFilter="CURVES",
    NameFilter="*",
    TypeFilter=4)

# ----
# Explanation: We're using example geometry, but:
# 
# Try creating a 'CURVES' layer and make some curved geometry on it to see the Geometry Pipeline component in action.
# 
# The component is case-sensitive and whitespace-sensitive, so make sure that the layer is called 'CURVES', not 'curves' or 'Curves' or 'CURVES ' (notice the space at the end)!
geometry = Geometry(circle)
# Challenge/Example G1 - 'Fuzzy lines'
geometry_2 = Geometry(geometry)
# Challenge/Example G2 - 'Ladder lines'
panel = Panel("200")
# Challenge/Example G3 - 'Swirly lines'
panel_2 = Panel("300")
# Challenge/Example G4 - 'Offset lines'
panel_3 = Panel("400")
# Challenge/Example G5 - Dash patterns
# Challenge/Example G5 - Offset lines
panel_4 = Panel("500")
# Challenge/Example G6 - Combining clusters and components
panel_5 = Panel("800")
# Challenge/Example G5 - Offset lines - with clusters
panel_6 = Panel("700")
# Challenge/Example G7 - Spirograph-esque lines: using data logic to create new geometry
panel_7 = Panel("900")
unit_x = UnitX(Factor="100")
unit_x_2 = UnitX(Factor=panel)
unit_x_3 = UnitX(Factor=panel_2)
unit_x_4 = UnitX(Factor=panel_3)
unit_x_5 = UnitX(Factor=panel_4)
unit_x_6 = UnitX(Factor="600")
unit_x_7 = UnitX(Factor=panel_5)
unit_x_8 = UnitX(Factor=panel_6)
unit_x_9 = UnitX(Factor=panel_7)
move = Move(Geometry=geometry_2, Motion=unit_x)  # -> Geometry, Transform
move_2 = Move(Geometry=geometry_2, Motion=unit_x_2)  # -> Geometry, Transform
move_3 = Move(Geometry=geometry_2, Motion=unit_x_3)  # -> Geometry, Transform
move_4 = Move(Geometry=geometry_2, Motion=unit_x_4)  # -> Geometry, Transform
move_5 = Move(Geometry=geometry_2, Motion=unit_x_5)  # -> Geometry, Transform
move_6 = Move(Geometry=geometry_2, Motion=unit_x_7)  # -> Geometry, Transform
move_7 = Move(Geometry=geometry_2, Motion=unit_x_6)  # -> Geometry, Transform
move_8 = Move(Geometry=geometry_2, Motion=unit_x_8)  # -> Geometry, Transform
move_9 = Move(Geometry=geometry_2, Motion=unit_x_9)  # -> Geometry, Transform
geometry_3 = Geometry(move_2.Geometry)
panel_8 = Panel("""1
0.3""")
geometry_4 = Geometry(graft(move_7.Geometry))
geometry_5 = Geometry(move_5.Geometry)
panel_9 = Panel("""2
0.5
4
0.5""")
series_2 = Series(Start=0, Step=Slider(0.2, range=0..1), Count=10)
geometry_6 = Geometry(graft(move_3.Geometry))
geometry_7 = Geometry(graft(move_4.Geometry))
geometry_8 = Geometry(graft(move_8.Geometry))
series_3 = Series(Start=0, Step=Slider(0.2, range=0..1), Count=10)
divide_length = DivideLength(Curve=geometry_3, Length=Slider(0.8, range=0..10))  # -> Points, Tangents, Parameters
dash_pattern = DashPattern(Curve=move_6.Geometry, Pattern=panel_9)  # -> Dashes, Gaps
dash_pattern_2 = DashPattern(Curve=geometry_5, Pattern=panel_8)  # -> Dashes, Gaps
offset = Offset(Curve=geometry_4, Distance=series_2, Plane=PlaneXY(0, 0, 0), Corners=1)
divide_length_2 = DivideLength(Curve=move_9.Geometry, Length=Slider(1.6, range=0..10))  # -> simplify(Points), Tangents, Parameters
panel_10 = Panel("""1
0.2
3
0.2""")
divide_length_3 = DivideLength(Curve=geometry_6, Length=Slider(0.8, range=0..10))  # -> Points, Tangents, Parameters

# ---- group: This is a Cluster! It contains a lot of Grasshopper components inside it. Double-click me to see what's going on inside.
# Explanation: This is an example of clusters. For a video tutorial explaining clusters, see:
# 
# http://skilltree.gsapp.org/tutorial/mt-clusters
offsetlines = OffsetLines(offset_distance=Slider(0.3, range=0..1), curve=move_8.Geometry)

# ----
# Explanation: This is not so much a set of challenges, but a series of example components to describe the creation of custom linework in Grasshopper.
divide_length_4 = DivideLength(Curve=move.Geometry, Length=Slider(0.8, range=0..10))  # -> Points, Tangents, Parameters
offset_2 = Offset(Curve=geometry_7, Distance=series_3, Plane=PlaneXY(0, 0, 0), Corners=1)
geometry_9 = Geometry(dash_pattern_2.Dashes)
dash_pattern_3 = DashPattern(Curve=offset, Pattern=panel_10)  # -> Dashes, Gaps
shift_list = ShiftList(List=divide_length_2.Points, Shift=Slider(5, range=0..10), Wrap=True)

# ---- group: This is a Cluster! It contains a lot of Grasshopper components inside it. Double-click me to see what's going on inside.
offsetlines_2 = OffsetLines(offset_distance=Slider(0.8, range=0..1), curve=dash_pattern.Dashes)  # -> simplify(geometry_5)

# ----
unit_z = UnitZ(Factor=1)
radians = Radians(Degrees=Slider(85, range=0..360))
geometry_10 = Geometry(offset_2)
geometry_11 = Geometry(offsetlines)
custom_preview = CustomPreview(Geometry=geometry_9, Shader=ColourSwatch(SwatchColor=RGB(0, 0, 0)))
geometry_12 = Geometry(dash_pattern_3.Dashes)
unit_z_2 = UnitZ(Factor=1)
radians_2 = Radians(Degrees=Slider(54, range=0..360))
line = Line(StartPoint=shift_list, EndPoint=divide_length_2.Points)
rotate = Rotate(Vector=divide_length.Tangents, Axis=unit_z, Angle=radians)
custom_preview_2 = CustomPreview(Geometry=geometry_11, Shader=ColourSwatch(SwatchColor=RGB(0, 0, 0)))
geometry_13 = Geometry(offsetlines_2)
custom_preview_3 = CustomPreview(Geometry=geometry_10, Shader=ColourSwatch(SwatchColor=RGB(0, 0, 0)))
custom_preview_4 = CustomPreview(Geometry=geometry_12, Shader=ColourSwatch(SwatchColor=RGB(0, 0, 0)))
rotate_2 = Rotate(Vector=divide_length_3.Tangents, Axis=unit_z_2, Angle=radians_2)
line_sdl = LineSDL(Start=divide_length_4.Points, Direction=divide_length_4.Tangents, Length=Slider(7, range=0..100))
geometry_14 = Geometry(line)
number_slider = Slider(1.4, range=0..10)
line_sdl_2 = LineSDL(Start=divide_length.Points, Direction=rotate, Length=1)
custom_preview_5 = CustomPreview(Geometry=geometry_14, Shader=ColourSwatch(SwatchColor=RGB(0, 0, 0)))
custom_preview_6 = CustomPreview(Geometry=geometry_13, Shader=ColourSwatch(SwatchColor=RGB(0, 0, 0)))
geometry_15 = Geometry(line_sdl)
amplitude = Amplitude(Vector=rotate_2, Amplitude=number_slider)
custom_preview_7 = CustomPreview(Geometry=geometry_15, Shader=ColourSwatch(SwatchColor=RGB(0, 0, 0)))
geometry_16 = Geometry(line_sdl_2)
move_10 = Move(Geometry=divide_length_3.Points, Motion=amplitude)  # -> Geometry, Transform
reverse = Reverse(Vector=rotate_2)
multiplication = Multiplication(A=number_slider, B="2")
custom_preview_8 = CustomPreview(Geometry=geometry_16, Shader=ColourSwatch(SwatchColor=RGB(0, 0, 0)))
line_sdl_3 = LineSDL(Start=move_10.Geometry, Direction=reverse, Length=multiplication)
geometry_17 = Geometry(line_sdl_3)
mirror_curve = MirrorCurve(Geometry=geometry_17, Curve=geometry_6, Tangent=True)
custom_preview_9 = CustomPreview(Geometry=mirror_curve, Shader=ColourSwatch(SwatchColor=RGB(0, 0, 0)))

# ==== cluster OffsetLines
# Explanation: Grafting is done so that, instead of:
# "one list of many curves",
# we have
# "many lists of one curves each".
# 
# The term branch is also used to talk about lists in a tree structure, so we have
# "many branches of one curve each."
# 
# When we do this, any operation done on the curves is done on each list at a time, and therefore each curve at a time.
# 
# In other words, all the operations will work individually on each curve, rather than onto all the curves at the same time.
curve = ClusterInput()
offset_distance = ClusterInput()

# ---- group: We're grafting this set of curves.
curve_2 = Curve(graft(curve))

# ----
offset_distance_2 = Number(offset_distance)

# ---- group: Get whether or not the curves are closed or open.
closed = Closed(Curve=curve_2)  # -> Closed, Periodic

# ---- group: We're dividing our workflow into two, depending on whether the curves are closed or not.
sift_pattern = SiftPattern(List=curve_2, SiftPattern=closed.Closed)  # -> Output0, Output1

# ---- group: We're offseting the original curves in both directions, and connecting their end and start points together, creating four lines from every line
negative = Negative(Value=offset_distance_2)
offset = Offset(Curve=sift_pattern.Output0, Distance=offset_distance_2, Plane=PlaneXY(0, 0, 0), Corners=1)
offset_2 = Offset(Curve=sift_pattern.Output0, Distance=negative, Plane=PlaneXY(0, 0, 0), Corners=1)
end_points = EndPoints(Curve=offset)  # -> Start, End
end_points_2 = EndPoints(Curve=offset_2)  # -> Start, End
line = Line(StartPoint=end_points_2.Start, EndPoint=end_points.Start)
line_2 = Line(StartPoint=end_points_2.End, EndPoint=end_points.End)
# Explanation: The Merge component is really important, because it pairs up the four sets of curve within each branch/list.
# 
# This means that, when we plug the output of this component into another one, the next component will operate on each set of four curves.
# 
# So - the Join Curves component will merge four curves at a time to create a 'silhouette' or 'outline' of a curve, that we can then plug into the Boundary Surfaces component.
merge = Merge(Data1=simplify(line), Data2=simplify(offset_2), Data3=simplify(line_2), Data4=simplify(offset))

# ---- group: The closed curves
geometry = Geometry(sift_pattern.Output1)

# ---- group: Offset the curves in both directions, combine them with the original geometry, and turn into boundary surfaces.
negative_2 = Negative(Value=offset_distance_2)
# Explanation: The Merge component is really important, because it pairs up the two sets of normal and offset curves together within each branch/list.
# 
# This means that, when we plug the output of this component into another one, the next component will operate on each pair of curves.
# 
# So - the Boundary Surfaces component will work on just two curves at a time -- the normal and offset curves -- and not all of the curves at once.
offset_3 = Offset(Curve=geometry, Distance=offset_distance_2, Plane=PlaneXY(0, 0, 0), Corners=1)
offset_4 = Offset(Curve=geometry, Distance=negative_2, Plane=PlaneXY(0, 0, 0), Corners=1)
merge_2 = Merge(Data1=simplify(offset_4), Data2=simplify(offset_3))
boundary_surfaces = BoundarySurfaces(Edges=merge_2)

# ----
panel = Panel(merge_2)
join_curves = JoinCurves(Curves=merge, Preserve=False)
geometry_2 = Geometry(boundary_surfaces)
boundary_surfaces_2 = BoundarySurfaces(Edges=join_curves)
geometry_3 = Geometry(boundary_surfaces_2)

# ---- group: This combines the two sets of geometry
combine_data = CombineData(Input0=geometry_3, Input1=geometry_2)  # -> simplify(Result), Index

# ----
geometry_4 = Geometry(combine_data.Result)
geometry_5 = ClusterOutput(geometry_4)
