# Grasshopper definition random_letter_drawing.ghx (Grasshopper 0.9.76)

# ---- group: Create a grid of points.
number_slider = Slider(10, range=0..10)
# Grasshopper Challenges
# By Dan Taeyoung, 2016. https://github.com/provolot/GrasshopperChallenges
# Example 1: Represenation example: random letter movements
construct_point = ConstructPoint(XCoordinate=Slider(100, range=0..100), YCoordinate=0, ZCoordinate=0)
geometry = Geometry(construct_point)
number_slider_2 = Slider(15, range=0..20)
rectangle = Rectangle(Plane=PlaneXY(0, 0, 0), XSize=number_slider, YSize=number_slider, Radius=0)  # -> Rectangle, Length
rectangular_array = RectangularArray(Geometry=geometry, Cell=rectangle.Rectangle, XCount=number_slider_2, YCount=number_slider_2)  # -> Geometry, Transform

# ---- group: How many points do we have in our grid?
# Explanation: This is not so much a set of challenges, but an example to illustrate how to use Grasshopper as a representation tool.
list_length = ListLength(List=rectangular_array.Geometry)

# ---- group: Pick a random letter of the alphabet
characters = Characters(Text="abcdefghijklmnopqrstuvwxyz")  # -> Result, Unicode
list_length_2 = ListLength(List=characters.Result)
number = Number(list_length)
random = Random(Range=list_length_2, Number=number, Seed=2)
list_item = ListItem(List=characters.Result, Index=random, Wrap=True)
panel = Panel(list_item)

# ---- group: These are the points on the grid. It's often helpful to create components in the middle of the canvas so you don't have to scroll all the way to the left to understand what some data may be.
point = Point(rectangular_array.Geometry)

# ---- group: Create a bunch of random letters on each point of the grid
number_slider_3 = Slider(0.1, range=0..0.1)
c_script = CSharpScript(face="Helvetica", bold=Toggle(True), italics=Toggle(False), size=Slider(18.35, range=0..21), content=panel, pl=point)  # -> out, A; inputs face: String, bold: Boolean, italics: Boolean, size: Double, content: String, pl: Plane
# ---------- c_script: C# ----------
    if(size == 0)
      size = 1;

    if(!string.IsNullOrEmpty(face) && size > 0 && !string.IsNullOrEmpty(content) &&
      pl.IsValid)
    {

      var te = RhinoDoc.ActiveDoc.Objects.AddText(content, pl, size, face, bold, italics);
      Rhino.DocObjects.TextObject txt = RhinoDoc.ActiveDoc.Objects.Find(te) as Rhino.DocObjects.TextObject;

      if(txt != null)
      {
        var tt = txt.Geometry as Rhino.Geometry.TextEntity;
        A = tt.Explode();
      }
      
      RhinoDoc.ActiveDoc.Objects.Delete(te, true);
    }
# ---------- end c_script ----------
simplify_curve = SimplifyCurve(Curve=c_script.A, Tolerance=number_slider_3, AngleTolerance=number_slider_3)  # -> Curve, Simplified
boundary_surfaces = BoundarySurfaces(Edges=simplify_curve.Curve)

# ---- group: Move the letters to be center-justified.
surface = Surface(flatten(boundary_surfaces))
point_2 = Point(point)
area = Area(Geometry=flatten(surface))  # -> Area, Centroid
vector_2pt = Vector2Pt(PointA=area.Centroid, PointB=point_2, Unitize=False)  # -> Vector, Length
move = Move(Geometry=surface, Motion=vector_2pt.Vector)  # -> Geometry, Transform

# ---- group: Number of points in our grid
number_2 = Number(list_length)

# ---- group: Let's create a random vector pointing in a random direction for each point in our array.
construct_domain = ConstructDomain(DomainStart=Slider(-13, range=-20..20), DomainEnd=Slider(8, range=-20..20))
random_2 = Random(Range=construct_domain, Number=number_2, Seed=Slider(444, range=0..1000))
random_3 = Random(Range=construct_domain, Number=number_2, Seed=Slider(3434, range=0..10000))
vector_xyz = VectorXYZ(XComponent=random_3, YComponent=random_2, ZComponent=0)  # -> Vector, Length

# ---- group: Let's create a random vector pointing in a random direction for each point in our array. / Then move the letters randomly
move_2 = Move(Geometry=move.Geometry, Motion=vector_xyz.Vector)  # -> Geometry, Transform

# ---- group: These are the points on the grid. It's often helpful to create components in the middle of the canvas so you don't have to scroll all the way to the left to understand what some data may be.
point_3 = Point(rectangular_array.Geometry)

# ---- group: Slice each letters into lines to create our own 'hatch' pattern.
contour = Contour(Shape=move_2.Geometry, Point=Point(0, 0, 0), Direction=vector_xyz.Vector, Distance=Slider(1, range=0..4))
geometry_2 = Geometry(contour)
custom_preview = CustomPreview(Geometry=geometry_2, Shader=ColourSwatch(SwatchColor=RGB(0, 0, 0)))

# ---- group: Create our own arced dotted lines / Create a set of lines moving from start points to our random end points
line_sdl = LineSDL(Start=point_3, Direction=vector_xyz.Vector, Length=vector_xyz.Length)

# ---- group: Create our own arced dotted lines
geometry_3 = Geometry(line_sdl)
end_points = EndPoints(Curve=geometry_3)  # -> Start, End
unit_x = UnitX(Factor=1)
xy_plane = XYPlane(Origin=end_points.End)
number_slider_4 = Slider(1.6, range=0..10)
number_slider_5 = Slider(3, range=0..10)
panel_2 = Panel("1,0.1")

# ---- group: Create our own arced dotted lines / Create a set of circular arcs
arc_sed = ArcSED(Start=end_points.Start, End=end_points.End, Direction=unit_x)  # -> Arc, Plane, Radius

# ---- group: Create our own arced dotted lines / Rotate an XY plane - this lets us rotate the triangle at the end of a line as if it were an arrowhead.
align_plane = AlignPlane(Plane=xy_plane, Direction=geometry_3)  # -> Plane, Angle

# ---- group: Create our own arced dotted lines / Make the arcs into a dashed pattern
dash_pattern = DashPattern(Curve=arc_sed.Arc, Pattern=panel_2)  # -> Dashes, Gaps

# ---- group: Create our own arced dotted lines / Create an 'arrowhead' with a triangle
polygon = Polygon(Plane=align_plane.Plane, Radius=number_slider_4, Segments=number_slider_5, FilletRadius=0)  # -> Polygon, Length

# ---- group: Create our own arced dotted lines (continued)
geometry_4 = Geometry([dash_pattern.Dashes, polygon.Polygon])

# ----
custom_preview_2 = CustomPreview(Geometry=geometry_4, Shader=ColourSwatch(SwatchColor=RGB(124, 120, 121)))
