# Grasshopper definition GH_Challenges_A_Intro_to_Grasshopper.ghx (Grasshopper 1.0.7)

panel = Panel("Challenge A2")
panel_2 = Panel("Challenge A3")
panel_3 = Panel("Challenge A1")
# Grasshopper Challenges
# By Dan Taeyoung, 2016. https://github.com/provolot/GrasshopperChallenges
# Challenges A - Intro to Grasshopper
# Connect the slider to the panel!
panel_4 = Panel("Challenge A0")
panel_5 = Panel("Challenge A4")
panel_6 = Panel("Challenge A9")
number_slider = Slider(10, range=0..10)
# Click and drag from this circle - this is an output,
# and you can create wires that let you plug into other inputs.
number_slider_2 = Slider(0, range=0..10)
pt = ConstructPoint(XCoordinate=250, YCoordinate=0, ZCoordinate=0)
# Set the number in the panel to exactly 3.14.
number_slider_3 = Slider(0, range=0..10)
# Change the slider to set the number in the panel to 7 (or 7.0).
number_slider_4 = Slider(0, range=0..10)

# ---- group: This defines a point in XYZ space. Hover over 'x, 'y', and 'z' to see what the coordinates of the point are.
pt_2 = ConstructPoint(XCoordinate=0, YCoordinate=0, ZCoordinate=0)

# ----
pt_3 = ConstructPoint(XCoordinate=200, YCoordinate=0, ZCoordinate=0)
pt_4 = ConstructPoint(XCoordinate=150, YCoordinate=0, ZCoordinate=0)
pt_5 = ConstructPoint(XCoordinate=100, YCoordinate=0, ZCoordinate=0)
# Combining A8 and A10, create a set of 10 cylinders that gradually increase both in diameter and in height.
displaytext = DisplayText(challenge="Challenge A11", loc=pt)
pt_6 = ConstructPoint(XCoordinate=50, YCoordinate=0, ZCoordinate=0)
# Remove the middle slider and make one new connection so that the circles gradually increase in radius.
displaytext_2 = DisplayText(challenge="Challenge A10", loc=pt_3)
# Delete one slider and rewire components, so that one slider makes the cylinder increase/decrease in both height and diameter.
displaytext_3 = DisplayText(challenge="Challenge A8", loc=pt_4)

# ---- group: You can ignore this - this displays 'Challenge A5' in Rhino's 3d space.
# Add a Slider as an input to the Circle component, and create a circle with an area larger than 300 (square units).
displaytext_4 = DisplayText(challenge="Challenge A5", loc=pt_2)

# ----
# Add Sliders as inputs to the 'Series' component in order to create 20 odd numbers, starting at 1. ex: "1, 3, 5.."
series = Series(Start=0, Step=1, Count=10)
# Create a cylinder by only adding one 'Extrude' component, and extruding the circle with the vector (direction) pointing along the Z axis.
displaytext_5 = DisplayText(challenge="Challenge A7", loc=pt_5)
# Removing the Circle component and using the Polygon component instead, create a 9-sided 'nonagon'.
displaytext_6 = DisplayText(challenge="Challenge A6", loc=pt_6)
# Changing only the slider and its properties, set the number in the panel to 50.
addition = Addition(A=Slider(0, range=0..10), B="10")
# Changing only the slider, set the number in the Multiplication panel to exactly 9000.
division = Division(A=number_slider, B="-10")

# ---- group: Remove me!
number_slider_5 = Slider(40, range=0..100)

# ----
multiplication = Multiplication(A=number_slider, B="-10")
multiplication_2 = Multiplication(A=number_slider, B="-10")
series_2 = Series(Start=1, Step=22, Count=Slider(10, range=0..10))

# ---- group: This is a panel - it helps you visualize data and geometry.
panel_7 = Panel()

# ----
series_3 = Series(Start=1, Step=22, Count=10)
Z = UnitZ(Factor=Slider(17, range=0..20))
panel_8 = Panel(number_slider_3)
cir = Circle(Plane=pt_4, Radius=Slider(5.596, range=0..10))

# ---- group: This is a 'Z' vector, and represents movement in the Z axis direction ("upwards").
Z_2 = UnitZ(Factor=Slider(20, range=0..20))

# ----
panel_9 = Panel(number_slider_4)
panel_10 = Panel(addition)
panel_11 = Panel(division)
multiplication_panel = Panel(multiplication)
panel_12 = Panel(multiplication_2)
cir_2 = Circle(Plane=pt_5, Radius=Slider(5, range=0..10))
panel_13 = Panel(series)

# ---- group: Add a slider to this component
cir_3 = Circle(Plane=pt_2, Radius=1)

# ---- group: Remove this component
cir_4 = Circle(Plane=pt_6, Radius=Slider(5, range=0..10))

# ----
polygon = Polygon(Plane=PlaneXY(0, 0, 0), Radius=3, Segments=6, FilletRadius=0)  # -> Polygon, Length
pt_7 = ConstructPoint(XCoordinate=200, YCoordinate=series_2, ZCoordinate=0)
pt_8 = ConstructPoint(XCoordinate=200, YCoordinate=series_3, ZCoordinate=0)
division_2 = Division(A=number_slider_5, B=Slider(4, range=0..10))
extr = Extrude(Base=cir, Direction=Z)
checker = Checker_2(data=panel_8)
checker_2 = Checker_3(data=panel_10)
checker_3 = Checker_7(data=series)
checker_4 = Checker(data=panel_9)
checker_5 = Checker_4(data=multiplication_panel)

# ---- group: These components are here to give you feedback as part of these challenges.
checker_6 = Checker_11(data=panel_7)
panel_14 = Panel(checker_6)

# ----
area = Area(Geometry=cir_3)  # -> Area, Centroid
checker_7 = Checker_5(data=cir_4)
# Zoom in (with the scroll wheel) to view hints.
# Hint:
# Right-click on the Slider and select "Edit" to change its properties.
#  By clicking the letters in the "Rounding" section you can control
# whether it creates decimal or whole numbers.
panel_15 = Panel(checker)
panel_16 = Panel(checker_2)
panel_17 = Panel(checker_4)
panel_18 = Panel(checker_3)
panel_19 = Panel(checker_5)

# ---- group: Notice that there are many different 'extrude' components - this one is the one you want.
extr_2 = Extrude()

# ----
panel_20 = Panel(checker_7)

# ---- group: (Notice how the 'Area' component also returns the center of the circle. Often, components will return many different helpful results).
geo = Geometry(area.Centroid)

# ---- group: These also extrude, but in different ways.
extrcrv = ExtrudeAlong()
extrude = ExtrudeLinear(OrientationP=PlaneXY(0, 0, 0))
extr_3 = ExtrudePoint()

# ----
panel_21 = Panel(area.Area)
cir_5 = Circle(Plane=pt_7, Radius=division_2)
geo_2 = Geometry()

# ---- group: This component just 'caps' the top and bottom of the cylinder - same as 'Cap' in Rhino.
# (There's no 'correct' box for this challenge)
cap = CapHoles(Brep=extr)

# ----
checker_8 = Checker_10(data=geo_2)
checker_9 = Checker_6(data=area.Area)
geo_3 = Geometry(cir_5)
geo_4 = Geometry()
checker_10 = Checker_9(data=geo_3)
# The 'List' in 'Sift Pattern' can take any kind of list, not just lists of numbers.
panel_22 = Panel(checker_8)
panel_23 = Panel(checker_9)
checker_11 = Checker_8(data=geo_4)
panel_24 = Panel(checker_10)
# Hint:
# Search the menu above for 'Extrude'. Alternately, double-click on the Grasshopper canvas - this will bring up a search menu. Type 'Extrude', and choose the plain 'Extrude', not 'Extrude Along', etc..
panel_25 = Panel(checker_11)

# ==== cluster Checker
data = ClusterInput()
data_2 = Data(data)
equality = Equality(FirstNumber="7", SecondNumber=data_2)  # -> Equality, Inequality
stream_filter = StreamFilter(Gate=equality.Equality, Stream0=" ", Stream1="Correct!")
data_3 = Data(stream_filter)
data_4 = ClusterOutput(data_3)

# ==== cluster Checker_2
data = ClusterInput()
data_2 = Data(data)
equality = Equality(FirstNumber="3.14", SecondNumber=data_2)  # -> Equality, Inequality
stream_filter = StreamFilter(Gate=equality.Equality, Stream0=" ", Stream1="Correct!")
data_3 = Data(stream_filter)
data_4 = ClusterOutput(data_3)

# ==== cluster Checker_3
data = ClusterInput()
data_2 = Data(data)
equality = Equality(FirstNumber="50", SecondNumber=data_2)  # -> Equality, Inequality
stream_filter = StreamFilter(Gate=equality.Equality, Stream0=" ", Stream1="Correct!")
data_3 = Data(stream_filter)
data_4 = ClusterOutput(data_3)

# ==== cluster Checker_4
data = ClusterInput()
data_2 = Data(data)
equality = Equality(FirstNumber="9000", SecondNumber=data_2)  # -> Equality, Inequality
stream_filter = StreamFilter(Gate=equality.Equality, Stream0=" ", Stream1="Correct!")
data_3 = Data(stream_filter)
data_4 = ClusterOutput(data_3)

# ==== cluster Checker_5
data = ClusterInput()
data_2 = Data(data)
explode = Explode(Curve=data_2, Recursive=True)  # -> Segments, Vertices
list_length = ListLength(List=explode.Segments)
equality = Equality(FirstNumber="9", SecondNumber=list_length)  # -> Equality, Inequality
stream_filter = StreamFilter(Gate=equality.Equality, Stream0=" ", Stream1="Correct!")
null_item = NullItem(Item=equality.Equality)  # -> NullFlags, InvalidFlags, Description
stream_filter_2 = StreamFilter(Gate=null_item.NullFlags, Stream0=stream_filter, Stream1=" ")
data_3 = Data(stream_filter_2)
data_4 = ClusterOutput(data_3)

# ==== cluster Checker_6
data = ClusterInput()
data_2 = Data(data)
larger_than = LargerThan(FirstNumber=data_2, SecondNumber="300")  # -> LargerThan, OrEqualTo
stream_filter = StreamFilter(Gate=larger_than.LargerThan, Stream0=" ", Stream1="Correct!")
data_3 = Data(stream_filter)
data_4 = ClusterOutput(data_3)

# ==== cluster Checker_7
data = ClusterInput()
data_2 = Data(data)
mass_addition = MassAddition(Input=data_2)  # -> Result, PartialResults
equality = Equality(FirstNumber="400", SecondNumber=mass_addition.Result)  # -> Equality, Inequality
stream_filter = StreamFilter(Gate=equality.Equality, Stream0=" ", Stream1="Correct!")
null_item = NullItem(Item=equality.Equality)  # -> NullFlags, InvalidFlags, Description
stream_filter_2 = StreamFilter(Gate=null_item.NullFlags, Stream0=stream_filter, Stream1=" ")
data_3 = Data(stream_filter_2)
data_4 = ClusterOutput(data_3)

# ==== cluster Checker_8
data = ClusterInput()
data_2 = Data(data)
brep_topology = BrepTopology(Brep=data_2, PerspectiveOnly=False)  # -> FaceFaceAdjacency, FaceEdgeAdjacency, EdgeFaceAdjacency
data_recorder = DataRecorder(data_2, DataLimit=10, RecordData=True)
list_length = ListLength(List=brep_topology.FaceEdgeAdjacency)
panel = Panel(data_recorder)
equality = Equality(FirstNumber="3", SecondNumber=list_length)  # -> Equality, Inequality
panel_2 = Panel(brep_topology.FaceEdgeAdjacency)
stream_filter = StreamFilter(Gate=equality.Equality, Stream0=" ", Stream1="Correct!")
null_item = NullItem(Item=equality.Equality)  # -> NullFlags, InvalidFlags, Description
stream_filter_2 = StreamFilter(Gate=null_item.NullFlags, Stream0=stream_filter, Stream1=" ")
data_3 = Data(stream_filter_2)
data_4 = ClusterOutput(data_3)

# ==== cluster Checker_9
data = ClusterInput()
data_2 = Data(data)
area = Area(Geometry=data_2)  # -> Area, Centroid
panel = Panel("10")
list_item = ListItem(List=area.Area, Index=0, Wrap=True)  # -> Item1, Item
larger_than = LargerThan(FirstNumber=list_item.Item1, SecondNumber=list_item.Item)  # -> LargerThan, OrEqualTo
stream_filter = StreamFilter(Gate=larger_than.LargerThan, Stream0=" ", Stream1="Correct!")
null_item = NullItem(Item=larger_than.LargerThan)  # -> NullFlags, InvalidFlags, Description
stream_filter_2 = StreamFilter(Gate=null_item.NullFlags, Stream0=stream_filter, Stream1=" ")
data_3 = Data(stream_filter_2)
data_4 = ClusterOutput(data_3)

# ==== cluster Checker_10
data = ClusterInput()
data_2 = Data(data)
volume = Volume(Geometry=data_2)  # -> Volume, Centroid
panel = Panel("10")
list_item = ListItem(List=volume.Volume, Index=0, Wrap=True)  # -> Item1, Item
larger_than = LargerThan(FirstNumber=list_item.Item1, SecondNumber=list_item.Item)  # -> LargerThan, OrEqualTo
stream_filter = StreamFilter(Gate=larger_than.LargerThan, Stream0=" ", Stream1="Correct!")
null_item = NullItem(Item=larger_than.LargerThan)  # -> NullFlags, InvalidFlags, Description
stream_filter_2 = StreamFilter(Gate=null_item.NullFlags, Stream0=stream_filter, Stream1=" ")
data_3 = Data(stream_filter_2)
data_4 = ClusterOutput(data_3)

# ==== cluster Checker_11
data = ClusterInput()
data_2 = Data(data)
number = Number(data_2)
null_item = NullItem(Item=number)  # -> NullFlags, InvalidFlags, Description
gate_not = GateNot(A=null_item.NullFlags)
stream_filter = StreamFilter(Gate=gate_not, Stream0=" ", Stream1="Correct!")
data_3 = Data(stream_filter)
data_4 = ClusterOutput(data_3)

# ==== cluster DisplayText
md_slider = MDSlider(
    SliderMode=0,
    slider_value=Point(0, 0.07560916063, 0.5),
    x_domain=Domain(-10, 10),
    y_domain=Domain(-10, 10),
    z_domain=Domain(0, 1))
loc = ClusterInput()
loc_2 = Data(loc)
challenge = ClusterInput()
bool = Boolean(True)
move = Move(Geometry=loc_2, Motion=md_slider)  # -> Geometry, Transform
challenge_2 = Data(challenge)
c_script = CSharpScript(face="Arial", bold=bool, size=Slider(3.046, range=0..11), content=challenge_2, pl=move.Geometry)  # -> out, A; inputs face: String, bold: Boolean, italics: Boolean, size: Double, content: String, pl: Plane
# ---------- c_script: C# ----------
    if(size == 0)
      size = 1;

    if(!string.IsNullOrEmpty(face) && size > 0 && !string.IsNullOrEmpty(content) &&
      pl.IsValid)
    {

      var te = RhinoDoc.ActiveDoc.Objects.AddText(content, pl, size, face, bold, italics);
      Rhino.DocObjects.TextObject txt = RhinoDoc.ActiveDoc.Objects.Find(te) as Rhino.DocObjects.TextObject;

      if(txt != null)
      {
        var tt = txt.Geometry as Rhino.Geometry.TextEntity;
        A = tt.Explode();
      }
      
      RhinoDoc.ActiveDoc.Objects.Delete(te, true);
    }
# ---------- end c_script ----------
boundary = BoundarySurfaces(Edges=c_script.A)
S = ClusterOutput(boundary)
