# Grasshopper definition GH_Challenges_B_Logic.gh (Grasshopper 0.9.76)

# Grasshopper Challenges
# By Dan Taeyoung, 2016. https://github.com/provolot/GrasshopperChallenges
# Challenges B - Intro to Logic
# Challenge B1: Change the slider values only to make both results return True.
number_slider = Slider(0, range=0..10)
number_slider_2 = Slider(0, range=0..10)
# Challenge B4: Copy-paste the definition from Challenge B2 above, and use it to filter for spheres with volume above 1000 (cube units).
geometry = Geometry([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])
# Challenge B2: Change the slider value to only sift for the numbers that are larger than 100.
input_numbers = Panel("""3
4
10
602
3.4
403
30
1493""")
# Challenge B3: By creating one slider and one 'Equality' component, select all of the numbers that are divisible by 3.
series = Series(Start=0, Step=1, Count=20)
volume = Volume(Geometry=geometry)  # -> Volume, Centroid
panel = Panel(series)
larger_than = LargerThan(FirstNumber=input_numbers, SecondNumber=Slider(1000, range=0..1000))  # -> LargerThan, OrEqualTo
larger_than_2 = LargerThan(FirstNumber=number_slider, SecondNumber=number_slider_2)  # -> LargerThan, OrEqualTo
smaller_than = SmallerThan(FirstNumber=number_slider_2, SecondNumber=Slider(0, range=0..10))  # -> SmallerThan, OrEqualTo
panel_2 = Panel(volume.Volume)

# ---- group: The 'Modulus' component calculates the remainder after division.
modulus = Modulus(A=panel, B=Slider(3, range=0..10))

# ----
panel_3 = Panel(larger_than.LargerThan)
panel_4 = Panel(smaller_than.SmallerThan)
# Double-click on the Slider on the 'Number Slider' text (or Right-click)  to edit the Slider properties.
panel_5 = Panel(larger_than_2.LargerThan)
panel_6 = Panel(modulus)
dispatch = Dispatch(List=input_numbers, DispatchPattern=panel_3)  # -> ListA, ListB
checker = Checker_4(data=panel_5, data_3=panel_4)
# Search the menu above for 'Extrude'. Alternately, double-click on the Grasshopper canvas - this will bring up a search menu. Type 'Extrude', and choose the plain 'Extrude', not 'Extrude Along', etc..
panel_7 = Panel(checker)
sift_pattern_true = Panel(dispatch.ListA)
sift_pattern_false = Panel(dispatch.ListB)
dispatch_2 = Dispatch(List=panel, DispatchPattern=[True, False])  # -> ListA, ListB
checker_2 = Checker(data=sift_pattern_true)
# even/odd?
# even/odd?
geometry_2 = Geometry()
panel_8 = Panel(checker_2)
checker_3 = Checker_2(data=geometry_2)
panel_9 = Panel(dispatch_2.ListA)
# Hint:
# The 'List' in 'Dispatch' can take any kind of list, not just lists of numbers.
panel_10 = Panel(checker_3)
checker_4 = Checker_3(data=panel_9)
panel_11 = Panel(checker_4)

# ==== cluster Checker
data = ClusterInput()
data_2 = Data(data)
list_length = ListLength(List=data_2)
equality = Equality(FirstNumber="3", SecondNumber=list_length)  # -> Equality, Inequality
stream_filter = StreamFilter(Gate=equality.Equality, Stream0=" ", Stream1="Correct!")
null_item = NullItem(Item=equality.Equality)  # -> NullFlags, InvalidFlags, Description
stream_filter_2 = StreamFilter(Gate=null_item.NullFlags, Stream0=stream_filter, Stream1=" ")
data_3 = Data(stream_filter_2)
data_4 = ClusterOutput(data_3)

# ==== cluster Checker_2
data = ClusterInput()
data_2 = Data(data)
volume = Volume(Geometry=data_2)  # -> Volume, Centroid
mass_addition = MassAddition(Input=volume.Volume)  # -> Result, PartialResults
similarity = Similarity(FirstNumber=mass_addition.Result, SecondNumber="16737", Threshold=0.1)  # -> Similarity, AbsoluteDifference
equality = Equality(FirstNumber="5")  # -> Equality, Inequality
stream_filter = StreamFilter(Gate=similarity.Similarity, Stream0=" ", Stream1="Correct!")
null_item = NullItem(Item=similarity.Similarity)  # -> NullFlags, InvalidFlags, Description
stream_filter_2 = StreamFilter(Gate=null_item.NullFlags, Stream0=stream_filter, Stream1=" ")
data_3 = Data(stream_filter_2)
data_4 = ClusterOutput(data_3)

# ==== cluster Checker_3
data = ClusterInput()
data_2 = Data(data)
mass_addition = MassAddition(Input=data_2)  # -> Result, PartialResults
equality = Equality(FirstNumber="63", SecondNumber=mass_addition.Result)  # -> Equality, Inequality
stream_filter = StreamFilter(Gate=equality.Equality, Stream0=" ", Stream1="Correct!")
null_item = NullItem(Item=equality.Equality)  # -> NullFlags, InvalidFlags, Description
stream_filter_2 = StreamFilter(Gate=null_item.NullFlags, Stream0=stream_filter, Stream1=" ")
data_3 = Data(stream_filter_2)
data_4 = ClusterOutput(data_3)

# ==== cluster Checker_4
data = ClusterInput()
data_2 = Data(data)
data_3 = ClusterInput()
list_length = ListLength(List=data_2)
data_4 = Data(data_3)
gate_and = GateAnd(A=data_2, B=data_4)
equality = Equality(FirstNumber="3", SecondNumber=list_length)  # -> Equality, Inequality
stream_filter = StreamFilter(Gate=gate_and, Stream0=" ", Stream1="Correct!")
null_item = NullItem(Item=gate_and)  # -> NullFlags, InvalidFlags, Description
stream_filter_2 = StreamFilter(Gate=null_item.NullFlags, Stream0=stream_filter, Stream1=" ")
data_5 = Data(stream_filter_2)
data_6 = ClusterOutput(data_5)
