# Grasshopper definition GH_Challenges_B_Logic.ghx (Grasshopper 0.9.76)

# Grasshopper Challenges
# By Dan Taeyoung, 2016. https://github.com/provolot/GrasshopperChallenges
# Challenges B - Intro to Logic
# Challenge B1: Change the slider values only to make both results return True.
number_slider = Slider(0, range=0..10)
boolean_toggle = BooleanToggle(False)
number_slider_2 = Slider(0, range=0..10)
# Challenge B7: Set the result of the operation to be 'True'.
boolean_toggle_2 = BooleanToggle(False)
# Challenge B8: Set the result of the operation to be 'True'.
boolean_toggle_3 = BooleanToggle(False)
# Challenge B4: Copy-paste the definition from Challenge B2 above, and use it to filter for spheres with volume above 1000 (cube units).
geometry = Geometry([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])
boolean_toggle_4 = BooleanToggle(False)
series = Series(Start=0, Step=1, Count=100)
# Challenge B6: Set the result of the OR operation to be "False".
boolean_toggle_5 = BooleanToggle(True)
boolean_toggle_6 = BooleanToggle(False)
# Challenge B9: Remembering Challenge B3, use the Gate logic we just learned to select the numbers that are only divisible by 3 or 7.
boolean_toggle_7 = BooleanToggle(False)
# Challenge B5: Set the result of the AND operation to be "True".
boolean_toggle_8 = BooleanToggle(False)
# Challenge B2: Change the slider value to only sift for the numbers that are larger than 100.
input_numbers = Panel("""3
4
10
602
3.4
403
30
1493""")
# Challenge B3: By creating one slider and one 'Equality' component, select all of the numbers that are divisible by 3.
series_2 = Series(Start=0, Step=1, Count=20)
volume = Volume(Geometry=geometry)  # -> Volume, Centroid
panel = Panel(series)
panel_2 = Panel(series_2)
gate_or = GateOr(A=boolean_toggle_4, B=boolean_toggle_6)
gate_or_2 = GateOr(A=boolean_toggle_5, B=Toggle(True))
gate_and = GateAnd(A=boolean_toggle_6, B=boolean_toggle_7)
gate_and_2 = GateAnd(A=boolean_toggle_8, B=Toggle(False))
larger_than = LargerThan(FirstNumber=input_numbers, SecondNumber=Slider(1000, range=0..1000))  # -> LargerThan, OrEqualTo
gate_and_3 = GateAnd(A=Toggle(False), B=boolean_toggle_4)
larger_than_2 = LargerThan(FirstNumber=number_slider, SecondNumber=number_slider_2)  # -> LargerThan, OrEqualTo
gate_and_4 = GateAnd(A=boolean_toggle_2, B=boolean_toggle)
gate_or_3 = GateOr(A=boolean_toggle, B=boolean_toggle_3)
smaller_than = SmallerThan(FirstNumber=number_slider_2, SecondNumber=Slider(0, range=0..10))  # -> SmallerThan, OrEqualTo
panel_3 = Panel(volume.Volume)
result = Panel(gate_and_2)
gate_not = GateNot(A=gate_and)
result_2 = Panel(gate_or_2)
gate_not_2 = GateNot(A=gate_and_3)

# ---- group: The 'Modulus' component calculates the remainder after division.
modulus = Modulus(A=panel_2, B=Slider(3, range=0..10))

# ----
panel_4 = Panel(larger_than.LargerThan)

# ---- group: The 'Modulus' component calculates the remainder after division.
modulus_2 = Modulus(A=panel, B=Slider(3, range=0..10))

modulus_3 = Modulus(A=panel, B=Slider(7, range=0..10))

# ----
gate_not_3 = GateNot(A=gate_and_4)
panel_5 = Panel(smaller_than.SmallerThan)
# Double-click on the Slider on the 'Number Slider' text (or Right-click)  to edit the Slider properties.
panel_6 = Panel(larger_than_2.LargerThan)
checker = Checker_6(data=result_2)
checker_2 = Checker_5(data=result)
panel_7 = Panel(modulus_2)
# even/odd?
panel_8 = Panel(modulus_3)
gate_and_5 = GateAnd(A=gate_or, B=gate_not)
panel_9 = Panel(modulus)
dispatch = Dispatch(List=input_numbers, DispatchPattern=panel_4)  # -> ListA, ListB
# Hint:
# If you're having trouble understanding what's going on, be sure to create a Panel and connect it to things to see what's going on.
gate_and_6 = GateAnd(A=gate_not_3, B=gate_or_3)
panel_10 = Panel(checker)
panel_11 = Panel(checker_2)
checker_3 = Checker_4(data=panel_6, data_3=panel_5)
gate_and_7 = GateAnd(A=gate_not_2, B=gate_and_5)
# Search the menu above for 'Extrude'. Alternately, double-click on the Grasshopper canvas - this will bring up a search menu. Type 'Extrude', and choose the plain 'Extrude', not 'Extrude Along', etc..
panel_12 = Panel(checker_3)
result_3 = Panel(gate_and_7)
sift_pattern_true = Panel(dispatch.ListA)
result_4 = Panel(gate_and_6)
sift_pattern_false = Panel(dispatch.ListB)
dispatch_2 = Dispatch(List=panel_2, DispatchPattern=[True, False])  # -> ListA, ListB
checker_4 = Checker(data=sift_pattern_true)
checker_5 = Checker_5(data=result_3)
checker_6 = Checker_5(data=result_4)
geometry_2 = Geometry()
panel_13 = Panel(checker_4)
panel_14 = Panel(checker_5)
panel_15 = Panel(checker_6)
checker_7 = Checker_2(data=geometry_2)
dispatch_3 = Dispatch(List=panel, DispatchPattern=[True, False])  # -> ListA, ListB
panel_16 = Panel(dispatch_2.ListA)
# Hint:
# The 'List' in 'Dispatch' can take any kind of list, not just lists of numbers.
panel_17 = Panel(checker_7)
checker_8 = Checker_3(data=panel_16)
panel_18 = Panel(dispatch_3.ListA)
panel_19 = Panel(checker_8)
checker_9 = Checker_7(data=panel_18)
panel_20 = Panel(checker_9)

# ==== cluster Checker
data = ClusterInput()
data_2 = Data(data)
list_length = ListLength(List=data_2)
equality = Equality(FirstNumber="3", SecondNumber=list_length)  # -> Equality, Inequality
stream_filter = StreamFilter(Gate=equality.Equality, Stream0=" ", Stream1="Correct!")
null_item = NullItem(Item=equality.Equality)  # -> NullFlags, InvalidFlags, Description
stream_filter_2 = StreamFilter(Gate=null_item.NullFlags, Stream0=stream_filter, Stream1=" ")
data_3 = Data(stream_filter_2)
data_4 = ClusterOutput(data_3)

# ==== cluster Checker_2
data = ClusterInput()
data_2 = Data(data)
geometry = Geometry(data_2)
volume = Volume(Geometry=geometry)  # -> Volume, Centroid
mass_addition = MassAddition(Input=volume.Volume)  # -> Result, PartialResults
similarity = Similarity(FirstNumber=mass_addition.Result, SecondNumber="16737", Threshold=0.1)  # -> Similarity, AbsoluteDifference
equality = Equality(FirstNumber="5")  # -> Equality, Inequality
stream_filter = StreamFilter(Gate=similarity.Similarity, Stream0=" ", Stream1="Correct!")
null_item = NullItem(Item=similarity.Similarity)  # -> NullFlags, InvalidFlags, Description
stream_filter_2 = StreamFilter(Gate=null_item.NullFlags, Stream0=stream_filter, Stream1=" ")
data_3 = Data(stream_filter_2)
data_4 = ClusterOutput(data_3)

# ==== cluster Checker_3
data = ClusterInput()
data_2 = Data(data)
mass_addition = MassAddition(Input=data_2)  # -> Result, PartialResults
equality = Equality(FirstNumber="63", SecondNumber=mass_addition.Result)  # -> Equality, Inequality
stream_filter = StreamFilter(Gate=equality.Equality, Stream0=" ", Stream1="Correct!")
null_item = NullItem(Item=equality.Equality)  # -> NullFlags, InvalidFlags, Description
stream_filter_2 = StreamFilter(Gate=null_item.NullFlags, Stream0=stream_filter, Stream1=" ")
data_3 = Data(stream_filter_2)
data_4 = ClusterOutput(data_3)

# ==== cluster Checker_4
data = ClusterInput()
data_2 = Data(data)
data_3 = ClusterInput()
list_length = ListLength(List=data_2)
data_4 = Data(data_3)
gate_and = GateAnd(A=data_2, B=data_4)
equality = Equality(FirstNumber="3", SecondNumber=list_length)  # -> Equality, Inequality
stream_filter = StreamFilter(Gate=gate_and, Stream0=" ", Stream1="Correct!")
null_item = NullItem(Item=gate_and)  # -> NullFlags, InvalidFlags, Description
stream_filter_2 = StreamFilter(Gate=null_item.NullFlags, Stream0=stream_filter, Stream1=" ")
data_5 = Data(stream_filter_2)
data_6 = ClusterOutput(data_5)

# ==== cluster Checker_5
data = ClusterInput()
data_2 = Data(data)
stream_filter = StreamFilter(Gate=data_2, Stream0=" ", Stream1="Correct!")
data_3 = Data(stream_filter)
data_4 = ClusterOutput(data_3)

# ==== cluster Checker_6
data = ClusterInput()
data_2 = Data(data)
gate_not = GateNot(A=data_2)
stream_filter = StreamFilter(Gate=gate_not, Stream0=" ", Stream1="Correct!")
data_3 = Data(stream_filter)
data_4 = ClusterOutput(data_3)

# ==== cluster Checker_7
data = ClusterInput()
data_2 = Data(data)
mass_addition = MassAddition(Input=data_2)  # -> Result, PartialResults
equality = Equality(FirstNumber="2208", SecondNumber=mass_addition.Result)  # -> Equality, Inequality
stream_filter = StreamFilter(Gate=equality.Equality, Stream0=" ", Stream1="Correct!")
null_item = NullItem(Item=equality.Equality)  # -> NullFlags, InvalidFlags, Description
stream_filter_2 = StreamFilter(Gate=null_item.NullFlags, Stream0=stream_filter, Stream1=" ")
data_3 = Data(stream_filter_2)
data_4 = ClusterOutput(data_3)
