# Grasshopper definition GH_Challenges_C_Lists.ghx (Grasshopper 0.9.76)

# Double-click on the Slider on the 'Number Slider' text (or Right-click)  to edit the Slider properties.
# Grasshopper Challenges
# By Dan Taeyoung, 2016. https://github.com/provolot/GrasshopperChallenges
# Challenges C - being nimble with Lists and Trees
panel = Panel("Challenge C0")
construct_point = ConstructPoint(XCoordinate=0, YCoordinate=0, ZCoordinate=0)
point = Point(Point(180, 39.22960831, 0))
number_slider = Slider(5, range=0..10)
point_2 = Point([Point(308.4024885, 70, 0), Point(308.4024885, 50, 0), Point(308.4024885, 30, 0), Point(308.4024885, 10, 0)])
geo = Geometry(Point(50, 0, 0))
point_3 = Point(Point(244.7599814, 31.74540076, 0))
pt = Point(Point(561.2548871, -34.81808073, 0))
panel_2 = Panel("Challenge C7")
# Add one 'Line' component to create a line between two points.
displaytext = DisplayText(challenge="Challenge C2", loc=point)
# Connect the 'Graft' component somewhere to create a 5x5 grid of points.
displaytext_2 = DisplayText(challenge="Challenge C1", loc=geo)
point_4 = Point(Point(464.2548871, -34.81808073, 0))
point_5 = Point(Point(393.2537864, 20.9515941, 0))
# Add a 'Line' component and a 'Graft' component to create all the possible lines between the four points and the five points.
displaytext_3 = DisplayText(challenge="Challenge C4", loc=point_2)
point_6 = Point(Point(446.7161594, 7.42604077, 0))
# Add one 'Line' component to create a line between one point and a list of five points.
displaytext_4 = DisplayText(challenge="Challenge C3", loc=point_3)
number_slider_2 = Slider(10, range=0..10)
displaytext_5 = DisplayText(challenge="Challenge C8", loc=pt)
# Using the answer from C5, move all of the circle-esque shapes onto the grid, then connect the 'Rotate' component to rotate all of the geometry together in the grid with the slider.
displaytext_6 = DisplayText(challenge="Challenge C6", loc=point_4)
unit_y = UnitY(Factor=1)
# Connect the 'Move' component to move the hexagon to each point location.
displaytext_7 = DisplayText(challenge="Challenge C5", loc=point_5)
# Add a 'Series' component to create a set of 10 points, incrementing in the Y direction.
displaytext_8 = DisplayText(challenge=panel, loc=construct_point)

geometry = Geometry(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)
point_7 = Point(Point(464.2548871, -34.81808073, 0))

# ---- group: This generates the x & y size of each grid 'rectangle'.
rectangle = Rectangle(Plane=PlaneXY(0, 0, 0), XSize=number_slider, YSize=number_slider, Radius=0)  # -> Rectangle, Length

# ----
geometry_2 = Geometry(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)
point_8 = Point(Point(393.2537864, 20.9515941, 0))

point_9 = Point([Point(391.7312824, 55.20557001, 0), Point(391.8084777, 56.93451418, 0), Point(392.9786943, 43.72579915, 0), Point(396.7889657, 41.48964297, 0), Point(395.8451172, 48.32924102, 0), Point(389.1970222, 43.45966327, 0), Point(402.3091418, 49.45130599, 0), Point(395.8346161, 59.10035069, 0)])
geometry_3 = Geometry([Point(50, 0, 0), Point(50, 20, 0), Point(50, 40, 0), Point(50, 60, 0), Point(50, 80, 0)])
number_slider_3 = Slider(5, range=0..10)
series = Series(Start=0, Step=Slider(20, range=0..100), Count=Slider(5, range=0..10))
pt_2 = Point(Point(540.6229375, 5.939928569, 0))
point_10 = Point([Point(264.7599814, 80, 0), Point(264.7599814, 60, 0), Point(264.7599814, 40, 0), Point(264.7599814, 20, 0), Point(264.7599814, 0, 0)])
point_11 = Point(Point(244.7599814, 31.74540076, 0))
point_12 = Point(Point(200, 40, 0))
point_13 = Point(Point(180, 39.22960831, 0))

# ---- group: This 'Seed' is an arbitrary number that will change the 'pseudorandomness' of the Random component.
# Combining challenges C6 and C7, create a grid of points; on that grid of points, place a polyline you have drawn, and rotate each polyline in-place with a random degree.
number_slider_4 = Slider(6319, range=0..10000)

# ----
# Change the existing definition to generate 10 random numbers from 0 to 2 * Pi (6.2831).
construct_domain = ConstructDomain(DomainStart=Slider(0, range=0..6.283), DomainEnd=Slider(10, range=0..10))
number_slider_5 = Slider(10, range=0..10)

# ---- group: This generates a rectangular array (a grid).
arrrec = RectangularArray(Geometry=point_6, Cell=rectangle.Rectangle, XCount=number_slider_2, YCount=number_slider_2)  # -> Geometry, Transform

# ----
number_slider_6 = Slider(1, range=0..1)
point_14 = Point([Point(328.4024885, 80, 0), Point(328.4024885, 60, 0), Point(328.4024885, 40, 0), Point(328.4024885, 20, 0), Point(328.4024885, 0, 0)])
point_15 = Point([Point(308.4024885, 70, 0), Point(308.4024885, 50, 0), Point(308.4024885, 30, 0), Point(308.4024885, 10, 0)])
unit_x = UnitX(Factor=series)

# ---- group: This generates the x & y size of each grid 'rectangle'.
rectangle_2 = Rectangle(Plane=PlaneXY(0, 0, 0), XSize=number_slider_3, YSize=number_slider_3, Radius=0)  # -> Rectangle, Length

# ---- group: in Grasshopper, 'Move' effectively functions as copying, as it moves the original point and creates a new one.
move = Move(Geometry=construct_point, Motion=unit_y)  # -> Geometry, Transform

# ----
vector_2pt = Vector2Pt(PointA=point_8, PointB=point_9, Unitize=False)  # -> Vector, Length
# Compare with example result:
example_result = Geometry([Point(807.3078012, 136.3755215, 0), Point(797.3078012, 126.3755215, 0), Point(787.3078012, 116.3755215, 0), Point(777.3078012, 106.3755215, 0), Point(767.3078012, 96.37552148, 0), Point(807.3078012, 126.3755215, 0)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])
# Create a set of points that looks like a pyramid. Do this by using the components below.
# (This is pretty difficult. Feel free to come back to this later.)
displaytext_9 = DisplayText(challenge="Extra-Challenge E-C2", loc=example_result)
# Compare with example result:
example_result_2 = Geometry([Point(660, 96.37552148, 0), Point(670, 96.37552148, 0), Point(680, 96.37552148, 0), Point(690, 96.37552148, 0), Point(700, 96.37552148, 0), Point(660, 96.37552148, 0), Point(670, 106.3755215, 0), Point(680, 106.3755215, 0), Point(690, 106.3755215, 0), Point(700, 106.3755215, 0), Point(660, 96.37552148, 0), Point(670, 106.3755215, 0), Point(680, 116.3755215, 0), Point(690, 116.3755215, 0), Point(700, 116.3755215, 0), Point(660, 96.37552148, 0), Point(670, 106.3755215, 0), Point(680, 116.3755215, 0), Point(690, 126.3755215, 0), Point(700, 126.3755215, 0), Point(660, 96.37552148, 0), Point(670, 106.3755215, 0), Point(680, 116.3755215, 0), Point(690, 126.3755215, 0), Point(700, 136.3755215, 0)])
# Create a set of points that looks like a triangle, starting at one point, two points, three points etc. Do this by using two 'Series' components.
displaytext_10 = DisplayText(challenge="Extra-Challenge E-C1", loc=example_result_2)
random = Random(Range=construct_domain, Number=1, Seed=number_slider_4)
vector_2pt_2 = Vector2Pt(PointA=point_7, PointB=arrrec.Geometry, Unitize=False)  # -> Vector, Length
series_2 = Series(Start=number_slider_6, Step=1, Count=Slider(10, range=0..10))  # -> graft(Series)

# ---- group: Put this somewhere. We'll explain this later.
graft_tree = GraftTree(IncludeEmptyLists=True, IncludeNullItems=True)

# ----
geometry_4 = Geometry()

# ---- group: This generates a rectangular array (a grid).
arrrec_2 = RectangularArray(Geometry=pt_2, Cell=rectangle_2.Rectangle, XCount=number_slider_5, YCount=number_slider_5)  # -> Geometry, Transform

# ---- group: This helps us visualize vector movement.
vector_display = VectorDisplay(Anchor=point_8, Vector=vector_2pt.Vector)

# ----
geometry_5 = Geometry()
checker = Checker_5(data=geometry_4)
geometry_6 = Geometry()
panel_3 = Panel(random)
checker_2 = Checker(data=move.Geometry)
checker_3 = Checker_4(data=geometry_5)

# ---- group: in Grasshopper, 'Move' effectively functions as copying, as it moves the original point and creates a new one.
move_2 = Move(Geometry=geometry_3, Motion=unit_x)  # -> Geometry, Transform

# ----
series_3 = Series(Start=number_slider_6, Step=1, Count=10)
# Hint:
checker_4 = Checker_6(data=geometry_6)
move_3 = Move(Motion=Vector(0, 0, 10))  # -> Geometry, Transform
# Search the menu above for 'Extrude'. Alternately, double-click on the Grasshopper canvas - this will bring up a search menu. Type 'Extrude', and choose the plain 'Extrude', not 'Extrude Along', etc..
panel_4 = Panel(checker_2)
panel_5 = Panel(checker)
panel_6 = Panel(checker_3)
# There are two 'Line' components that look very similar; one holds lines, the other one generates them. You're looking for the latter.
panel_7 = Panel(checker_4)

# ---- group: This visualizes the 'tree' structure; when you 'Graft', you're making your list of, say, 10 items into 10 lists, each containing 1 item each.
param_viewer = ParamViewer(geometry_4)

# ---- group: Each gray 'band' or header demarcates each new list, or "branch". In a list of lists (a 'tree'), a single list is a 'branch'.
panel_8 = Panel(geometry_4)

# ----
# 'List Item' is able to get a letter, given what inputs?
# If only that was more random...
# Compare with example result:
# Hint:
# One series is plugged into the other.
example_result_3 = Geometry([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])
series_4 = Series(Start=number_slider_6, Step=1, Count=10)
checker_5 = Checker_3(data=move_2.Geometry)
geometry_7 = Geometry(move_3.Geometry)
checker_6 = Checker_2(data=geometry_7)
panel_9 = Panel(checker_5)
graft_tree_2 = GraftTree(IncludeEmptyLists=True, IncludeNullItems=True)
rotate = Rotate(Angle=Slider(3.055, range=0..6.283), Plane=PlaneXY(0, 0, 0))  # -> Geometry, Transform
unit_z = UnitZ(Factor=1)
construct_point_2 = ConstructPoint(XCoordinate=graft_tree_2, YCoordinate=0, ZCoordinate=0)  # -> simplify(Point)
panel_10 = Panel(checker_6)
trim_tree = TrimTree(Tree=construct_point_2, Depth=1)
move_4 = Move(Geometry=trim_tree, Motion=unit_z)  # -> Geometry, Transform
# Hint:
# If the rotation is moving strangely, it's because the Rotate component requires a center/pivot point -- the 'Plane' input. Where would you get a list of points around which your geometry should rotate?
# Compare with example result:
example_result_4 = Geometry([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])
custom_preview = CustomPreview(Geometry=rotate.Geometry, Shader=ColourSwatch(SwatchColor=RGB(247, 33, 255)))

# ==== cluster Checker
data = ClusterInput()
data_2 = Data(data)
clean_tree = CleanTree(RemoveNulls=True, RemoveInvalid=True, RemoveEmpty=False, Tree=data_2)
list_length = ListLength(List=clean_tree)
equality = Equality(FirstNumber="10", SecondNumber=list_length)  # -> Equality, Inequality
stream_filter = StreamFilter(Gate=equality.Equality, Stream0=" ", Stream1="Correct!")
null_item = NullItem(Item=equality.Equality)  # -> NullFlags, InvalidFlags, Description
stream_filter_2 = StreamFilter(Gate=null_item.NullFlags, Stream0=stream_filter, Stream1=" ")
data_3 = Data(stream_filter_2)
data_4 = ClusterOutput(data_3)

# ==== cluster Checker_2
data = ClusterInput()
data_2 = Data(data)
curve = Curve(data_2)
clean_tree = CleanTree(RemoveNulls=True, RemoveInvalid=True, RemoveEmpty=False, Tree=curve)
list_length = ListLength(List=flatten(clean_tree))
larger_than = LargerThan(SecondNumber=0)  # -> LargerThan, OrEqualTo
equality = Equality(FirstNumber="8", SecondNumber=list_length)  # -> Equality, Inequality
stream_filter = StreamFilter(Gate=equality.Equality, Stream0=" ", Stream1="Correct!")
null_item = NullItem(Item=equality.Equality)  # -> NullFlags, InvalidFlags, Description
stream_filter_2 = StreamFilter(Gate=null_item.NullFlags, Stream0=stream_filter, Stream1=" ")
data_3 = Data(stream_filter_2)
data_4 = ClusterOutput(data_3)

# ==== cluster Checker_3
data = ClusterInput()
data_2 = Data(data)
tree_statistics = TreeStatistics(Tree=data_2)  # -> Paths, Length, Count
equality = Equality(FirstNumber="5", SecondNumber=tree_statistics.Count)  # -> Equality, Inequality
stream_filter = StreamFilter(Gate=equality.Equality, Stream0=" ", Stream1="Correct!")
null_item = NullItem(Item=equality.Equality)  # -> NullFlags, InvalidFlags, Description
stream_filter_2 = StreamFilter(Gate=null_item.NullFlags, Stream0=stream_filter, Stream1=" ")
data_3 = Data(stream_filter_2)
data_4 = ClusterOutput(data_3)

# ==== cluster Checker_4
data = ClusterInput()
data_2 = Data(data)
length = Length(Curve=data_2)
tree_statistics = TreeStatistics(Tree=data_2)  # -> Paths, Length, Count
mass_addition = MassAddition(Input=length)  # -> Result, PartialResults
larger_than = LargerThan(FirstNumber=mass_addition.Result, SecondNumber=0)  # -> LargerThan, OrEqualTo
equality = Equality(FirstNumber="5", SecondNumber=tree_statistics.Count)  # -> Equality, Inequality
stream_filter = StreamFilter(Gate=larger_than.LargerThan, Stream0=" ", Stream1="Correct!")
null_item = NullItem(Item=larger_than.LargerThan)  # -> NullFlags, InvalidFlags, Description
stream_filter_2 = StreamFilter(Gate=null_item.NullFlags, Stream0=stream_filter, Stream1=" ")
data_3 = Data(stream_filter_2)
data_4 = ClusterOutput(data_3)

# ==== cluster Checker_5
data = ClusterInput()
data_2 = Data(data)
list_length = ListLength(List=flatten(data_2))
larger_than = LargerThan(SecondNumber=0)  # -> LargerThan, OrEqualTo
equality = Equality(FirstNumber="20", SecondNumber=list_length)  # -> Equality, Inequality
stream_filter = StreamFilter(Gate=equality.Equality, Stream0=" ", Stream1="Correct!")
null_item = NullItem(Item=equality.Equality)  # -> NullFlags, InvalidFlags, Description
stream_filter_2 = StreamFilter(Gate=null_item.NullFlags, Stream0=stream_filter, Stream1=" ")
data_3 = Data(stream_filter_2)
data_4 = ClusterOutput(data_3)

# ==== cluster Checker_6
data = ClusterInput()
data_2 = Data(data)
tree_statistics = TreeStatistics(Tree=data_2)  # -> Paths, Length, Count
length = Length(Curve=data_2)
larger_than = LargerThan(FirstNumber=length, SecondNumber=Slider(0.01, range=0..0.01))  # -> LargerThan, OrEqualTo
equality = Equality(FirstNumber="5", SecondNumber=tree_statistics.Count)  # -> Equality, Inequality
stream_filter = StreamFilter(Gate=larger_than.LargerThan, Stream0=" ", Stream1="Correct!")
null_item = NullItem(Item=larger_than.LargerThan)  # -> NullFlags, InvalidFlags, Description
stream_filter_2 = StreamFilter(Gate=null_item.NullFlags, Stream0=stream_filter, Stream1=" ")
data_3 = Data(stream_filter_2)
data_4 = ClusterOutput(data_3)

# ==== cluster DisplayText
md_slider = MDSlider(
    slider_value=Point(0, 0.07560916063, 0.5),
    SliderMode=0,
    x_domain=Domain(-10, 10),
    y_domain=Domain(-10, 10),
    z_domain=Domain(0, 1))
loc = ClusterInput()
loc_2 = Data(loc)
item = ListItem(List=loc_2, Index=0, Wrap=True)
move = Move(Geometry=item, Motion=md_slider)  # -> Geometry, Transform
challenge = ClusterInput()
bool = Boolean(True)
pdecon = Deconstruct(Point=move.Geometry)  # -> XComponent, YComponent, ZComponent
challenge_2 = Data(challenge)
pt = ConstructPoint(XCoordinate=pdecon.XComponent, YCoordinate=Slider(-14, range=-50..50), ZCoordinate=pdecon.ZComponent)
c_script = CSharpScript(face="Arial", bold=bool, size=Slider(3.046, range=0..11), content=challenge_2, pl=pt)  # -> out, A; inputs face: String, bold: Boolean, italics: Boolean, size: Double, content: String, pl: Plane
# ---------- c_script: C# ----------
    if(size == 0)
      size = 1;

    if(!string.IsNullOrEmpty(face) && size > 0 && !string.IsNullOrEmpty(content) &&
      pl.IsValid)
    {

      var te = RhinoDoc.ActiveDoc.Objects.AddText(content, pl, size, face, bold, italics);
      Rhino.DocObjects.TextObject txt = RhinoDoc.ActiveDoc.Objects.Find(te) as Rhino.DocObjects.TextObject;

      if(txt != null)
      {
        var tt = txt.Geometry as Rhino.Geometry.TextEntity;
        A = tt.Explode();
      }
      
      RhinoDoc.ActiveDoc.Objects.Delete(te, true);
    }
# ---------- end c_script ----------
boundary = BoundarySurfaces(Edges=c_script.A)
S = ClusterOutput(boundary)
