# Grasshopper definition GH_Challenges_C_Lists_v2.gh (Grasshopper 0.9.76)

# Challenge C3: Add one 'Line' component to create a line between one point and a list of five points.
point = Point(Point(200, 40, 0))
# Challenge C3: Add one 'Line' component to create a line between two points.
point_2 = Point(Point(180, 39.22960831, 0))
point_3 = Point([Point(264.7599814, 80, 0), Point(264.7599814, 60, 0), Point(264.7599814, 40, 0), Point(264.7599814, 20, 0), Point(264.7599814, 0, 0)])
point_4 = Point(Point(244.7599814, 31.74540076, 0))
point_5 = Point([Point(328.4024885, 80, 0), Point(328.4024885, 60, 0), Point(328.4024885, 40, 0), Point(328.4024885, 20, 0), Point(328.4024885, 0, 0)])
# Challenge C4: Add a 'Line' component and a 'Graft' component to create all the possible lines between the four points and the five points.
point_6 = Point([Point(308.4024885, 70, 0), Point(308.4024885, 50, 0), Point(308.4024885, 30, 0), Point(308.4024885, 10, 0)])
# Grasshopper Challenges
# By Dan Taeyoung, 2016. https://github.com/provolot/GrasshopperChallenges
# Challenges C - being nimble with Lists and Trees
# Challenge C1: Add a 'Series' component to create a set of 10 points, incrementing in the Y direction.
construct_point = ConstructPoint(XCoordinate=0, YCoordinate=0, ZCoordinate=0)
# Challenge C8: Combining challenges C6 and C7, create a grid of points; on that grid of points, place a polyline you have drawn, and rotate each polyline in-place with a random degree.
number_slider = Slider(10, range=0..10)

geometry = Geometry(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)
# Challenge C6: Using the answer from C5, move all of the circle-esque shapes onto the grid, then connect the 'Rotate' component to rotate all of the geometry together in the grid with the slider.
point_7 = Point(Point(464.2548871, -34.81808073, 0))

# ----
# Challenge C7: Change the existing definition to generate 10 random numbers from 0 to 2 * Pi (6.2831).
geometry_2 = Geometry([Point(495.0365926, 62.30719088, 0), Point(489.0365926, 62.30719088, 0), Point(483.0365926, 62.30719088, 0), Point(477.0365926, 62.30719088, 0), Point(471.0365926, 62.30719088, 0), Point(495.0365926, 56.30719088, 0)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])

geometry_3 = Geometry(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)
# Challenge C5: Connect the 'Move' component to move the hexagon to each point location.
point_8 = Point(Point(393.2537864, 20.9515941, 0))

# ----
# Challenge C2: Connect the 'Graft' component somewhere to create a 5x5 grid of points.
geometry_4 = Geometry([Point(50, 0, 0), Point(50, 20, 0), Point(50, 40, 0), Point(50, 60, 0), Point(50, 80, 0)])
point_9 = Point([Point(391.7312824, 55.20557001, 0), Point(391.8084777, 56.93451418, 0), Point(392.9786943, 43.72579915, 0), Point(396.7889657, 41.48964297, 0), Point(395.8451172, 48.32924102, 0), Point(389.1970222, 43.45966327, 0), Point(402.3091418, 49.45130599, 0), Point(395.8346161, 59.10035069, 0)])
series = Series(Start=0, Step=Slider(20, range=0..100), Count=Slider(5, range=0..10))
unit_y = UnitY(Factor=1)
# Compare with example result:
example_result = Geometry([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])

# ---- group: This 'Seed' is an arbitrary number that will change the 'pseudorandomness' of the Random component.
number_slider_2 = Slider(6319, range=0..10000)

# ----
# Challenge C9: Create a set of points that looks like a triangle, starting at one point, two points, three points etc. Do this by using two 'Series' components.
# Compare with example result:
example_result_2 = Geometry([Point(660, 96.37552148, 0), Point(670, 96.37552148, 0), Point(680, 96.37552148, 0), Point(690, 96.37552148, 0), Point(700, 96.37552148, 0), Point(660, 96.37552148, 0), Point(670, 106.3755215, 0), Point(680, 106.3755215, 0), Point(690, 106.3755215, 0), Point(700, 106.3755215, 0), Point(660, 96.37552148, 0), Point(670, 106.3755215, 0), Point(680, 116.3755215, 0), Point(690, 116.3755215, 0), Point(700, 116.3755215, 0), Point(660, 96.37552148, 0), Point(670, 106.3755215, 0), Point(680, 116.3755215, 0), Point(690, 126.3755215, 0), Point(700, 126.3755215, 0), Point(660, 96.37552148, 0), Point(670, 106.3755215, 0), Point(680, 116.3755215, 0), Point(690, 126.3755215, 0), Point(700, 136.3755215, 0)])
unit_x = UnitX(Factor=series)
# Challenge C10: Create a set of points that looks like a pyramid. Do this by using three 'Series' components.
# Compare with example result:
# 'List Item' is able to get a letter, given what inputs?
# If only that was more random...
example_result_3 = Geometry([Point(807.3078012, 136.3755215, 0), Point(797.3078012, 126.3755215, 0), Point(787.3078012, 116.3755215, 0), Point(777.3078012, 106.3755215, 0), Point(767.3078012, 96.37552148, 0), Point(807.3078012, 126.3755215, 0)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])
construct_domain = ConstructDomain(DomainStart=Slider(0, range=0..6.283), DomainEnd=number_slider)

# ---- group: in Grasshopper, 'Move' effectively functions as copying, as it moves the original point and creates a new one.
move = Move(Geometry=construct_point, Motion=unit_y)  # -> Geometry, Transform

# ----
vector_2pt = Vector2Pt(PointA=point_8, PointB=point_9, Unitize=False)  # -> Vector, Length
geometry_5 = Geometry()
geometry_6 = Geometry()
vector_2pt_2 = Vector2Pt(PointA=point_7, PointB=geometry_2, Unitize=False)  # -> Vector, Length
geometry_7 = Geometry()

# ---- group: Put this somewhere. We'll explain this later.
graft_tree = GraftTree(IncludeEmptyLists=True, IncludeNullItems=True)

# ----
random = Random(Range=construct_domain, Number=1, Seed=number_slider_2)
checker = Checker_3(data=geometry_5)
checker_2 = Checker_4(data=geometry_6)
checker_3 = Checker_5(data=geometry_7)

# ---- group: This helps us visualize vector movement.
vector_display = VectorDisplay(Anchor=point_8, Vector=vector_2pt.Vector)

# ----
# Hint:
panel = Panel(checker)
panel_2 = Panel(checker_2)

# ---- group: in Grasshopper, 'Move' effectively functions as copying, as it moves the original point and creates a new one.
move_2 = Move(Geometry=geometry_4, Motion=unit_x)  # -> Geometry, Transform

# ----
panel_3 = Panel(random)
panel_4 = Panel(checker_3)

# ---- group: This visualizes the 'tree' structure; when you 'Graft', you're making your list of, say, 10 items into 10 lists, each containing 1 item each.
param_viewer = ParamViewer(geometry_7)

# ---- group: Each gray 'band' or header demarcates each new list, or "branch". In a list of lists (a 'tree'), a single list is a 'branch'.
panel_5 = Panel(geometry_7)

# ----
move_3 = Move(Motion=Vector(0, 0, 10))  # -> Geometry, Transform
checker_4 = Checker(data=move.Geometry)
# There are two 'Line' components that look very similar; one holds lines, the other one generates them. You're looking for the latter.
checker_5 = Checker_2(data=move_2.Geometry)
# Double-click on the Slider on the 'Number Slider' text (or Right-click)  to edit the Slider properties.
# Search the menu above for 'Extrude'. Alternately, double-click on the Grasshopper canvas - this will bring up a search menu. Type 'Extrude', and choose the plain 'Extrude', not 'Extrude Along', etc..
panel_6 = Panel(checker_4)
geometry_8 = Geometry(move_3.Geometry)
panel_7 = Panel(checker_5)
checker_6 = Checker_6(data=geometry_8)
rotate = Rotate(Angle=Slider(3.055, range=0..6.283), Plane=PlaneXY(0, 0, 0))  # -> Geometry, Transform
panel_8 = Panel(checker_6)
# Hint:
# One series is plugged into the other.
colour_swatch = ColourSwatch(SwatchColor=RGB(247, 33, 255))
# Compare with example result:
example_result_4 = Geometry([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])
custom_preview = CustomPreview(Geometry=rotate.Geometry, Shader=colour_swatch)

# ==== cluster Checker
data = ClusterInput()
data_2 = Data(data)
list_length = ListLength(List=data_2)
equality = Equality(FirstNumber="10", SecondNumber=list_length)  # -> Equality, Inequality
stream_filter = StreamFilter(Gate=equality.Equality, Stream0=" ", Stream1="Correct!")
null_item = NullItem(Item=equality.Equality)  # -> NullFlags, InvalidFlags, Description
stream_filter_2 = StreamFilter(Gate=null_item.NullFlags, Stream0=stream_filter, Stream1=" ")
data_3 = Data(stream_filter_2)
data_4 = ClusterOutput(data_3)

# ==== cluster Checker_2
data = ClusterInput()
data_2 = Data(data)
tree_statistics = TreeStatistics(Tree=data_2)  # -> Paths, Length, Count
equality = Equality(FirstNumber="5", SecondNumber=tree_statistics.Count)  # -> Equality, Inequality
stream_filter = StreamFilter(Gate=equality.Equality, Stream0=" ", Stream1="Correct!")
null_item = NullItem(Item=equality.Equality)  # -> NullFlags, InvalidFlags, Description
stream_filter_2 = StreamFilter(Gate=null_item.NullFlags, Stream0=stream_filter, Stream1=" ")
data_3 = Data(stream_filter_2)
data_4 = ClusterOutput(data_3)

# ==== cluster Checker_3
data = ClusterInput()
data_2 = Data(data)
tree_statistics = TreeStatistics(Tree=data_2)  # -> Paths, Length, Count
length = Length(Curve=data_2)
larger_than = LargerThan(FirstNumber=length, SecondNumber=Slider(0.01, range=0..0.01))  # -> LargerThan, OrEqualTo
equality = Equality(FirstNumber="5", SecondNumber=tree_statistics.Count)  # -> Equality, Inequality
stream_filter = StreamFilter(Gate=larger_than.LargerThan, Stream0=" ", Stream1="Correct!")
null_item = NullItem(Item=larger_than.LargerThan)  # -> NullFlags, InvalidFlags, Description
stream_filter_2 = StreamFilter(Gate=null_item.NullFlags, Stream0=stream_filter, Stream1=" ")
data_3 = Data(stream_filter_2)
data_4 = ClusterOutput(data_3)

# ==== cluster Checker_4
data = ClusterInput()
data_2 = Data(data)
length = Length(Curve=data_2)
tree_statistics = TreeStatistics(Tree=data_2)  # -> Paths, Length, Count
mass_addition = MassAddition(Input=length)  # -> Result, PartialResults
larger_than = LargerThan(FirstNumber=mass_addition.Result, SecondNumber=0)  # -> LargerThan, OrEqualTo
equality = Equality(FirstNumber="5", SecondNumber=tree_statistics.Count)  # -> Equality, Inequality
stream_filter = StreamFilter(Gate=larger_than.LargerThan, Stream0=" ", Stream1="Correct!")
null_item = NullItem(Item=larger_than.LargerThan)  # -> NullFlags, InvalidFlags, Description
stream_filter_2 = StreamFilter(Gate=null_item.NullFlags, Stream0=stream_filter, Stream1=" ")
data_3 = Data(stream_filter_2)
data_4 = ClusterOutput(data_3)

# ==== cluster Checker_5
data = ClusterInput()
data_2 = Data(data)
list_length = ListLength(List=flatten(data_2))
larger_than = LargerThan(SecondNumber=0)  # -> LargerThan, OrEqualTo
equality = Equality(FirstNumber="20", SecondNumber=list_length)  # -> Equality, Inequality
stream_filter = StreamFilter(Gate=equality.Equality, Stream0=" ", Stream1="Correct!")
null_item = NullItem(Item=equality.Equality)  # -> NullFlags, InvalidFlags, Description
stream_filter_2 = StreamFilter(Gate=null_item.NullFlags, Stream0=stream_filter, Stream1=" ")
data_3 = Data(stream_filter_2)
data_4 = ClusterOutput(data_3)

# ==== cluster Checker_6
data = ClusterInput()
data_2 = Data(data)
curve = Curve(data_2)
clean_tree = CleanTree(RemoveNulls=True, RemoveInvalid=True, RemoveEmpty=False, Tree=curve)
list_length = ListLength(List=flatten(clean_tree))
larger_than = LargerThan(SecondNumber=0)  # -> LargerThan, OrEqualTo
equality = Equality(FirstNumber="8", SecondNumber=list_length)  # -> Equality, Inequality
stream_filter = StreamFilter(Gate=equality.Equality, Stream0=" ", Stream1="Correct!")
null_item = NullItem(Item=equality.Equality)  # -> NullFlags, InvalidFlags, Description
stream_filter_2 = StreamFilter(Gate=null_item.NullFlags, Stream0=stream_filter, Stream1=" ")
data_3 = Data(stream_filter_2)
data_4 = ClusterOutput(data_3)
