# Grasshopper definition GH_Challenges_D_.gh (Grasshopper 0.9.76)

number_slider = Slider(10, range=0..10)
# Grasshopper Challenges
# By Dan Taeyoung, 2016. https://github.com/provolot/GrasshopperChallenges
# Challenges D - Text drawings start
# Challenge D1: Using only the existing components, select 10 random letters from the alphabet.
panel = Panel("abcdefghijklmnopqrstuvwxyz")
# Challenge D4: Using the definition from challenges C8 and C12, create a grid of overlapping, intersecting randomly chosen letters - ala Jasper Johns.
number_slider_2 = Slider(10, range=0..10)
# Challenge D5: Using the definition from D4, and remembering Challenge C8, randomly rotate each letter. (The Area component will be needed to get the centroid of each letter.)
geometry = Geometry(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)
number_slider_3 = Slider(6, range=0..20)
# Challenge D3: Using only the components below (and thinking about Challenge C5), place one character on each point, so that the grid looks like it's made of 'g' or 'q's, etc.
geometry_2 = Geometry(Point(1133.748032, 92.90023124, 0))
# Challenge D6: Modifying the code below, move the letter in ten random directions. Remember Challenge C8.
geometry_3 = Geometry(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)
# Challenge D2: Using Challenge D1, can you create the outline of 10 random letters on top of each other?
boolean_toggle = BooleanToggle(True)
# Challenge D7: Using D6 and D5, randomly rotate AND move each letter on the grid in a random direction.
number_slider_4 = Slider(4, range=0..10)
rectangle = Rectangle(Plane=PlaneXY(0, 0, 0), XSize=number_slider, YSize=number_slider, Radius=0)  # -> Rectangle, Length
number_slider_5 = Slider(6, range=0..20)
geometry_4 = Geometry(Point(1133.748032, 92.90023124, 0))
area = Area(Geometry=geometry)  # -> Area, Centroid
point = Point(Point(997.6247563, 92.04829366, 0))
characters = Characters(Text="abcdefghijklmnopqrstuvwxyz")  # -> Result, Unicode
rectangle_2 = Rectangle(Plane=PlaneXY(0, 0, 0), XSize=number_slider_2, YSize=number_slider_2, Radius=0)  # -> Rectangle, Length
characters_2 = Characters(Text=panel)  # -> Result, Unicode
c_text_outline_generator = CSharpScript(face="Helvetica", bold=boolean_toggle, italics=Toggle(False), size=Slider(21, range=0..21), content="syzygy", pl=point)  # -> out, A; inputs face: String, bold: Boolean, italics: Boolean, size: Double, content: String, pl: Plane
# ---------- c_text_outline_generator: C# ----------
    if(size == 0)
      size = 1;

    if(!string.IsNullOrEmpty(face) && size > 0 && !string.IsNullOrEmpty(content) &&
      pl.IsValid)
    {

      var te = RhinoDoc.ActiveDoc.Objects.AddText(content, pl, size, face, bold, italics);
      Rhino.DocObjects.TextObject txt = RhinoDoc.ActiveDoc.Objects.Find(te) as Rhino.DocObjects.TextObject;

      if(txt != null)
      {
        var tt = txt.Geometry as Rhino.Geometry.TextEntity;
        A = tt.Explode();
      }
      
      RhinoDoc.ActiveDoc.Objects.Delete(te, true);
    }
# ---------- end c_text_outline_generator ----------
vector_xyz = VectorXYZ(XComponent=Slider(3, range=0..10), YComponent=number_slider_4, ZComponent=0)  # -> Vector, Length
panel_2 = Panel(characters.Result)
rectangular_array = RectangularArray(Geometry=geometry_2, Cell=rectangle.Rectangle, XCount=number_slider_3, YCount=number_slider_3)  # -> Geometry, Transform
rectangular_array_2 = RectangularArray(Geometry=geometry_4, Cell=rectangle_2.Rectangle, XCount=number_slider_5, YCount=number_slider_5)  # -> Geometry, Transform
panel_3 = Panel(characters_2.Result)
# Compare with example result:
# example_result_D1.PNG
number_of_random_letters_we_want = Panel("10")
number_slider_6 = Slider(36, range=0..100)
# Compare with example result:
# example_result_D5.PNG
# Compare with example result:
# example_result_D6.PNG
# Compare with example result:
# example_result_D7.PNG
move = Move(Geometry=geometry_3, Motion=vector_xyz.Vector)  # -> Geometry, Transform
list_item = ListItem(List=panel_2, Index=Slider(17, range=0..26), Wrap=True)
# Compare with example result:
# example_result_D4.PNG
panel_4 = Panel(list_item)
list_length = ListLength()
list_length_2 = ListLength()
random = Random(Range=Domain(0, 1), Number=1, Seed=2)
# Compare with example result:
# example_result_D3.PNG
c_text_outline_generator_2 = CSharpScript(face="Helvetica", bold=Toggle(True), italics=Toggle(False), size=Slider(21, range=0..21))  # -> out, A; inputs face: String, bold: Boolean, italics: Boolean, size: Double, content: String, pl: Plane; same code as c_text_outline_generator
random_2 = Random(Range=Domain(0, 1), Number=1, Seed=2)
# Hint:
# The 'List Item' component grabs a character from the list of letters. What are its inputs? If only something could be a little bit random...
list_item_2 = ListItem(List=characters_2.Result, Index=Slider(13, range=0..26), Wrap=True)
panel_5 = Panel(list_item_2)
text = Text(panel_5)
checker = Checker(data=text)
panel_6 = Panel(checker)

# ==== cluster Checker
data = ClusterInput()
data_2 = Data(data)
text = Text(data_2)
clean_tree = CleanTree(RemoveNulls=True, RemoveInvalid=True, RemoveEmpty=False, Tree=text)
list_length = ListLength(List=flatten(clean_tree))
larger_than = LargerThan(SecondNumber=0)  # -> LargerThan, OrEqualTo
equality = Equality(FirstNumber="10", SecondNumber=list_length)  # -> Equality, Inequality
stream_filter = StreamFilter(Gate=equality.Equality, Stream0=" ", Stream1="Correct!")
null_item = NullItem(Item=equality.Equality)  # -> NullFlags, InvalidFlags, Description
stream_filter_2 = StreamFilter(Gate=null_item.NullFlags, Stream0=stream_filter, Stream1=" ")
data_3 = Data(stream_filter_2)
data_4 = ClusterOutput(data_3)
