# Grasshopper definition GH_Challenges_D_text_drawings.ghx (Grasshopper 1.0.7)

construct_point = ConstructPoint(XCoordinate=0, YCoordinate=0, ZCoordinate=0)
# Challenge D3: Using only the components below (and thinking about Challenge C5), place one character on each point, so that the grid looks like it's made of 'g' or 'q's, etc.
construct_point_2 = ConstructPoint(XCoordinate="150", YCoordinate=0, ZCoordinate=0)
number_slider = Slider(10, range=0..10)
# Grasshopper Challenges
# By Dan Taeyoung, 2016. https://github.com/provolot/GrasshopperChallenges
# Challenges D - Text drawings start
# Challenge D1: Using only the existing components, select 10 random letters from the alphabet.
panel = Panel("abcdefghijklmnopqrstuvwxyz")
# Challenge D4: Using the definition from challenges C8 and C12, create a grid of overlapping, intersecting randomly chosen letters - ala Jasper Johns.
construct_point_3 = ConstructPoint(XCoordinate="300", YCoordinate=0, ZCoordinate=0)
number_slider_2 = Slider(10, range=0..10)
construct_point_4 = ConstructPoint(XCoordinate="450", YCoordinate=0, ZCoordinate=0)
# Challenge D7: Using D6 and D5, randomly rotate AND move each letter on the grid in a random direction.
construct_point_5 = ConstructPoint(XCoordinate="600", YCoordinate=0, ZCoordinate=0)
number_slider_3 = Slider(6, range=0..20)
# Challenge D2: Using Challenge D1, can you create the outline of 10 random letters on top of each other?
boolean_toggle = BooleanToggle(True)
number_slider_4 = Slider(6, range=0..20)
rectangle = Rectangle(Plane=PlaneXY(0, 0, 0), XSize=number_slider, YSize=number_slider, Radius=0)  # -> Rectangle, Length
# Challenge D6: Modifying the code below, move the letter in ten random directions. Remember Challenge C8.
boolean_toggle_2 = BooleanToggle(True)
# Challenge D5: Using the definition from D4, and remembering Challenge C8, randomly rotate each letter. (The Area component will be needed to get the centroid of each letter.)
boolean_toggle_3 = BooleanToggle(True)
characters = Characters(Text="abcdefghijklmnopqrstuvwxyz")  # -> Result, Unicode
rectangle_2 = Rectangle(Plane=PlaneXY(0, 0, 0), XSize=number_slider_2, YSize=number_slider_2, Radius=0)  # -> Rectangle, Length
characters_2 = Characters(Text=panel)  # -> Result, Unicode
point = Point(construct_point_4)
point_2 = Point(construct_point_5)
c_text_outline_generator = CSharpScript(
    face="Helvetica",
    bold=boolean_toggle,
    italics=Toggle(False),
    size=Slider(21, range=0..21),
    content="syzygy",
    pl=construct_point)  # -> out, A; inputs face: String, bold: Boolean, italics: Boolean, size: Double, content: String, pl: Plane
# ---------- c_text_outline_generator: C# usings ----------
using System.IO;
using System.Linq;
using System.Data;
using System.Drawing;
using System.Reflection;
using System.Windows.Forms;
using System.Xml;
using System.Xml.Linq;
using System.Runtime.InteropServices;

using Rhino.DocObjects;
using Rhino.Collections;
using GH_IO;
using GH_IO.Serialization;
# ---------- c_text_outline_generator: C# ----------
    if(size == 0)
      size = 1;

    if(!string.IsNullOrEmpty(face) && size > 0 && !string.IsNullOrEmpty(content) &&
      pl.IsValid)
    {

      var te = RhinoDoc.ActiveDoc.Objects.AddText(content, pl, size, face, bold, italics);
      Rhino.DocObjects.TextObject txt = RhinoDoc.ActiveDoc.Objects.Find(te) as Rhino.DocObjects.TextObject;

      if(txt != null)
      {
        var tt = txt.Geometry as Rhino.Geometry.TextEntity;
        A = tt.Explode();
      }

      RhinoDoc.ActiveDoc.Objects.Delete(te, true);
    }
# ---------- end c_text_outline_generator ----------
panel_2 = Panel(characters.Result)
c_text_outline_generator_2 = CSharpScript(face="Helvetica", bold=boolean_toggle_3, italics=Toggle(False), size=Slider(21, range=0..21), content="c", pl=point)  # -> out, A; inputs face: String, bold: Boolean, italics: Boolean, size: Double, content: String, pl: Plane
# ---------- c_text_outline_generator_2: C# ----------
    if(size == 0)
      size = 1;

    if(!string.IsNullOrEmpty(face) && size > 0 && !string.IsNullOrEmpty(content) &&
      pl.IsValid)
    {

      var te = RhinoDoc.ActiveDoc.Objects.AddText(content, pl, size, face, bold, italics);
      Rhino.DocObjects.TextObject txt = RhinoDoc.ActiveDoc.Objects.Find(te) as Rhino.DocObjects.TextObject;

      if(txt != null)
      {
        var tt = txt.Geometry as Rhino.Geometry.TextEntity;
        A = tt.Explode();
      }
      
      RhinoDoc.ActiveDoc.Objects.Delete(te, true);
    }
# ---------- end c_text_outline_generator_2 ----------
c_text_outline_generator_3 = CSharpScript(face="Helvetica", bold=boolean_toggle_2, italics=Toggle(False), size=Slider(21, range=0..21), content="k", pl=point_2)  # -> out, A; inputs face: String, bold: Boolean, italics: Boolean, size: Double, content: String, pl: Plane; same code as c_text_outline_generator_2
rectangular_array = RectangularArray(Geometry=construct_point_2, Cell=rectangle.Rectangle, XCount=number_slider_3, YCount=number_slider_3)  # -> Geometry, Transform
rectangular_array_2 = RectangularArray(Geometry=construct_point_3, Cell=rectangle_2.Rectangle, XCount=number_slider_4, YCount=number_slider_4)  # -> Geometry, Transform
panel_3 = Panel(characters_2.Result)
geometry = Geometry(c_text_outline_generator_3.A)
geometry_2 = Geometry(c_text_outline_generator_2.A)
number_of_random_letters_we_want = Panel("10")
number_slider_5 = Slider(36, range=0..100)
list_item = ListItem(List=panel_2, Index=Slider(17, range=0..26), Wrap=True)
# Compare with example result:
# example_result_D4.PNG
panel_4 = Panel(list_item)
list_length = ListLength()
vector_xyz = VectorXYZ(XComponent=Slider(3, range=0..10), YComponent=Slider(4, range=0..10), ZComponent=0)  # -> Vector, Length
# Compare with example result:
# example_result_D5.PNG
area = Area(Geometry=geometry_2)  # -> Area, Centroid
random = Random(Range=Domain(0, 1), Number=1, Seed=2)
# Compare with example result:
# example_result_D3.PNG
c_text_outline_generator_4 = CSharpScript(face="Helvetica", bold=Toggle(True), italics=Toggle(False), size=Slider(21, range=0..21))  # -> out, A; inputs face: String, bold: Boolean, italics: Boolean, size: Double, content: String, pl: Plane; same code as c_text_outline_generator_2
# Hint:
# The 'List Item' component grabs a character from the list of letters. What are its inputs? If only something could be a little bit random...
list_item_2 = ListItem(List=characters_2.Result, Index=Slider(13, range=0..26), Wrap=True)
# Compare with example result:
# example_result_D6.PNG
# Compare with example result:
# example_result_D7.PNG
move = Move(Geometry=geometry, Motion=vector_xyz.Vector)  # -> Geometry, Transform
panel_5 = Panel(list_item_2)
# Compare with example result:
# example_result_D1.PNG
text = Text(panel_5)
checker = Checker(data=text)
panel_6 = Panel(checker)

# ==== cluster Checker
data = ClusterInput()
data_2 = Data(data)
text = Text(data_2)
clean_tree = CleanTree(RemoveNulls=True, RemoveInvalid=True, RemoveEmpty=False, Tree=text)
list_length = ListLength(List=flatten(clean_tree))
larger_than = LargerThan(SecondNumber=0)  # -> LargerThan, OrEqualTo
equality = Equality(FirstNumber="10", SecondNumber=list_length)  # -> Equality, Inequality
stream_filter = StreamFilter(Gate=equality.Equality, Stream0=" ", Stream1="Correct!")
null_item = NullItem(Item=equality.Equality)  # -> NullFlags, InvalidFlags, Description
stream_filter_2 = StreamFilter(Gate=null_item.NullFlags, Stream0=stream_filter, Stream1=" ")
data_3 = Data(stream_filter_2)
data_4 = ClusterOutput(data_3)
