# Grasshopper definition GH_Challenges_E_representation.ghx (Grasshopper 0.9.76)
# plug-ins: Human

point = Point([Point(519.6830882, 303.3329789, 0), Point(479.1816793, 181.0645749, 0), Point(530.3815735, 84.01402912, 0), Point(496.7577624, -9.215629, 0)])
# Challenge E7. Using only the components present, create a custom 'dotted line', made of circles that change in size and color. Bake them to a hatch. In Rhino, export the hatch as an Illustrator .AI file, and open in Illustrator!
interpolate = Interpolate(Vertices=point, Degree=3, Periodic=False, KnotStyle=1)  # -> Curve, Length, Domain
# Challenge E1: We need to bake a sphere, but this 90s neon green will simply not do. Change the color and bake the sphere.
construct_point = ConstructPoint(XCoordinate=0, YCoordinate=0, ZCoordinate=0)
# Challenge E2: Great, but we need more fine-tuned control; change the color with the 'Colour RGB (f)' component and bake another sphere.
construct_point_2 = ConstructPoint(XCoordinate="100", YCoordinate=0, ZCoordinate=0)
# Grasshopper Challenges
# By Dan Taeyoung, 2016. https://github.com/provolot/GrasshopperChallenges
# Challenges E - Grasshopper as representation tool
# Required Plugins: Human
# Challenge E0: Let's bake on command. Using the slider, bake only two circles: a circle with diameter 10, and with diameter 20.
construct_point_3 = ConstructPoint(XCoordinate="-100", YCoordinate=0, ZCoordinate=0)
series = Series(Start=0, Step=Slider(33, range=0..100), Count=10)
# Challenge E3: We have ten spheres, but no reason why they should all be the same color. Add one 'Series' component and one 'Slider' to the Colour RGB (f) component, in order to create ten spheres that have all different colors. Bake them.
panel = Panel("200")
series_2 = Series(Start=0, Step=Slider(33, range=0..100), Count=Slider(10, range=0..20))
# Challenge E4. Let's have more free-form control over our color changes. Edit the gradient tool and bake a set of new spheres.
panel_2 = Panel("300")
series_3 = Series(Start=0, Step=Slider(33, range=0..100), Count=10)
# Challenge E7. 'Contour' lets us create a custom hatch pattern of sorts, by slicing geometry into lines. Challenge: Is it possible to make each set of lines for each polygon a different color?
panel_3 = Panel("700")
# Challenge E5. Without adding any components, increase the number of circles to 20. Make sure to adjust the Gradient component's Lower limit and Upper limit to make this happen!
panel_4 = Panel("300")
# Challenge E6. Let's try using Hatches - bake a hatch with a given color. (Hatches, upon export to Illustrator, they create colored geometry. This allows you to have fine-tuned control over Illustrator geometry.)
panel_5 = Panel("400")
curve = Curve(interpolate.Curve)
construct_point_4 = ConstructPoint(XCoordinate=panel_3, YCoordinate=0, ZCoordinate=0)
construct_point_5 = ConstructPoint(XCoordinate=panel_5, YCoordinate=0, ZCoordinate=0)
construct_point_6 = ConstructPoint(XCoordinate=panel, YCoordinate=series, ZCoordinate=0)
construct_point_7 = ConstructPoint(XCoordinate=panel_2, YCoordinate=series_2, ZCoordinate=0)
sphere = Sphere(Base=construct_point, Radius=Slider(8, range=0..100))
sphere_2 = Sphere(Base=construct_point_2, Radius=Slider(8, range=0..100))
# Explanation: Some components below are from the "Human" plugin. If you don't see anything, or if Grasshopper gave you a warning when you opened this file, install the Human plugin at:
# 
# http://food4rhino.com/project/human
circle = Circle(Plane=construct_point_3, Radius=Slider(20, range=0..30))
construct_point_8 = ConstructPoint(XCoordinate=panel_4, YCoordinate=series_3, ZCoordinate=0)
series_4 = Series(Start=0, Step=1, Count=Slider(10, range=0..10))
colour_swatch = ColourSwatch(SwatchColor=RGB(106, 250, 0))
number_slider = Slider(12, range=0..20)
circle_2 = Circle(Plane=construct_point_4, Radius=Slider(51, range=0..100))
sphere_3 = Sphere(Base=construct_point_6, Radius=Slider(9, range=0..100))

# ----
# Explanation: This is a really helpful process. The first component gets the 'bounds' or the minimum and maximum values of the data it receives, and the second one breaks it down into two numbers.
# 
# This way, we can get the Lower limit and Upper limit for the gradient component  programatically.
bounds = Bounds(Numbers=series_4)
deconstruct_domain = DeconstructDomain(Domain=bounds)  # -> Start, End

circle_3 = Circle(Plane=construct_point_5, Radius=Slider(22, range=0..100))
# Explanation: The gradient tool converts numbers (Parameter) to colors, using the lower limit as the left-most color, and the upper limit as the right-most color.
# 
# So, for the example below, entering 0 returns pink, 10 returns blue, and 5 returns a purpleish color.
# 
# You can edit the gradient by dragging the white dots, or right-clicking on them.
sphere_4 = Sphere(Base=construct_point_7, Radius=Slider(9, range=0..100))
sphere_5 = Sphere(Base=construct_point_8, Radius=Slider(9, range=0..100))
series_5 = Series(Start=0, Step=1, Count=Slider(10, range=0..10))
divide_curve = DivideCurve(Curve=curve, Count=Slider(20, range=0..100), Kinks=False)  # -> Points, Tangents, Parameters

# ---- group: Notice the '(f)' after the name - that means that it receives 'floating point numbers' from 0.0 to 1.0
colour_rgb_f = ColourRGBF(Alpha=1, Red=Slider(1, range=0..1), Green=Slider(1, range=0..1), Blue=Slider(1, range=0..1))

# ---- group: This very similarly named component, without the '(f)', uses numbers from 0 to 255.
colour_rgb = ColourRGB(Alpha=255, Red=0, Green=0, Blue=0)

# ----
divide_curve_2 = DivideCurve(Curve=circle_2, Count=number_slider, Kinks=False)  # -> Points, Tangents, Parameters

# ---- group: Notice the '(f)' after the name - that means that it receives 'floating point numbers' from 0.0 to 1.0
colour_rgb_f_2 = ColourRGBF(Alpha=1, Red=Slider(1, range=0..1), Green=Slider(1, range=0..1), Blue=Slider(1, range=0..1))

# ----
panel_6 = Panel(bounds)
gradient = Gradient(
    LowerLimit=Slider(0, range=0..10),
    UpperLimit=Slider(10, range=0..10),
    Parameter=series_5,
    stops=[0.15: RGB(255, 130, 160), 0.817: RGB(51, 128, 189)])
series_6 = Series(Start=Slider(3, range=3..5), Step=Slider(1, range=0..5), Count=number_slider)
colour = Colour(ColourSwatch(SwatchColor=RGB(195, 74, 255)))
# Explanation: The two components below are from the "Human" plugin. If you don't see anything, or if Grasshopper gave you a warning when you opened this file, install the Human plugin at:
# 
# http://food4rhino.com/project/human
gradient_2 = Gradient(
    LowerLimit=deconstruct_domain.Start,
    UpperLimit=deconstruct_domain.End,
    Parameter=series_4,
    stops=[0: RGB(42, 198, 17), 0: RGB(243, 57, 0), 0.1: RGB(236, 27, 60), 0.2: RGB(210, 0, 118), 0.3: RGB(103, 0, 120), 0.4: RGB(39, 72, 161), 0.5: RGB(1, 192, 229), 0.6: RGB(18, 178, 90), 0.7: RGB(79, 186, 8), 0.8: RGB(220, 237, 32), 0.9: RGB(247, 159, 20), 1: RGB(243, 57, 0)])
addition = Addition(A=series_6, B=Slider(2.05, range=0..5))

# ---- group: Make sure to turn this back off! Otherwise any changes will continuously bake copies.
boolean_toggle = BooleanToggle(False)

# ----
number_slider_2 = Slider(0.5, range=0..1)
bounds_2 = Bounds()
number_slider_3 = Slider(1, range=0..1)

# ---- group: Make sure to turn this back off! Otherwise any changes will continuously bake copies.
boolean_toggle_2 = BooleanToggle(False)

# ---- group: Click the 'False' to change it to 'True' and bake geometry!
# Explanation: Make sure to turn this back off! Otherwise any changes will continuously bake copies.
boolean_toggle_3 = BooleanToggle(True)

# ----
list_length = ListLength()
polygon = Polygon(Plane=divide_curve_2.Points, Radius=addition, Segments=series_6, FilletRadius=0)  # -> Polygon, Length

# ---- group: The 'CreateHatch' and 'CreateAttributes' components are from the "Human" plugin.
createattributes = CreateAttributes(Color=colour, enableFullPath=False)
boolean = Boolean(Toggle(False))
text = Text("Solid")
curve_2 = Curve(circle_3)
createhatch = CreateHatch(Bake=boolean, Curves=curve_2, HatchPatternName=text, HatchScale=1, HatchRotation=0, Attributes=createattributes)

# ----
gradient_3 = Gradient(LowerLimit=0, UpperLimit=1, stops=[0.00568: RGB(48, 194, 255), 1: RGB(0, 0, 0)])
series_7 = Series(Start=0, Step=1, Count=10)

# ---- group: Make sure to turn this back off! Otherwise any changes will continuously bake copies.
boolean_toggle_4 = BooleanToggle(False)

# ----
circle_4 = Circle(Plane=divide_curve.Points, Radius=Slider(6, range=0..10))

# ---- group: Make sure to turn this back off! Otherwise any changes will continuously bake copies.
boolean_toggle_5 = BooleanToggle(False)

# ----
custom_preview = CustomPreview(Geometry=sphere, Shader=colour_swatch)

# ---- group: This component is from http://www.giuliopiacentino.com/grasshopper-tools/.
# (There are actually many components in other plugins that do baking, including in Lunchbox, Human, Elefront among others. Giulio Piacentino's component works without a plugin.)
bakeattributes = CSharpScript(objs=sphere, colors=colour_swatch, activate=boolean_toggle_2)  # -> out; inputs objs: list, names: list of String, layers: list of String, colors: list of Color, pWidths: list of Double, wiresEach: list of Int32, materials: list, activate: Boolean, groupListTgthr: Boolean
# ---------- bakeattributes: C# ----------
    //Inserts geometry into the Rhino document, with custom attributes
    //Written by Giulio Piacentino
    //Version written 2011 10 18 - for Grasshopper 0.8.52

    if (activate)
    {
      int groupIndex = -1;
      if(groupListTgthr)
        groupIndex = doc.Groups.Add();

      for(int i = 0; i < objs.Count; i++)
      {
        object obj = objs[i];
        if(obj == null)
        {
          Print("No object to bake");
          return;
        }

        //Make new attribute to set name
        Rhino.DocObjects.ObjectAttributes att = new Rhino.DocObjects.ObjectAttributes();

        string name = names.Count > 0 ? names[i % names.Count] : null;
        //Set object name
        if(!string.IsNullOrEmpty(name))
        {
          att.Name = name;
        }

        Color color = colors.Count > 0 ? colors[i % colors.Count] : new Color();
        //Set color
        if(!color.IsEmpty)
        {
          att.ColorSource = Rhino.DocObjects.ObjectColorSource.ColorFromObject; //Make the color type "by object"
          att.ObjectColor = color;

          att.PlotColorSource = Rhino.DocObjects.ObjectPlotColorSource.PlotColorFromObject; //Make the plot color type "by object"
          att.PlotColor = color;
        }

        string layer = layers.Count > 0 ? layers[i % layers.Count] : null;
        //Set layer
        if(!string.IsNullOrEmpty(layer) && Rhino.DocObjects.Layer.IsValidName(layer))
        {
          //Get the current layer index
          Rhino.DocObjects.Tables.LayerTable layerTable = doc.Layers;
          int layerIndex = layerTable.Find(layer, true);

          if(layerIndex < 0) //This layer does not exist, we add it
          {
            Rhino.DocObjects.Layer onlayer = new Rhino.DocObjects.Layer(); //Make a new layer
            onlayer.Name = layer;

            layerIndex = layerTable.Add(onlayer); //Add the layer to the layer table
            if (layerIndex > -1) //We manged to add layer!
            {
              att.LayerIndex = layerIndex;
              Print("Added new layer to the document at position " + layerIndex + " named " + layer + ". ");
            } else
              Print("Layer did not add. Try cleaning up your layers."); //This never happened to me.
          }
          else
            att.LayerIndex = layerIndex; //We simply add to the existing layer
        }


        double pWidth = pWidths.Count > 0 ? pWidths[i % pWidths.Count] : 0;
        //Set plotweight
        if(pWidth > 0)
        {
          att.PlotWeightSource = Rhino.DocObjects.ObjectPlotWeightSource.PlotWeightFromObject;
          att.PlotWeight = pWidth;
        }


        object material = materials.Count > 0 ? materials[i % materials.Count] : null;
        //Set material
        bool materialByName = !string.IsNullOrEmpty(material as string);
        Rhino.Display.DisplayMaterial inMaterial = material as Rhino.Display.DisplayMaterial;
        if(material is Color)
        {
          inMaterial = new Rhino.Display.DisplayMaterial((Color) material);
        }
        if(material != null && inMaterial == null && !materialByName)
        {
          if(!(material is string))
          {
            try //We also resort to try with IConvertible
            {
              inMaterial = (Rhino.Display.DisplayMaterial) Convert.ChangeType(material, typeof(Rhino.Display.DisplayMaterial));
            }
            catch(InvalidCastException)
            {
            }
          }
        }
        if(inMaterial != null || materialByName)
        {
          string matName;

          if(!materialByName)
          {
            matName = string.Format("A:{0}-D:{1}-E:{2}-S:{3},{4}-T:{5}",
              Format(inMaterial.Ambient),
              Format(inMaterial.Diffuse),
              Format(inMaterial.Emission),
              Format(inMaterial.Specular),
              inMaterial.Shine.ToString(),
              inMaterial.Transparency.ToString()
              );
          }
          else
          {
            matName = (string) material;
          }

          int materialIndex = doc.Materials.Find(matName, true);
          if(materialIndex < 0 && !materialByName) //Material does not exist and we have its specs
          {
            materialIndex = doc.Materials.Add(); //Let's add it
            if(materialIndex > -1)
            {
              Print("Added new material at position " + materialIndex + " named \"" + matName + "\". ");
              Rhino.DocObjects.Material m = doc.Materials[materialIndex];
              m.Name = matName;
              m.AmbientColor = inMaterial.Ambient;
              m.DiffuseColor = inMaterial.Diffuse;
              m.EmissionColor = inMaterial.Emission;
              //m.ReflectionColor = no equivalent
              m.SpecularColor = inMaterial.Specular;
              m.Shine = inMaterial.Shine;
              m.Transparency = inMaterial.Transparency;
              //m.TransparentColor = no equivalent
              m.CommitChanges();

              att.MaterialSource = Rhino.DocObjects.ObjectMaterialSource.MaterialFromObject;
              att.MaterialIndex = materialIndex;
            }
            else
              Print("Material did not add. Try cleaning up your materials."); //This never happened to me.
          }
          else if(materialIndex < 0 && materialByName) //Material does not exist and we do not have its specs. We do nothing
          {
            Print("Warning: material name not found. I cannot set the source to this material name. Add a material with name: " + matName);
          }
          else
          {
            //If this material exists, we do not replace it!
            att.MaterialSource = Rhino.DocObjects.ObjectMaterialSource.MaterialFromObject;
            att.MaterialIndex = materialIndex;
          }
        }


        int wires = wiresEach.Count > 0 ? wiresEach[i % wiresEach.Count] : 0;
        //Set wire density
        if(wires == -1 || wires > 0)
        {
          att.WireDensity = wires;
        }

        Bake(obj, att, groupIndex);
      }
    }
    else
    {
      Print("Inactive");
    }
# ---------- bakeattributes: C# additional code ----------
  void Bake(object obj, Rhino.DocObjects.ObjectAttributes att, int groupIndex)
  {
    if(obj == null)
      return;

    Guid id;

    //Bake to the right type of object
    if(obj is GeometryBase)
    {
      GeometryBase geomObj = obj as GeometryBase;

      switch(geomObj.ObjectType)
      {
        case Rhino.DocObjects.ObjectType.Brep:
          id = doc.Objects.AddBrep(obj as Brep, att);
          break;
        case Rhino.DocObjects.ObjectType.Curve:
          id = doc.Objects.AddCurve(obj as Curve, att);
          break;
        case Rhino.DocObjects.ObjectType.Point:
          id = doc.Objects.AddPoint((obj as Rhino.Geometry.Point).Location, att);
          break;
        case Rhino.DocObjects.ObjectType.Surface:
          id = doc.Objects.AddSurface(obj as Surface, att);
          break;
        case Rhino.DocObjects.ObjectType.Mesh:
          id = doc.Objects.AddMesh(obj as Mesh, att);
          break;
        case (Rhino.DocObjects.ObjectType) 1073741824://Rhino.DocObjects.ObjectType.Extrusion:
          id = (Guid) typeof(Rhino.DocObjects.Tables.ObjectTable).InvokeMember("AddExtrusion", BindingFlags.Instance | BindingFlags.InvokeMethod, null, doc.Objects, new object[]{obj, att});
          break;
        case Rhino.DocObjects.ObjectType.PointSet:
          id = doc.Objects.AddPointCloud(obj as Rhino.Geometry.PointCloud, att); //This is a speculative entry
          break;
        default:
          Print("The script does not know how to handle this type of geometry: " + obj.GetType().FullName);
          return;
      }
    }
    else
    {
      Type objectType = obj.GetType();

      if(objectType == typeof(Arc))
      {
        id = doc.Objects.AddArc((Arc) obj, att);
      }
      else if(objectType == typeof(Box))
      {
        id = doc.Objects.AddBrep(((Box) obj).ToBrep(), att);
      }
      else if(objectType == typeof(Circle))
      {
        id = doc.Objects.AddCircle((Circle) obj, att);
      }
      else if(objectType == typeof(Ellipse))
      {
        id = doc.Objects.AddEllipse((Ellipse) obj, att);
      }
      else if(objectType == typeof(Polyline))
      {
        id = doc.Objects.AddPolyline((Polyline) obj, att);
      }
      else if(objectType == typeof(Sphere))
      {
        id = doc.Objects.AddSphere((Sphere) obj, att);
      }
      else if(objectType == typeof(Point3d))
      {
        id = doc.Objects.AddPoint((Point3d) obj, att);
      }
      else if(objectType == typeof(Line))
      {
        id = doc.Objects.AddLine((Line) obj, att);
      }
      else if(objectType == typeof(Vector3d))
      {
        Print("Impossible to bake vectors");
        return;
      }
      else if(obj is IEnumerable)
      {
        int newGroupIndex;
        if(groupIndex == -1)
          newGroupIndex = doc.Groups.Add();
        else
          newGroupIndex = groupIndex;
        foreach(object o in obj as IEnumerable)
        {
          Bake(o, att, newGroupIndex);
        }
        return;
      }
      else
      {
        Print("Unhandled type: " + objectType.FullName);
        return;
      }
    }

    if(groupIndex != -1)
    {
      doc.Groups.AddToGroup(groupIndex, id);
      Print("Added " + obj.GetType().Name + " to group number " + groupIndex);
    }
    else
      Print("Added " + obj.GetType().Name);
  }

  static string Format(Color c)
  {
    return (new System.Text.StringBuilder("A")).Append(c.A.ToString()).Append("R").Append(c.R.ToString()).Append("G")
      .Append(c.G.ToString()).Append("B").Append(c.B.ToString()).ToString();
  }
# ---------- end bakeattributes ----------

# ----
deconstruct_domain_2 = DeconstructDomain()  # -> Start, End
colour_2 = Colour(colour_rgb_f_2)
colour_3 = Colour(gradient)

# ---- group: This component is from http://www.giuliopiacentino.com/grasshopper-tools/.
bakeattributes_2 = CSharpScript(objs=circle, activate=boolean_toggle_3)  # -> out; inputs objs: list, names: list of String, layers: list of String, colors: list of Color, pWidths: list of Double, wiresEach: list of Int32, materials: list, activate: Boolean, groupListTgthr: Boolean; same code as bakeattributes

# ----
bakeattributes_3 = CSharpScript(objs=sphere_2, colors=colour_rgb_f, activate=boolean_toggle)  # -> out; inputs objs: list, names: list of String, layers: list of String, colors: list of Color, pWidths: list of Double, wiresEach: list of Int32, materials: list, activate: Boolean, groupListTgthr: Boolean; same code as bakeattributes
geometry = Geometry(polygon.Polygon)
custom_preview_2 = CustomPreview(Geometry=sphere_2, Shader=colour_rgb_f)
custom_preview_3 = CustomPreview(Geometry=sphere_3, Shader=colour_2)
bakeattributes_4 = CSharpScript(objs=sphere_3, colors=colour_2, activate=boolean_toggle_4)  # -> out; inputs objs: list, names: list of String, layers: list of String, colors: list of Color, pWidths: list of Double, wiresEach: list of Int32, materials: list, activate: Boolean, groupListTgthr: Boolean; same code as bakeattributes

# ---- group: Make sure to turn this back off! Otherwise any changes will continuously bake copies.
boolean_toggle_6 = BooleanToggle(False)

# ----
custom_preview_4 = CustomPreview(Geometry=sphere_4, Shader=colour_3)
bakeattributes_5 = CSharpScript(objs=sphere_4, colors=colour_3, activate=boolean_toggle_5)  # -> out; inputs objs: list, names: list of String, layers: list of String, colors: list of Color, pWidths: list of Double, wiresEach: list of Int32, materials: list, activate: Boolean, groupListTgthr: Boolean; same code as bakeattributes
# (There are actually many components in other plugins that do baking, including in Lunchbox, Human, Elefront among others. Giulio Piacentino's component works without a plugin.)
checker = Checker_2(data=circle)
colour_4 = Colour(gradient_2)
checker_2 = Checker(colour=colour_2)
# Hint:
# If you're not seeing 'Correct!', make sure that you _really_ have only two lines.
panel_7 = Panel(checker)
custom_preview_5 = CustomPreview(Geometry=sphere_5, Shader=colour_4)
bakeattributes_6 = CSharpScript(objs=sphere_5, colors=colour_4, activate=boolean_toggle_6)  # -> out; inputs objs: list, names: list of String, layers: list of String, colors: list of Color, pWidths: list of Double, wiresEach: list of Int32, materials: list, activate: Boolean, groupListTgthr: Boolean; same code as bakeattributes
panel_8 = Panel(checker_2)

# ---- group: The 'Contour' component needs as input a point that is near the geometry that you are Contouring.
point_2 = Point(construct_point_4)

# ----
vector_xyz = VectorXYZ(XComponent=Slider(1, range=0..1), YComponent=Slider(1, range=0..1), ZComponent=0)  # -> Vector, Length
geometry_2 = Geometry(circle_4)
colour_5 = Colour(ColourSwatch(SwatchColor=RGB(51, 255, 255)))
boundary_surfaces = BoundarySurfaces(Edges=geometry_2)

# ---- group: As a note, there are four different 'Contour' components that look similar. Take care when you're placing this component!
# Explanation: The 'Contour' component slices geometry and generates lines. If you Contour a 2d object, it creates a set of lines; if you Contour a 3d object, it will generate a set of closed polylines representing a plane.
contour = Contour(Shape=geometry, Point=point_2, Direction=vector_xyz.Vector, Distance=Slider(1.866, range=1..5))

# ----
# Hint:
# Challenge E5 may be a good reference to how to use the Gradient and Bounds components together.
custom_preview_6 = CustomPreview(Geometry=boundary_surfaces, Shader=colour_5)
boolean_2 = Boolean(Toggle(False))

# ---- group: These two components are from the "Human" plugin.
createattributes_2 = CreateAttributes(Color=colour_5, enableFullPath=False)
createhatch_2 = CreateHatch(
    Bake=boolean_2,
    Curves=geometry_2,
    HatchPatternName="Solid",
    HatchScale=1,
    HatchRotation=0,
    Attributes=createattributes_2)

# ----
custom_preview_7 = CustomPreview(
    Geometry=contour,
    Shader={ambient=RGB(0, 0, 0), diffuse=RGB(255, 105, 180), emission=RGB(76, 32, 54), shine=0.5, specular=RGB(255, 255, 255), transparency=0})
geometry_3 = Geometry(createhatch_2)

# ==== cluster Checker
colour = ClusterInput()
split_argb = SplitARGB(Colour=colour)  # -> Alpha, Red, Green, Blue
relative_differences = RelativeDifferences(Values=split_argb.Red)
relative_differences_2 = RelativeDifferences(Values=split_argb.Green)
relative_differences_3 = RelativeDifferences(Values=split_argb.Blue)
average = Average(Input=relative_differences)
average_2 = Average(Input=relative_differences_2)
average_3 = Average(Input=relative_differences_3)
mass_addition = MassAddition(Input=[average, average_2, average_3])  # -> Result, PartialResults
larger_than = LargerThan(FirstNumber=mass_addition.Result, SecondNumber="0.001")  # -> LargerThan, OrEqualTo
stream_filter = StreamFilter(Gate=larger_than.LargerThan, Stream0=" ", Stream1="Correct!")
data = Data(stream_filter)
data_2 = ClusterOutput(data)
panel = Panel(mass_addition.Result)

# ==== cluster Checker_2
data = ClusterInput()
data_2 = Data(data)
geometry_pipeline = GeometryPipeline(
    GroupByLayer=False,
    GroupByType=False,
    IncludeHidden=True,
    IncludeLocked=True,
    LayerFilter="*",
    NameFilter="*",
    TypeFilter=4)
boolean = Boolean(data_2)
mass_addition = MassAddition(Input=flatten(boolean))  # -> Result, PartialResults
length = Length(Curve=geometry_pipeline)
mass_addition_2 = MassAddition(Input=length)  # -> Result, PartialResults
boolean_2 = Boolean(mass_addition.Result)
pi = Pi(Factor=1)
division = Division(A=mass_addition_2.Result, B=pi)
similarity = Similarity(FirstNumber=Slider(60, range=0..100), SecondNumber=division, Threshold=0.1)  # -> Similarity, AbsoluteDifference
panel = Panel(division)
gate_and = GateAnd(A=boolean_2, B=similarity.Similarity)
stream_filter = StreamFilter(Gate=gate_and, Stream0=" ", Stream1="Correct!")
data_3 = Data(stream_filter)
data_4 = ClusterOutput(data_3)
