# Grasshopper definition GH_Challenges_F_trees.ghx (Grasshopper 0.9.76)

panel = Panel("Explanation F3")
# Double-click on the Slider on the 'Number Slider' text (or Right-click)  to edit the Slider properties.
# Grasshopper Challenges
# By Dan Taeyoung, 2018. https://github.com/dantaeyoung/GrasshopperChallenges
# Challenges F - Trees and Trees 1
# Trees, in Grasshopper, are ways to store and order data. This is one way of introducing trees in an intuitive way.
panel_2 = Panel("Explanation F0")
panel_3 = Panel("Explanation F2")
panel_5 = Panel("Explanation F1")
panel_6 = Panel("Explanation F8")
panel_7 = Panel("Challenge F6")
panel_8 = Panel("Explanation F9")
panel_9 = Panel("Explanation F4")

# ---- group: This generates random points inside a circle.
point = Point(Point(403.43749, 42.01082882, 0))
circle = Circle(Plane=point, Radius=Slider(22, range=0..100))
boundary_surfaces = BoundarySurfaces(Edges=circle)
populate_geometry = PopulateGeometry(Geometry=boundary_surfaces, Count=Slider(15, range=0..100), Seed=1)

# ----
point_2 = Point([Point(308.4024885, 70, 0), Point(308.4024885, 50, 0), Point(308.4024885, 30, 0), Point(308.4024885, 10, 0)])
panel_10 = Panel("""3
4
5
6""")
panel_11 = Panel("""1
1000""")
point_3 = Point(Point(400.1660284, -14.69450591, 0))
point_4 = Point(Point(493.5844324, -13.96751444, 0))
# Add a 'Line' component and a 'Graft' component to create all the possible lines between the four points and the five points.
displaytext = DisplayText(challenge="Challenge F5", loc=point_2)
# Using only the components below, connect all of the randomly generated points to each other,
# so that each point is connect to all other points.
displaytext_2 = DisplayText(challenge="Challenge F7", loc=point_3)
panel_12 = Panel("""10
20
30
40""")
panel_13 = Panel("""10
20
30
40""")
# Using only the components below, generate all the results of the times table (e.g. 2 x 3, 2 x 4...)
series = Series(Start=1, Step=1, Count=9)
# Using the Sort List example, and the existing code below, find a way to draw a line between a point and another point closest to that point.
# Hint:
# Try sorting other things through the 'Values' input/output in the Sort List component.
displaytext_3 = DisplayText(challenge="Challenge F10", loc=point_4)

# ---- group: This generates random points inside a circle.
point_5 = Point(Point(496.8798482, 40.91013175, 0))
circle_2 = Circle(Plane=point_5, Radius=Slider(22, range=0..100))
boundary_surfaces_2 = BoundarySurfaces(Edges=circle_2)
populate_geometry_2 = PopulateGeometry(Geometry=boundary_surfaces_2, Count=Slider(5, range=0..100), Seed=1)

# ----
graft_tree = GraftTree(Tree=panel_10, IncludeEmptyLists=True, IncludeNullItems=True)
# Any guesses as to what the answer will be?
# Connect the output to the panel -- or if you want a challenge, type in your guess into the panel directly.
panel_14 = Panel("3")
panel_15 = Panel("""3
4
5
6""")
# Okay, this is a little trickier.
# Any guesses as to what the answer will be?
# Connect the output to the panel -- or if you want a challenge, type in your guess into the panel directly.
panel_16 = Panel("""3
4
5
6""")
panel_17 = Panel("""1
10
100
1000""")
panel_18 = Panel("""1
1000""")
# Any guesses as to what the answer will be?
# Connect the output to the panel -- or if you want a challenge, type in your guess into the panel directly.
panel_19 = Panel("""3
4
5
6""")
# Any guesses as to what the answer will be?
# Connect the output to the panel -- or if you want a challenge, type in your guess into the panel directly.
panel_20 = Panel("10")
# Okay, this is a little trickier.
# Any guesses as to what the answer will be?
# Connect the output to the panel -- or if you want a challenge, type in your guess into the panel directly.
panel_21 = Panel("""3
4
5
6""")
panel_22 = Panel("""1
1000""")
panel_23 = Panel(series)
# Okay, this is a little trickier also. This uses the same data as C3.
# Any guesses as to what the answer will be?
# Connect the output to the panel -- or if you want a challenge, type in your guess into the panel directly.
panel_24 = Panel("""3
4
5
6""")
panel_25 = Panel("""1
1000""")
graft_tree_2 = GraftTree(Tree=panel_12, IncludeEmptyLists=True, IncludeNullItems=True)
graft_tree_3 = GraftTree(Tree=panel_13, IncludeEmptyLists=True, IncludeNullItems=True)
multiplication = Multiplication(A=graft_tree, B=panel_11)
series_2 = Series(Start=0, Step=1, Count=10)
name = Panel("""Muriel
Denise
Seondeok
Joan""")
birth_year = Panel("""1925
1931
595
1412""")
panel_26 = Panel("""3
4
5
6""")
# 12. The reason is because, when Grasshopper operates between
# `a list of lists` and `a list`,
# it will match up
# `the first list in the lists of lists A` with `the first item in list B`,
# `the second list in the lists of list A` with `the second item in list B`, etc.
panel_27 = Panel("""3
4
5
6""")
panel_28 = Panel("""1
1000""")
point_6 = Point(Point(589.5712607, -13.61422858, 0))
multiplication_2 = Multiplication(A=panel_19, B=panel_20)
# 2. This panel shows us "1 List with 2 Items."
# 3. This gray bar indicates
# that the items below are in the same list.
panel_29 = Panel("""1
1000""")
multiplication_3 = Multiplication(A=panel_14, B="10")
# Explanation:
# 1. This panel shows us "1 List with 4 Items."
panel_30 = Panel("""3
4
5
6""")
graft_tree_4 = GraftTree(Tree=panel_25, IncludeEmptyLists=True, IncludeNullItems=True)
graft_tree_5 = GraftTree(Tree=panel_16, IncludeEmptyLists=True, IncludeNullItems=True)
multiplication_4 = Multiplication(A=panel_15, B=panel_17)
# Okay, another guess.
# Any guesses as to what the answer will be?
# Connect the output to the panel.
panel_31 = Panel(series_2)
point_7 = Point([Point(328.4024885, 80, 0), Point(328.4024885, 60, 0), Point(328.4024885, 40, 0), Point(328.4024885, 20, 0), Point(328.4024885, 0, 0)])
point_8 = Point([Point(308.4024885, 70, 0), Point(308.4024885, 50, 0), Point(308.4024885, 30, 0), Point(308.4024885, 10, 0)])
multiplication_5 = Multiplication(A=panel_21, B=panel_22)
panel_32 = Panel(multiplication)

# ---- group: Merge will combine data streams together
merge = Merge(Data1=graft_tree_3, Data2=graft_tree_2)

# ----
# Using F10 above, find a way to connect each point with the closest 3 points next to it.
displaytext_4 = DisplayText(challenge="Challenge F11", loc=point_6)
graft_tree_6 = GraftTree(IncludeEmptyLists=True, IncludeNullItems=True)
multiplication_6 = Multiplication()
# Explanation:
panel_33 = Panel("""3
4
5
6""")
panel_34 = Panel("""1
1000""")
sort_list = SortList(Keys=birth_year, ValuesValuesA=name)  # -> Keys, ValuesValuesA
multiplication_7 = Multiplication(A=graft_tree_5, B=panel_18)
graft_tree_7 = GraftTree(Tree=panel_27, IncludeEmptyLists=True, IncludeNullItems=True)
multiplication_8 = Multiplication(A=panel_24, B=graft_tree_4)
mass_addition = MassAddition(Input=multiplication)  # -> Result, PartialResults

# ---- group: "Mass Addition" adds everything together in a list.
mass_addition_2 = MassAddition(Input=series_2)  # -> Result, PartialResults

# ----
# 6. However, if we Graft one of the lists:
graft_tree_8 = GraftTree(Tree=panel_26, IncludeEmptyLists=True, IncludeNullItems=True)
# 2. This means that, when a data tree passes through a component,
# each operation of the component is applied onto each list.
# 
# OR in other words, each of the four lists, or 'branches', of the tree,
# is being processed by the 'Mass Multpliciation' component.
panel_35 = Panel(merge)
graft_tree_9 = GraftTree(Tree=panel_34, IncludeEmptyLists=True, IncludeNullItems=True)

# ---- group: This generates random points inside a circle.
point_9 = Point(Point(593.9332095, 41.63712322, 0))
circle_3 = Circle(Plane=point_9, Radius=Slider(22, range=0..100))
boundary_surfaces_3 = BoundarySurfaces(Edges=circle_3)
populate_geometry_3 = PopulateGeometry(Geometry=boundary_surfaces_3, Count=Slider(27, range=0..100), Seed=1)

# ----
geometry = Geometry()
geometry_2 = Geometry(populate_geometry)
data = Data()

# ---- group: Double-click on me to edit me!
panel_36 = Panel("")

# ----
sorted_birth_years = Panel(sort_list.Keys)
names_sorted_in_order_of_birth_year = Panel(sort_list.ValuesValuesA)
panel_37 = Panel(graft_tree_7)
data_2 = Data(mass_addition.Result)
# 1. Components like 'Mass Multiplication'
# work on a single list at a time.
# 
# Mass Multiplication ,when given a list,
# multplies together everything in that list.
mass_multiplication = MassMultiplication(Input=merge)  # -> Result, PartialResults
panel_38 = Panel("""1
1000""")
checker = Checker_7(data=geometry)
panel_39 = Panel(graft_tree_9)
panel_40 = Panel(data)
panel_41 = Panel(mass_addition_2.Result)
number_slider = Slider(1, range=0..1)
graft_tree_10 = GraftTree(IncludeEmptyLists=True, IncludeNullItems=True)
line = Line()
geometry_3 = Geometry(populate_geometry_2)
multiplication_9 = Multiplication(A=panel_33, B=graft_tree_9)
checker_2 = Checker_4()
checker_3 = Checker_5()
checker_4 = Checker(data=panel_36)
checker_5 = Checker_3()
checker_6 = Checker_2()
example_result = Geometry([Point(807.3078012, 136.3755215, 0), Point(797.3078012, 126.3755215, 0), Point(787.3078012, 116.3755215, 0), Point(777.3078012, 106.3755215, 0), Point(767.3078012, 96.37552148, 0), Point(807.3078012, 126.3755215, 0)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])
# Create a set of points that looks like a pyramid. Do this by using the components below.
# (This is pretty difficult. I forget how to do this sometimes. If you figure it out, let me know!)
# Compare with example result:
displaytext_5 = DisplayText(challenge="Exxxtra-Challenge Ex-F1", loc=example_result)
# 7. We get four lists, each with 1 item in it!
# 8. There are four gray bars,
# indicating that there are four lists.
# 9. Notice that this line is dashed.
# This means that this data is not a
# single piece of data, or a list, but
# structured as a tree (roughly, a list of lists).
panel_42 = Panel(graft_tree_8)
checker_7 = Checker_6()
checker_8 = Checker_8(data=panel_40)
panel_43 = Panel(checker)
multiplication_10 = Multiplication(A=graft_tree_7, B=panel_38)
panel_44 = Panel(mass_multiplication.Result)
data_3 = Data(line)
graft_tree_11 = GraftTree(Tree=geometry_3, IncludeEmptyLists=True, IncludeNullItems=True)

# ---- group: This visualizes the 'tree' structure; when you 'Graft', you're making your list of, say, 10 items into 10 lists, each containing 1 item each.
param_viewer = ParamViewer(geometry)

# ---- group: Each gray 'band' or header demarcates each new list, or "branch". In a list of lists (a 'tree'), a single list is a 'branch'.
panel_45 = Panel(geometry)

# ----
# Search the menu above for 'Extrude'. Alternately, double-click on the Grasshopper canvas - this will bring up a search menu. Type 'Extrude', and choose the plain 'Extrude', not 'Extrude Along', etc..
panel_46 = Panel(checker_4)
panel_47 = Panel(checker_6)
# 1. If you notice carefully,
# the resulting data is the same as in C3,
# except the order is different!
# 2. Instead of 4 lists containing 2 items each,
# we have 2 lists containing 4 items each.
# 
# (Why does this matter? We'll get to that later.)
# 3. One simple way to think of it as:
# the grafting operation puts each item in a list on its own 'branch', or in a new list.
# 4. What you graft often will structure your data.
# 
# So in this case, grafting the '1, 1000' data now gives us results that is structured as:
# 
# 'things multipled by 1'
# and
# 'things multiplied by 1000'.
panel_48 = Panel(multiplication_9)
series_3 = Series(Start=number_slider, Step=1, Count=Slider(10, range=0..10))  # -> graft(Series)
panel_49 = Panel(checker_2)
panel_50 = Panel(data_3)
panel_51 = Panel(checker_3)
# 4. When we multiply the two lists together..
multiplication_11 = Multiplication(A=panel_30, B=panel_29)
panel_52 = Panel(checker_5)
panel_53 = Panel(checker_7)
panel_54 = Panel(checker_8)
distance = Distance(PointA=graft_tree_11, PointB=geometry_3)
checker_9 = Checker_9(data=data_3)
checker_10 = Checker_10()
# 13. Each pair of arrows represents how Grasshopper 'matches up' data
# when processing it in a component.
panel_55 = Panel(multiplication_10)
series_4 = Series(Start=number_slider, Step=1, Count=10)
sort_list_2 = SortList(Keys=distance)  # -> Keys, ValuesValuesA
line_2 = Line()
# Combining challenges C6 and C7, create a grid of points; on that grid of points, place a polyline you have drawn, and rotate each polyline in-place with a random degree.
# Create a set of points that looks like a triangle, starting at one point, two points, three points etc. Do this by using two 'Series' components.
# Hint:
# One series is plugged into the other.
panel_56 = Panel(checker_9)
# Create a set of points that looks like a pyramid. Do this by using the components below.
panel_57 = Panel(checker_10)
geometry_4 = Geometry(populate_geometry_3)
# 10. If we multiply..
multiplication_12 = Multiplication(A=graft_tree_8, B=panel_28)
series_5 = Series(Start=number_slider, Step=1, Count=10)
# 5. We get a list with 4 items.
panel_58 = Panel(multiplication_11)
unit_z = UnitZ(Factor=1)

# ---- group: You can keep on adding more outputs by zooming in
list_item = ListItem(List=sort_list_2.Keys, Index=0, Wrap=True)  # -> Item, Item1, Item2, Item3

# ----
panel_59 = Panel(sort_list_2.Keys)
graft_tree_12 = GraftTree(IncludeEmptyLists=True, IncludeNullItems=True)
# 11. We get four lists, each with two items in them.
# If the rotation is moving strangely, it's because the Rotate component requires a center/pivot point -- the 'Plane' input. Where would you get a list of points around which your geometry should rotate?
panel_60 = Panel(multiplication_12)

# ---- group: This is all zero because it is getting the distance between a point and itself
distance_to_first_closest_point = Panel(list_item.Item)

# ----
construct_point = ConstructPoint(XCoordinate=graft_tree_12, YCoordinate=0, ZCoordinate=0)  # -> simplify(Point)
distance_to_third_closest_point = Panel(list_item.Item2)
distance_to_second_closest_point = Panel(list_item.Item1)
trim_tree = TrimTree(Tree=construct_point, Depth=1)
move = Move(Geometry=trim_tree, Motion=unit_z)  # -> Geometry, Transform

# ==== cluster Checker
data = ClusterInput()
data_2 = Data(data)
panel = Panel("""3
40
500
6000""")
equality = Equality(FirstNumber=panel, SecondNumber=data_2)  # -> Equality, Inequality
correct_if_true_and_not_null = CorrectIfTrueAndNotNull(bool=equality.Equality, optional_text="Correct!")
data_3 = ClusterOutput(correct_if_true_and_not_null)

# ==== cluster Checker_2
data = ClusterInput()
data_2 = Data(data)
panel = Panel("""30
40
50
60""")
equality = Equality(FirstNumber=panel, SecondNumber=data_2)  # -> Equality, Inequality
correct_if_true_and_not_null = CorrectIfTrueAndNotNull_2(bool=equality.Equality, optional_text="Correct!")
data_3 = ClusterOutput(correct_if_true_and_not_null)

# ==== cluster Checker_3
data = ClusterInput()
data_2 = Data(data)
panel = Panel("""3
40
500
6000""")
equality = Equality(FirstNumber=panel, SecondNumber=data_2)  # -> Equality, Inequality
panel_2 = Panel("""Correct!
When you have two sets of input lists, Grasshopper will match up 
the first item in List A to the first item in List B, 

the second item in list A to the second item in List B,
and so on.""")
correct_if_true_and_not_null = CorrectIfTrueAndNotNull_2(bool=equality.Equality, optional_text=panel_2)
data_3 = ClusterOutput(correct_if_true_and_not_null)

# ==== cluster Checker_4
data = ClusterInput()
data_2 = Data(data)
panel = Panel("""3
4000
5000
6000""")
panel_2 = Panel("""Correct!

When you have two sets of input lists that have different lengths, Grasshopper will try to match up two lists.

When Grasshopper 'runs out' of items to match on the shorter list, then it will repeat the last item of the shorter list to compute with the other item.

So: it will start matching up the third item on List A with the second item on List B,
then the fourth item on List A with the second item on List B.""")
equality = Equality(FirstNumber=panel, SecondNumber=data_2)  # -> Equality, Inequality
correct_if_true_and_not_null = CorrectIfTrueAndNotNull_2(bool=equality.Equality, optional_text=panel_2)
data_3 = ClusterOutput(correct_if_true_and_not_null)

# ==== cluster Checker_5
data = ClusterInput()
data_2 = Data(flatten(data))
panel = Panel("""3
3000
4
4000
5
5000
6
6000""")
panel_2 = Panel("""Correct!

And interesting, right?""")
equality = Equality(FirstNumber=panel, SecondNumber=data_2)  # -> Equality, Inequality
correct_if_true_and_not_null = CorrectIfTrueAndNotNull_2(bool=equality.Equality, optional_text=panel_2)
data_3 = ClusterOutput(correct_if_true_and_not_null)

# ==== cluster Checker_6
data = ClusterInput()
data_2 = Data(flatten(data))
panel = Panel("""3
4
5
6
3000
4000
5000
6000""")
equality = Equality(FirstNumber=panel, SecondNumber=data_2)  # -> Equality, Inequality
correct_if_true_and_not_null = CorrectIfTrueAndNotNull_2(bool=equality.Equality, optional_text="Correct!")
data_3 = ClusterOutput(correct_if_true_and_not_null)

# ==== cluster Checker_7
data = ClusterInput()
data_2 = Data(data)
list_length = ListLength(List=flatten(data_2))
larger_than = LargerThan(SecondNumber=0)  # -> LargerThan, OrEqualTo
equality = Equality(FirstNumber="20", SecondNumber=list_length)  # -> Equality, Inequality
stream_filter = StreamFilter(Gate=equality.Equality, Stream0=" ", Stream1="Correct!")
null_item = NullItem(Item=equality.Equality)  # -> NullFlags, InvalidFlags, Description
stream_filter_2 = StreamFilter(Gate=null_item.NullFlags, Stream0=stream_filter, Stream1=" ")
data_3 = Data(stream_filter_2)
data_4 = ClusterOutput(data_3)

# ==== cluster DisplayText
md_slider = MDSlider(
    slider_value=Point(0, 0.07560916063, 0.5),
    SliderMode=0,
    x_domain=Domain(-10, 10),
    y_domain=Domain(-10, 10),
    z_domain=Domain(0, 1))
loc = ClusterInput()
loc_2 = Data(loc)
item = ListItem(List=loc_2, Index=0, Wrap=True)
move = Move(Geometry=item, Motion=md_slider)  # -> Geometry, Transform
challenge = ClusterInput()
bool = Boolean(True)
pdecon = Deconstruct(Point=move.Geometry)  # -> XComponent, YComponent, ZComponent
challenge_2 = Data(challenge)
pt = ConstructPoint(XCoordinate=pdecon.XComponent, YCoordinate=Slider(-14, range=-50..50), ZCoordinate=pdecon.ZComponent)
c_script = CSharpScript(face="Arial", bold=bool, size=Slider(3.046, range=0..11), content=challenge_2, pl=pt)  # -> out, A; inputs face: String, bold: Boolean, italics: Boolean, size: Double, content: String, pl: Plane
# ---------- c_script: C# ----------
    if(size == 0)
      size = 1;

    if(!string.IsNullOrEmpty(face) && size > 0 && !string.IsNullOrEmpty(content) &&
      pl.IsValid)
    {

      var te = RhinoDoc.ActiveDoc.Objects.AddText(content, pl, size, face, bold, italics);
      Rhino.DocObjects.TextObject txt = RhinoDoc.ActiveDoc.Objects.Find(te) as Rhino.DocObjects.TextObject;

      if(txt != null)
      {
        var tt = txt.Geometry as Rhino.Geometry.TextEntity;
        A = tt.Explode();
      }
      
      RhinoDoc.ActiveDoc.Objects.Delete(te, true);
    }
# ---------- end c_script ----------
boundary = BoundarySurfaces(Edges=c_script.A)
S = ClusterOutput(boundary)

# ==== cluster Checker_8
data = ClusterInput()
data_2 = Data(flatten(data))
panel = Panel("""1.0
2.0
3.0
4.0
5.0
6.0
7.0
8.0
9.0
2.0
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""")
sort = SortList(Keys=panel)  # -> Keys, ValuesA
sort_2 = SortList(Keys=data_2)  # -> Keys, ValuesA
equality = Equality(FirstNumber=sort.Keys, SecondNumber=sort_2.Keys)  # -> Equality, Inequality
correct_if_true_and_not_null = CorrectIfTrueAndNotNull_2(bool=equality.Equality, optional_text="Correct!")
data_3 = ClusterOutput(correct_if_true_and_not_null)

# ==== cluster Checker_9
data = ClusterInput()
data_2 = Data(data)
tstat = TreeStatistics(Tree=data_2)  # -> Paths, Length, Count
ma = MassAddition(Input=tstat.Length)  # -> Result, PartialResults
multiplication = Multiplication(A=tstat.Count, B=tstat.Count)
equality = Equality(FirstNumber=ma.Result, SecondNumber=multiplication)  # -> Equality, Inequality
correct_if_true_and_not_null = CorrectIfTrueAndNotNull_2(bool=equality.Equality)
data_3 = ClusterOutput(correct_if_true_and_not_null)

# ==== cluster Checker_10
data = ClusterInput()
data_2 = Data(flatten(data))
panel = Panel("""3003
4004
5005
6006""")
panel_2 = Panel("""Correct!

And interesting, right?""")
equality = Equality(FirstNumber=panel, SecondNumber=data_2)  # -> Equality, Inequality
correct_if_true_and_not_null = CorrectIfTrueAndNotNull_2(bool=equality.Equality, optional_text=panel_2)
data_3 = ClusterOutput(correct_if_true_and_not_null)

# ==== cluster CorrectIfTrueAndNotNull
bool = ClusterInput()
optional_text = ClusterInput()
bool_2 = Boolean(bool)
not = GateNot(A=bool_2)
optional_text_2 = Text(optional_text)
null_item = NullItem(Item=optional_text_2)  # -> NullFlags, InvalidFlags, Description
ma = MassAddition(Input=not)  # -> Result, PartialResults
null = NullItem(Item=bool_2)  # -> NullFlags, InvalidFlags, Description
bool_3 = Boolean(ma.Result)
filter = StreamFilter(Gate=null_item.NullFlags, Stream0=optional_text_2, Stream1="Correct!")
cluster = Cluster(I=null.NullFlags)
or = GateOr(A=bool_3, B=cluster)
not_2 = GateNot(A=or)
null_item_2 = NullItem(Item=not_2)  # -> NullFlags, InvalidFlags, Description
stream_filter = StreamFilter(Gate=not_2, Stream0=" ", Stream1=filter)
stream_filter_2 = StreamFilter(Gate=null_item_2.NullFlags, Stream0=stream_filter, Stream1=" ")
data = Data(stream_filter_2)
data_2 = ClusterOutput(data)

# ==== cluster CorrectIfTrueAndNotNull_2
optional_text = ClusterInput()
bool = ClusterInput()
bool_2 = Boolean(bool)
not = GateNot(A=bool_2)
optional_text_2 = Text(optional_text)
null_item = NullItem(Item=optional_text_2)  # -> NullFlags, InvalidFlags, Description
ma = MassAddition(Input=not)  # -> Result, PartialResults
bool_3 = Boolean(ma.Result)
filter = StreamFilter(Gate=null_item.NullFlags, Stream0=optional_text_2, Stream1="Correct!")
not_2 = GateNot(A=bool_3)
null_item_2 = NullItem(Item=not_2)  # -> NullFlags, InvalidFlags, Description
stream_filter = StreamFilter(Gate=not_2, Stream0=" ", Stream1=filter)
stream_filter_2 = StreamFilter(Gate=null_item_2.NullFlags, Stream0=stream_filter, Stream1=" ")
data = Data(stream_filter_2)
data_2 = ClusterOutput(data)

# ==== cluster Cluster
I = ClusterInput()
ma = MassAddition(Input=I)  # -> Result, PartialResults
bool = Boolean(ma.Result)
bool_2 = ClusterOutput(bool)
