# Grasshopper definition GH_Challenges_F_trees_upon_trees.ghx (Grasshopper 0.9.76)

number_slider = Slider(100, range=0..100)
# Grasshopper Challenges
# By Dan Taeyoung, 2016. https://github.com/provolot/GrasshopperChallenges
# Challenges F - "Trees all the way down"
# Challenge F1: Creating a 'Line' component creates lines between the two sets of points. What happens when one set of points is longer than the other?
number_slider_2 = Slider(10, range=0..10)
# Challenge F2: Connect the 'Graft' component somewhere to connect every single point to every other point with a line.
number_slider_3 = Slider(6, range=0..10)
series = Series(Start=0, Step=Slider(10, range=0..10), Count=Slider(6, range=0..10))
series_2 = Series(Start=0, Step=number_slider_2, Count=Slider(6, range=0..10))
series_3 = Series(Start=0, Step=Slider(10, range=0..10), Count=Slider(6, range=0..10))
series_4 = Series(Start=0, Step=Slider(10, range=0..10), Count=number_slider_3)
addition = Addition(A=number_slider)
addition_2 = Addition(A=number_slider, B=Slider(21, range=0..100))
construct_point = ConstructPoint(XCoordinate=addition_2, YCoordinate=series_3, ZCoordinate=0)
construct_point_2 = ConstructPoint(XCoordinate=Slider(21, range=0..100), YCoordinate=series_4, ZCoordinate=0)
construct_point_3 = ConstructPoint(XCoordinate=addition, YCoordinate=series, ZCoordinate=0)
construct_point_4 = ConstructPoint(XCoordinate=0, YCoordinate=series_2, ZCoordinate=0)
point = Point(construct_point_3)
point_2 = Point(construct_point_4)
point_3 = Point(construct_point)
point_4 = Point(construct_point_2)
line = Line(StartPoint=point_2, EndPoint=point_4)
graft_tree = GraftTree(IncludeEmptyLists=True, IncludeNullItems=True)
line_2 = Line(StartPoint=point, EndPoint=point_3)
geometry = Geometry(line_2)
geometry_2 = Geometry(line)
checker = Checker(data=geometry)
checker_2 = Checker(data=geometry_2)

# ---- group: This visualizes the 'tree' structure; when you 'Graft', you're making your list of, say, 10 items into 10 lists, each containing 1 item each.
param_viewer = ParamViewer(geometry)

# ----
panel = Panel(checker)

# ---- group: Each gray 'band' or header demarcates each new list, or "branch". In a list of lists (a 'tree'), a single list is a 'branch'.
panel_2 = Panel(geometry)

# ----
panel_3 = Panel(checker_2)

# ==== cluster Checker
data = ClusterInput()
data_2 = Data(data)
end_points = EndPoints(Curve=data_2)  # -> Start, End
panel = Panel("20")
cull_duplicates = CullDuplicates(Points=flatten([end_points.Start, end_points.End]), Tolerance=0.1, CullMode=3)  # -> Points, Indices, Valence
list_length = ListLength(List=flatten(data_2))
list_length_2 = ListLength(List=cull_duplicates.Points)
larger_than = LargerThan(FirstNumber=list_length, SecondNumber=list_length_2)  # -> LargerThan, OrEqualTo
modulus = Modulus(A=list_length_2, B=Slider(2, range=0..10))
stream_filter = StreamFilter(Gate=larger_than.LargerThan, Stream0=" ", Stream1="Correct!")
panel_2 = Panel(list_length_2)
data_3 = Data(stream_filter)
data_4 = ClusterOutput(data_3)
