# Grasshopper definition GH_Challenges_G_clusters.ghx (Grasshopper 1.0.7)

panel = Panel("Challenge G7")
# Can you make some simple Clusters that are designed to plug into each other --
# That have drastically different effects
# depending on the order in which they are plugged into each other?
# Try sorting other things through the 'Values' input/output in the Sort List component.
panel_2 = Panel("Challenge G8")
# Double-click on the Slider on the 'Number Slider' text (or Right-click)  to edit the Slider properties.
# Grasshopper Challenges
# By Dan Taeyoung, 2018. https://github.com/dantaeyoung/GrasshopperChallenges
# Challenges G - Clusters
# Clusters are way to turn lots of components and 'package' them inside a single component!
# Not only are they very convenient and, they can do really interesting / fun things as well.
panel_3 = Panel("Explanation G0")
point = Point(Point(87.20573662, 25.51418311, 0))
panel_4 = Panel("""2
4
4
4
5
5
7
9""")
panel_5 = Panel("""2
4
4
4
5
5
7
9""")
point_2 = Point(Point(652.0219937, 38.75028248, 0))
point_3 = Point(Point(452.3898391, 37.0812184, 0))
point_4 = Point(Point(841.2627202, 37.42032273, 0))
point_5 = Point(Point(266.3012088, 30.1063747, 0))
point_6 = Point(Point(841.2627202, 37.42032273, 0))
# Try creating a cluster.
displaytext = DisplayText(challenge="Explanation G1", loc=point)
# Try making this into two identical clusters.
displaytext_2 = DisplayText(challenge="Challenge G4", loc=point_2)
# Add an input so you can control the number of division points -- from outside of the cluster.
displaytext_3 = DisplayText(challenge="Challenge G3", loc=point_3)
# If you right click on a cluster, you can click "Disentangle" --
# this will stop clusters from referring to each other, and will make each cluster its own thing.
displaytext_4 = DisplayText(challenge="Explanation G6", loc=point_4)
# It would be nice to control some of the internal inputs from outside of the cluster.
#  Let's add an input.
displaytext_5 = DisplayText(challenge="Explanation G2", loc=point_5)
# If you hover over each cluster,
# It will tell you that:
# "This cluster occurs twice in this document".
# 
# This means that these two clusters are connected together.
displaytext_6 = DisplayText(challenge="Explanation G5", loc=point_6)
# 1. Select everything in the purple group,
# 
# 2. *Middle*-click, and select the 'package' icon at the top.
# 
# 3. Behold! You have a cluster.
# 
# 4. You can double-click and enter that cluster.
circle = Circle(Plane=point, Radius=Slider(33, range=0..100))
number_slider = Slider(33, range=0..100)
number_slider_2 = Slider(6, range=0..9)

# ---- group: This calculates the standard deviation. It's made up of a bunch of components.
number = Number(panel_4)
# Clusters can be turned into a single component.
average = Average(Input=number)
subtraction = Subtraction(A=average, B=number)
square = Square(Value=subtraction)
average_2 = Average(Input=square)
square_root = SquareRoot(Value=average_2)

# ----
# Can you make some simple Clusters that are designed to plug into each other?
# How do you have to craft your inputs/outputs to accomodate this?
number_slider_3 = Slider(33, range=0..100)
number_slider_4 = Slider(33, range=0..100)
circle_2 = Circle(Plane=point_5, Radius=Slider(33, range=0..100))

divide_curve = DivideCurve(Curve=circle, Count=Slider(5, range=0..10), Kinks=False)  # -> Points, Tangents, Parameters
circle_3 = Circle(Plane=divide_curve.Points, Radius=Slider(33, range=0..100))

circle_4 = Circle(Plane=point_3, Radius=Slider(33, range=0..100))
point_7 = Point(point_2)
# Double-click on this cluster to 'open it up'.
cluster = Cluster(number=panel_5)
cluster_2 = Cluster_5(point=point_4, radius=number_slider_3)  # -> list_b, polygon_2
polygon = Polygon(Plane=point_7, Radius=number_slider, Segments=number_slider_2, FilletRadius=0)  # -> Polygon, Length
cluster_3 = Cluster_3(curve=circle_4)
cluster_4 = Cluster_4(point=point_6, radius=number_slider_4)  # -> list_b, polygon_2
# 1. Double-click on the cluster to open it.
cluster_5 = Cluster_2(curve=circle_2)
divide_curve_2 = DivideCurve(Curve=polygon.Polygon, Count=10, Kinks=False)  # -> Points, Tangents, Parameters
cluster_6 = Cluster_5(point=cluster_2.list_b, radius=number_slider_3)  # -> list_b, polygon_2
# 1. Try editing the inside of the cluster.
cluster_7 = Cluster_4(point=cluster_4.list_b, radius=number_slider_4)  # -> list_b, polygon_2
polygon_2 = Polygon(Plane=divide_curve_2.Points, Radius=number_slider, Segments=number_slider_2, FilletRadius=0)  # -> Polygon, Length
# Combining challenges C6 and C7, create a grid of points; on that grid of points, place a polyline you have drawn, and rotate each polyline in-place with a random degree.
# Create a set of points that looks like a triangle, starting at one point, two points, three points etc. Do this by using two 'Series' components.
# Hint:
# One series is plugged into the other.
# Create a set of points that looks like a pyramid. Do this by using the components below.
geometry = Geometry([cluster_2.polygon_2, cluster_6.polygon_2])
geometry_2 = Geometry([cluster_4.polygon_2, cluster_7.polygon_2])
geometry_3 = Geometry(circle_3)
divide_curve_3 = DivideCurve(Curve=polygon_2.Polygon, Count=10, Kinks=False)  # -> Points, Tangents, Parameters
# Search the menu above for 'Extrude'. Alternately, double-click on the Grasshopper canvas - this will bring up a search menu. Type 'Extrude', and choose the plain 'Extrude', not 'Extrude Along', etc..
panel_6 = Panel(square_root)
panel_7 = Panel(cluster)
# If the rotation is moving strangely, it's because the Rotate component requires a center/pivot point -- the 'Plane' input. Where would you get a list of points around which your geometry should rotate?
geometry_4 = Geometry(divide_curve_3.Points)

# ==== cluster Cluster
number = ClusterInput()
# 2. If you click on the 'package' icon to the upper left
# you can click 'save and close'
# and exit this cluster back to the main document.
number_2 = Number(number)
# 1. You're "inside" the cluster!
# Notice that the components in here look the same as what's out there.
# That should mean this cluster functions the same way as what's out there.
average = Average(Input=number_2)
subtraction = Subtraction(A=average, B=number_2)
square = Square(Value=subtraction)
average_2 = Average(Input=square)
square_root = SquareRoot(Value=average_2)
result = ClusterOutput(square_root)

# ==== cluster DisplayText
md_slider = MDSlider(
    SliderMode=0,
    slider_value=Point(0, 0.07560916063, 0.5),
    x_domain=Domain(-10, 10),
    y_domain=Domain(-10, 10),
    z_domain=Domain(0, 1))
loc = ClusterInput()
loc_2 = Data(loc)
item = ListItem(List=loc_2, Index=0, Wrap=True)
move = Move(Geometry=item, Motion=md_slider)  # -> Geometry, Transform
challenge = ClusterInput()
bool = Boolean(True)
pdecon = Deconstruct(Point=move.Geometry)  # -> XComponent, YComponent, ZComponent
challenge_2 = Data(challenge)
pt = ConstructPoint(XCoordinate=pdecon.XComponent, YCoordinate=Slider(-14, range=-50..50), ZCoordinate=pdecon.ZComponent)
c_script = CSharpScript(face="Arial", bold=bool, size=Slider(3.046, range=0..11), content=challenge_2, pl=pt)  # -> out, A; inputs face: String, bold: Boolean, italics: Boolean, size: Double, content: String, pl: Plane
# ---------- c_script: C# ----------
    if(size == 0)
      size = 1;

    if(!string.IsNullOrEmpty(face) && size > 0 && !string.IsNullOrEmpty(content) &&
      pl.IsValid)
    {

      var te = RhinoDoc.ActiveDoc.Objects.AddText(content, pl, size, face, bold, italics);
      Rhino.DocObjects.TextObject txt = RhinoDoc.ActiveDoc.Objects.Find(te) as Rhino.DocObjects.TextObject;

      if(txt != null)
      {
        var tt = txt.Geometry as Rhino.Geometry.TextEntity;
        A = tt.Explode();
      }
      
      RhinoDoc.ActiveDoc.Objects.Delete(te, true);
    }
# ---------- end c_script ----------
boundary = BoundarySurfaces(Edges=c_script.A)
S = ClusterOutput(boundary)

# ==== cluster Cluster_2
# 2. This is a cluster input.
curve = ClusterInput()

# ----
# 4. Try creating a 'Cluster Input' component
# and attaching it to this number component.
# 
# 
# 
# 5. You'll see that the 'Cluster Input' adopts the name of the number component.
# 
# 6. Try attaching another Cluster Input component to this one.
number_slider = Slider(5, range=0..10)
divide_curve = DivideCurve(Curve=curve, Count=number_slider, Kinks=False)  # -> Points, Tangents, Parameters
# 3. This is a cluster output.
circle = Circle(Plane=divide_curve.Points, Radius=Slider(33, range=0..100))

# ----
# 7. Cluster Inputs 'adopt' or copy the qualities of the component they're connected to.
# 
# In fact, once they do so, you can't un-copy or change their qualities very easily.
# 
# For this reason, it's best to
# delete and create new 'Cluster Inputs' and Cluster Outputs when you want to change things.
# 8. Try adding Cluster Outputs and connecting them to things!
# 
# 9. Now, exit this cluster and note that you've added two new inputs to the cluster.
number_of_divide_points = Number()
number = Number()
circle_2 = ClusterOutput(circle)

# ==== cluster Cluster_3
curve = ClusterInput()

divide_curve = DivideCurve(Curve=curve, Count=Slider(5, range=0..10), Kinks=False)  # -> Points, Tangents, Parameters
circle = Circle(Plane=divide_curve.Points, Radius=Slider(33, range=0..100))

circle_2 = ClusterOutput(circle)

# ==== cluster Cluster_4
point = ClusterInput()
point_2 = Point(point)
# 2.. You're in one of the clusters,
# 
# But they're actually the same cluster,
# they just have two instances of the same thing.
# 
# 3. Try changing something.. like the Segments #, or this text,
# and exiting and looking at the other cluster!
radius = ClusterInput()
polygon = Polygon(Plane=point_2, Radius=radius, Segments=Slider(4, range=0..10), FilletRadius=0)  # -> Polygon, Length
control_points = ControlPoints(Curve=polygon.Polygon)  # -> Points, Weights, Knots
split_list = SplitList(List=control_points.Points, Index="1")  # -> ListA, flatten(ListB)
polygon_2 = ClusterOutput(polygon.Polygon)
list_b = ClusterOutput(split_list.ListB)

# ==== cluster Cluster_5
point = ClusterInput()
point_2 = Point(point)
# 1. Try editing the inside of this cluster! Does it stay the same across clusters?.
radius = ClusterInput()
polygon = Polygon(Plane=point_2, Radius=radius, Segments=Slider(4, range=0..10), FilletRadius=0)  # -> Polygon, Length
control_points = ControlPoints(Curve=polygon.Polygon)  # -> Points, Weights, Knots
split_list = SplitList(List=control_points.Points, Index="1")  # -> ListA, flatten(ListB)
polygon_2 = ClusterOutput(polygon.Polygon)
list_b = ClusterOutput(split_list.ListB)
