# Grasshopper definition GH_Examples_Random_letter_drawing.ghx (Grasshopper 0.9.76)
# plug-ins: HDTReference

# ---- group: Create a grid of points.
number_slider = Slider(10, range=0..10)
# Grasshopper Challenges
# By Dan Taeyoung, 2016. https://github.com/provolot/GrasshopperChallenges
# Examples: Represenation example: random letter movements
construct_point = ConstructPoint(XCoordinate=Slider(100, range=0..100), YCoordinate=0, ZCoordinate=0)
geometry = Geometry(construct_point)
number_slider_2 = Slider(15, range=0..20)
rectangle = Rectangle(Plane=PlaneXY(0, 0, 0), XSize=number_slider, YSize=number_slider, Radius=0)  # -> Rectangle, Length
rectangular_array = RectangularArray(Geometry=geometry, Cell=rectangle.Rectangle, XCount=number_slider_2, YCount=number_slider_2)  # -> Geometry, Transform

# ---- group: How many points do we have in our grid?
list_length = ListLength(List=rectangular_array.Geometry)

# ---- group: Pick a random letter of the alphabet
characters = Characters(Text="abcdefghijklmnopqrstuvwxyz")  # -> Result, Unicode
list_length_2 = ListLength(List=characters.Result)
number = Number(list_length)
random = Random(Range=list_length_2, Number=number, Seed=2)
list_item = ListItem(List=characters.Result, Index=random, Wrap=True)
panel = Panel(list_item)

# ---- group: These are the points on the grid. It's often helpful to create components in the middle of the canvas so you don't have to scroll all the way to the left to understand what some data may be.
point = Point(rectangular_array.Geometry)

# ---- group: Create a bunch of random letters on each point of the grid
number_slider_3 = Slider(0.1, range=0..0.1)
c_script = CSharpScript(face="Helvetica", bold=Toggle(True), italics=Toggle(False), size=Slider(18.35, range=0..21), content=panel, pl=point)  # -> out, A; inputs face: String, bold: Boolean, italics: Boolean, size: Double, content: String, pl: Plane
# ---------- c_script: C# ----------
    if(size == 0)
      size = 1;

    if(!string.IsNullOrEmpty(face) && size > 0 && !string.IsNullOrEmpty(content) &&
      pl.IsValid)
    {

      var te = RhinoDoc.ActiveDoc.Objects.AddText(content, pl, size, face, bold, italics);
      Rhino.DocObjects.TextObject txt = RhinoDoc.ActiveDoc.Objects.Find(te) as Rhino.DocObjects.TextObject;

      if(txt != null)
      {
        var tt = txt.Geometry as Rhino.Geometry.TextEntity;
        A = tt.Explode();
      }
      
      RhinoDoc.ActiveDoc.Objects.Delete(te, true);
    }
# ---------- end c_script ----------
simplify_curve = SimplifyCurve(Curve=c_script.A, Tolerance=number_slider_3, AngleTolerance=number_slider_3)  # -> Curve, Simplified
boundary_surfaces = BoundarySurfaces(Edges=simplify_curve.Curve)

# ---- group: Move the letters to be center-justified.
surface = Surface(flatten(boundary_surfaces))
point_2 = Point(point)
area = Area(Geometry=flatten(surface))  # -> Area, Centroid
vector_2pt = Vector2Pt(PointA=area.Centroid, PointB=point_2, Unitize=False)  # -> Vector, Length
move = Move(Geometry=surface, Motion=vector_2pt.Vector)  # -> Geometry, Transform

# ---- group: Number of points in our grid
number_2 = Number(list_length)

# ---- group: Let's create a random vector pointing in a random direction for each point in our array.
construct_domain = ConstructDomain(DomainStart=Slider(-13, range=-20..20), DomainEnd=Slider(8, range=-20..20))
random_2 = Random(Range=construct_domain, Number=number_2, Seed=Slider(444, range=0..1000))
random_3 = Random(Range=construct_domain, Number=number_2, Seed=Slider(3434, range=0..10000))
vector_xyz = VectorXYZ(XComponent=random_3, YComponent=random_2, ZComponent=0)  # -> Vector, Length

# ---- group: Let's create a random vector pointing in a random direction for each point in our array. / Then move the letters randomly
move_2 = Move(Geometry=move.Geometry, Motion=vector_xyz.Vector)  # -> Geometry, Transform

# ---- group: These are the points on the grid. It's often helpful to create components in the middle of the canvas so you don't have to scroll all the way to the left to understand what some data may be.
point_3 = Point(rectangular_array.Geometry)

# ---- group: Slice each letters into lines to create our own 'hatch' pattern.
contour = Contour(Shape=move_2.Geometry, Point=Point(0, 0, 0), Direction=vector_xyz.Vector, Distance=Slider(1, range=0..4))
colour_swatch = ColourSwatch(SwatchColor=RGB(0, 0, 0))
geometry_2 = Geometry(contour)
number_slider_4 = Slider(1, range=0..10)
previewlw = CustomPreviewLineweights(Geometry=geometry_2, Shader=colour_swatch, Thickness=number_slider_4)

# ---- group: Create our own arced dotted lines / Create a set of lines moving from start points to our random end points
line_sdl = LineSDL(Start=point_3, Direction=vector_xyz.Vector, Length=vector_xyz.Length)

# ---- group: Create our own arced dotted lines
geometry_3 = Geometry(line_sdl)
end_points = EndPoints(Curve=geometry_3)  # -> Start, End
unit_x = UnitX(Factor=1)
xy_plane = XYPlane(Origin=end_points.End)
number_slider_5 = Slider(1.6, range=0..10)
number_slider_6 = Slider(3, range=0..10)
panel_2 = Panel("1,0.1")

# ---- group: Create our own arced dotted lines / Create a set of circular arcs
arc_sed = ArcSED(Start=end_points.Start, End=end_points.End, Direction=unit_x)  # -> Arc, Plane, Radius

# ---- group: Create our own arced dotted lines / Rotate an XY plane - this lets us rotate the triangle at the end of a line as if it were an arrowhead.
align_plane = AlignPlane(Plane=xy_plane, Direction=geometry_3)  # -> Plane, Angle

# ---- group: Create our own arced dotted lines / Make the arcs into a dashed pattern
dash_pattern = DashPattern(Curve=arc_sed.Arc, Pattern=panel_2)  # -> Dashes, Gaps

# ---- group: Create our own arced dotted lines / Create an 'arrowhead' with a triangle
polygon = Polygon(Plane=align_plane.Plane, Radius=number_slider_5, Segments=number_slider_6, FilletRadius=0)  # -> Polygon, Length

# ----
bake_drawing = Boolean(Toggle(False))
bakeattributes = CSharpScript(objs=geometry_2, layers="Drawing - contours", colors=colour_swatch, pWidths=number_slider_4, activate=bake_drawing)  # -> out; inputs objs: list, names: list of String, layers: list of String, colors: list of Color, pWidths: list of Double, wiresEach: list of Int32, materials: list, activate: Boolean, groupListTgthr: Boolean
# ---------- bakeattributes: C# ----------
    //Inserts geometry into the Rhino document, with custom attributes
    //Written by Giulio Piacentino
    //Version written 2011 10 18 - for Grasshopper 0.8.52

    if (activate)
    {
      int groupIndex = -1;
      if(groupListTgthr)
        groupIndex = doc.Groups.Add();

      for(int i = 0; i < objs.Count; i++)
      {
        object obj = objs[i];
        if(obj == null)
        {
          Print("No object to bake");
          return;
        }

        //Make new attribute to set name
        Rhino.DocObjects.ObjectAttributes att = new Rhino.DocObjects.ObjectAttributes();

        string name = names.Count > 0 ? names[i % names.Count] : null;
        //Set object name
        if(!string.IsNullOrEmpty(name))
        {
          att.Name = name;
        }

        Color color = colors.Count > 0 ? colors[i % colors.Count] : new Color();
        //Set color
        if(!color.IsEmpty)
        {
          att.ColorSource = Rhino.DocObjects.ObjectColorSource.ColorFromObject; //Make the color type "by object"
          att.ObjectColor = color;

          att.PlotColorSource = Rhino.DocObjects.ObjectPlotColorSource.PlotColorFromObject; //Make the plot color type "by object"
          att.PlotColor = color;
        }

        string layer = layers.Count > 0 ? layers[i % layers.Count] : null;
        //Set layer
        if(!string.IsNullOrEmpty(layer) && Rhino.DocObjects.Layer.IsValidName(layer))
        {
          //Get the current layer index
          Rhino.DocObjects.Tables.LayerTable layerTable = doc.Layers;
          int layerIndex = layerTable.Find(layer, true);

          if(layerIndex < 0) //This layer does not exist, we add it
          {
            Rhino.DocObjects.Layer onlayer = new Rhino.DocObjects.Layer(); //Make a new layer
            onlayer.Name = layer;

            layerIndex = layerTable.Add(onlayer); //Add the layer to the layer table
            if (layerIndex > -1) //We manged to add layer!
            {
              att.LayerIndex = layerIndex;
              Print("Added new layer to the document at position " + layerIndex + " named " + layer + ". ");
            } else
              Print("Layer did not add. Try cleaning up your layers."); //This never happened to me.
          }
          else
            att.LayerIndex = layerIndex; //We simply add to the existing layer
        }


        double pWidth = pWidths.Count > 0 ? pWidths[i % pWidths.Count] : 0;
        //Set plotweight
        if(pWidth > 0)
        {
          att.PlotWeightSource = Rhino.DocObjects.ObjectPlotWeightSource.PlotWeightFromObject;
          att.PlotWeight = pWidth;
        }


        object material = materials.Count > 0 ? materials[i % materials.Count] : null;
        //Set material
        bool materialByName = !string.IsNullOrEmpty(material as string);
        Rhino.Display.DisplayMaterial inMaterial = material as Rhino.Display.DisplayMaterial;
        if(material is Color)
        {
          inMaterial = new Rhino.Display.DisplayMaterial((Color) material);
        }
        if(material != null && inMaterial == null && !materialByName)
        {
          if(!(material is string))
          {
            try //We also resort to try with IConvertible
            {
              inMaterial = (Rhino.Display.DisplayMaterial) Convert.ChangeType(material, typeof(Rhino.Display.DisplayMaterial));
            }
            catch(InvalidCastException)
            {
            }
          }
        }
        if(inMaterial != null || materialByName)
        {
          string matName;

          if(!materialByName)
          {
            matName = string.Format("A:{0}-D:{1}-E:{2}-S:{3},{4}-T:{5}",
              Format(inMaterial.Ambient),
              Format(inMaterial.Diffuse),
              Format(inMaterial.Emission),
              Format(inMaterial.Specular),
              inMaterial.Shine.ToString(),
              inMaterial.Transparency.ToString()
              );
          }
          else
          {
            matName = (string) material;
          }

          int materialIndex = doc.Materials.Find(matName, true);
          if(materialIndex < 0 && !materialByName) //Material does not exist and we have its specs
          {
            materialIndex = doc.Materials.Add(); //Let's add it
            if(materialIndex > -1)
            {
              Print("Added new material at position " + materialIndex + " named \"" + matName + "\". ");
              Rhino.DocObjects.Material m = doc.Materials[materialIndex];
              m.Name = matName;
              m.AmbientColor = inMaterial.Ambient;
              m.DiffuseColor = inMaterial.Diffuse;
              m.EmissionColor = inMaterial.Emission;
              //m.ReflectionColor = no equivalent
              m.SpecularColor = inMaterial.Specular;
              m.Shine = inMaterial.Shine;
              m.Transparency = inMaterial.Transparency;
              //m.TransparentColor = no equivalent
              m.CommitChanges();

              att.MaterialSource = Rhino.DocObjects.ObjectMaterialSource.MaterialFromObject;
              att.MaterialIndex = materialIndex;
            }
            else
              Print("Material did not add. Try cleaning up your materials."); //This never happened to me.
          }
          else if(materialIndex < 0 && materialByName) //Material does not exist and we do not have its specs. We do nothing
          {
            Print("Warning: material name not found. I cannot set the source to this material name. Add a material with name: " + matName);
          }
          else
          {
            //If this material exists, we do not replace it!
            att.MaterialSource = Rhino.DocObjects.ObjectMaterialSource.MaterialFromObject;
            att.MaterialIndex = materialIndex;
          }
        }


        int wires = wiresEach.Count > 0 ? wiresEach[i % wiresEach.Count] : 0;
        //Set wire density
        if(wires == -1 || wires > 0)
        {
          att.WireDensity = wires;
        }

        Bake(obj, att, groupIndex);
      }
    }
    else
    {
      Print("Inactive");
    }
# ---------- bakeattributes: C# additional code ----------
  void Bake(object obj, Rhino.DocObjects.ObjectAttributes att, int groupIndex)
  {
    if(obj == null)
      return;

    Guid id;

    //Bake to the right type of object
    if(obj is GeometryBase)
    {
      GeometryBase geomObj = obj as GeometryBase;

      switch(geomObj.ObjectType)
      {
        case Rhino.DocObjects.ObjectType.Brep:
          id = doc.Objects.AddBrep(obj as Brep, att);
          break;
        case Rhino.DocObjects.ObjectType.Curve:
          id = doc.Objects.AddCurve(obj as Curve, att);
          break;
        case Rhino.DocObjects.ObjectType.Point:
          id = doc.Objects.AddPoint((obj as Rhino.Geometry.Point).Location, att);
          break;
        case Rhino.DocObjects.ObjectType.Surface:
          id = doc.Objects.AddSurface(obj as Surface, att);
          break;
        case Rhino.DocObjects.ObjectType.Mesh:
          id = doc.Objects.AddMesh(obj as Mesh, att);
          break;
        case (Rhino.DocObjects.ObjectType) 1073741824://Rhino.DocObjects.ObjectType.Extrusion:
          id = (Guid) typeof(Rhino.DocObjects.Tables.ObjectTable).InvokeMember("AddExtrusion", BindingFlags.Instance | BindingFlags.InvokeMethod, null, doc.Objects, new object[]{obj, att});
          break;
        case Rhino.DocObjects.ObjectType.PointSet:
          id = doc.Objects.AddPointCloud(obj as Rhino.Geometry.PointCloud, att); //This is a speculative entry
          break;
        default:
          Print("The script does not know how to handle this type of geometry: " + obj.GetType().FullName);
          return;
      }
    }
    else
    {
      Type objectType = obj.GetType();

      if(objectType == typeof(Arc))
      {
        id = doc.Objects.AddArc((Arc) obj, att);
      }
      else if(objectType == typeof(Box))
      {
        id = doc.Objects.AddBrep(((Box) obj).ToBrep(), att);
      }
      else if(objectType == typeof(Circle))
      {
        id = doc.Objects.AddCircle((Circle) obj, att);
      }
      else if(objectType == typeof(Ellipse))
      {
        id = doc.Objects.AddEllipse((Ellipse) obj, att);
      }
      else if(objectType == typeof(Polyline))
      {
        id = doc.Objects.AddPolyline((Polyline) obj, att);
      }
      else if(objectType == typeof(Sphere))
      {
        id = doc.Objects.AddSphere((Sphere) obj, att);
      }
      else if(objectType == typeof(Point3d))
      {
        id = doc.Objects.AddPoint((Point3d) obj, att);
      }
      else if(objectType == typeof(Line))
      {
        id = doc.Objects.AddLine((Line) obj, att);
      }
      else if(objectType == typeof(Vector3d))
      {
        Print("Impossible to bake vectors");
        return;
      }
      else if(obj is IEnumerable)
      {
        int newGroupIndex;
        if(groupIndex == -1)
          newGroupIndex = doc.Groups.Add();
        else
          newGroupIndex = groupIndex;
        foreach(object o in obj as IEnumerable)
        {
          Bake(o, att, newGroupIndex);
        }
        return;
      }
      else
      {
        Print("Unhandled type: " + objectType.FullName);
        return;
      }
    }

    if(groupIndex != -1)
    {
      doc.Groups.AddToGroup(groupIndex, id);
      Print("Added " + obj.GetType().Name + " to group number " + groupIndex);
    }
    else
      Print("Added " + obj.GetType().Name);
  }

  static string Format(Color c)
  {
    return (new System.Text.StringBuilder("A")).Append(c.A.ToString()).Append("R").Append(c.R.ToString()).Append("G")
      .Append(c.G.ToString()).Append("B").Append(c.B.ToString()).ToString();
  }
# ---------- end bakeattributes ----------
colour_swatch_2 = ColourSwatch(SwatchColor=RGB(124, 120, 121))
colour_swatch_3 = ColourSwatch(SwatchColor=RGB(124, 120, 121))
number_slider_7 = Slider(0, range=0..10)
bakeattributes_2 = CSharpScript(objs=polygon.Polygon, layers="Drawing - arrowheads", colors=colour_swatch_3, activate=bake_drawing)  # -> out; inputs objs: list, names: list of String, layers: list of String, colors: list of Color, pWidths: list of Double, wiresEach: list of Int32, materials: list, activate: Boolean, groupListTgthr: Boolean; same code as bakeattributes
bakeattributes_3 = CSharpScript(
    objs=dash_pattern.Dashes,
    layers="Drawing - dashed circles",
    colors=colour_swatch_2,
    pWidths=number_slider_7,
    activate=Toggle(False))  # -> out; inputs objs: list, names: list of String, layers: list of String, colors: list of Color, pWidths: list of Double, wiresEach: list of Int32, materials: list, activate: Boolean, groupListTgthr: Boolean; same code as bakeattributes
previewlw_2 = CustomPreviewLineweights(Geometry=polygon.Polygon, Shader=colour_swatch_3, Thickness=Slider(3, range=0..10))
previewlw_3 = CustomPreviewLineweights(Geometry=dash_pattern.Dashes, Shader=colour_swatch_2, Thickness=number_slider_7)
