# Grasshopper definition GH_Tutorials_H_GettingDataInAndOut.ghx (Grasshopper 1.0.7)
# plug-ins: jSwan, Swiftlet, Heron

# Saving arbitrary Grasshopper Data!
# Okay --- this is super funky.
# You can save any kind of geometry with Grasshopper to a file!
# 
# And even more interestingly, Grasshopper will auto-load this.
# 
# This means that you can have Grasshopper sharing data between instances of Rhino..
# 
# Or, if you use Dropbox / Google Drive or some other auto-syncing mechanism, you can easily share data over the network!
number_slider = Slider(7, range=0..10)

# ---- group: Citibike Station data - this is older, archived data from 2016!
# Using Python to do a HTTP GET request from the internet, download data, and parse JSON!
panel = Panel("http://feeds.citibikenyc.com/stations/stations.json")

# ---- group: Citibike Station data - up to date (as of July 2022)
# Citibike API example
# Using Swiftlet to do a HTTP GET request from the internet, download data, and parse JSON!
panel_2 = Panel("https://gbfs.citibikenyc.com/gbfs/en/station_status.json")

# ----
# Obscure: Saving data in ghpython ‘sticky’:
# This is an obscure way to save data ‘across’ ghpython scripts, in a global variable. (You probably won’t really use this unless you know what you’re doing!)
number_slider_2 = Slider(2, range=0..10)
# Saving text files!
# You can save files with Grasshopper.
number_slider_3 = Slider(4, range=0..10)
panel_3 = Panel("https://gbfs.citibikenyc.com/gbfs/en/station_information.json")
series = Series(Start=number_slider, Step=1, Count=Slider(7, range=0..100))
ghpython_script = GhPythonScript(x=number_slider_2)  # -> out, a
# ---------- ghpython_script: Python ----------
from scriptcontext import sticky

sticky["test"] = x
# ---------- end ghpython_script ----------
ghpython_script_2 = GhPythonScript(x=Slider(5, range=0..10))  # -> result, out
# ---------- ghpython_script_2: Python ----------
from scriptcontext import sticky


result = sticky["test"]
# ---------- end ghpython_script_2 ----------

# ---- group: right-click and "select one existing file"
# Getting data in/out of Grasshopper
# Reading text files!
# Any program that has a text output can be updated/read in Grasshopper.
# Step 1: Create a text file in a text editor, and save it to a folder.
# Step 2: Load the file in Grasshopper
file_path = FilePath("C:\Users\provolot\github\PaperHopper_metatool\.gitignore")

# ----
series_2 = Series(Start=number_slider_3, Step=1, Count=Slider(10, range=0..100))
panel_4 = Panel(file_path)
panel_5 = Panel(ghpython_script_2.result)
panel_6 = Panel(ghpython_script.a)
panel_7 = Panel(series)
boolean_toggle = BooleanToggle(False)
# Change the file and watch this change, live!
read_file = ReadFile(File=file_path, PerLineParse=True)
# Right-click and set ‘Destination’
sphere = Sphere(Base=PlaneXY(0, 0, 0), Radius=Slider(6, range=0..10))
# Right click and select "Stream Destination" to select location..
# 
# Then right click again and toggle "Stream Contents" to start saving data to a file. Untoggle this to stop.
panel_8 = Panel(series_2)
stream_filter = StreamFilter(Gate=boolean_toggle, Stream1=panel_3)

# ---- group: This is the component that does the JSON reading.
getjson = PythonScript(URL=panel, Activate=Toggle(False))  # -> data, JSON, PathStructure, IDs, Values; inputs Activate: Boolean
# ---------- getjson: Python ----------
import json
import array
import urllib2
import rhinoscriptsyntax as rs
import clr
import Grasshopper
from Grasshopper.Kernel.Data import GH_Path
from Grasshopper import DataTree

def traverseJson(fragment, thispath, prevkey, toReturn):
    thistext = ""
    if(type(fragment) == dict):
        for i in xrange(len(fragment.keys())):
            thispath.append(i)
            thiskey = fragment.keys()[i]
            thistext += traverseJson(fragment[thiskey], thispath, thiskey, toReturn)
            thispath.pop()
        return thistext
    if(type(fragment) == list):
        for i in xrange(len(fragment)):
            thispath.append(i)
            thistext += traverseJson(fragment[i], thispath, prevkey, toReturn)
            thispath.pop()
        return thistext    
        
        
    if(fragment != None):
        if(toReturn == "paths"):
            return unicode(thispath) + "\n"
        if(toReturn == "ids"):
            return prevkey + "\n"
        if(toReturn == "values"):
            return unicode(fragment) + "\n"
        
    else:
        return ""
    
    
def JSONtoTREE(json):
    global PathStructure
    global IDs
    global Values
    
    IDtree = DataTree[object]()
    Valuetree = DataTree[object]()
    
    path = []
    
    PathStructure = traverseJson(json, path, "", "paths").splitlines();
    IDs = traverseJson(json, path, "", "ids").splitlines()
    Values = traverseJson(json, path, "", "values").splitlines()
    NewPathStructure = []
    for i in xrange(len(PathStructure)):
        thispath = PathStructure[i]
        thispath = map(lambda x: int(x), thispath.replace("]","").replace("[","").split(","))
        #print GH_Path(thispath
        newarray = array.array('i')
        newarray.fromlist(thispath)
        IDtree.Add(IDs[i], GH_Path(*newarray))
        Valuetree.Add(Values[i], GH_Path(*newarray))
        
    IDs = IDtree
    Values = Valuetree
    
    return str(json)
    

if(Activate == True):
    
    if URL:
        data = urllib2.urlopen(URL).read()
        data = json.loads(data)
      
        JSON = JSONtoTREE(data)
        
    else:
        if Path:
            
            file = open(Path)
            data = json.load(file)
            JSON = JSONtoTREE(data)
            
        else:
            if Text:
                data = json.loads(Text)
                JSON = JSONtoTREE(data)
# ---------- end getjson ----------

# ----
stream_filter_2 = StreamFilter(Gate=boolean_toggle, Stream1=panel_2)
panel_9 = Panel(read_file)
data_output = DataOutput(
    somedata=panel_7,
    somegeo=sphere,
    Destination="/Users/provolot/Dropbox/My Mac (Dan’s MacBook Air)/Desktop/test.ghdata",
    RelativePath="/Users/provolot/Dropbox/My Mac (Dan’s MacBook Air)/Desktop/test.ghdata|../../Dropbox/My Mac (Dan’s MacBook Air)/Desktop/test.ghdata")

# ---- group: This is from Swiftlet, a library that allows HTTP web requests
get_request = GETRequest(URL=stream_filter_2)  # -> Status, Content, Response
get_request_2 = GETRequest(URL=stream_filter)  # -> Status, Content, Response

# ----
trim_tree = TrimTree(Tree=getjson.IDs, Depth=1)
trim_tree_2 = TrimTree(Tree=getjson.Values, Depth=1)
simplify_tree = SimplifyTree(Tree=trim_tree, Front=False)
panel_10 = Panel(simplify_tree)
# You can right-click to set the name of the input file. You can also set the delay, so that file changes aren't reflected immediately.
panel_11 = Panel("""station_id
num_bikes_available""")

# ---- group: This is from Jswan, a library that allows easy navigation of JSON data
deserialize_json = DeserializeJson(JSON=get_request_2.Content, OutputsLocked=False)  # -> Data, Last_updated, Ttl
deserialize_json_2 = DeserializeJson(JSON=get_request.Content, OutputsLocked=False)  # -> Data, Last_updated, Ttl
deserialize_json_3 = DeserializeJson(JSON=deserialize_json.Data, OutputsLocked=False)
deserialize_json_4 = DeserializeJson(JSON=deserialize_json_2.Data, OutputsLocked=False)
deserialize_json_5 = DeserializeJson(JSON=deserialize_json_3, OutputsLocked=False)  # -> Station_id, Station_type, Lon, Eightd_station_services, Name, External_id, Electric_bike_surcharge_waiver, Eightd_has_key_dispenser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
deserialize_keys_and_values = DeserializeKeysAndValues(JSON=deserialize_json_4, Keys=panel_11)  # -> Key, Value
list_item = ListItem(List=deserialize_keys_and_values.Value, Index=0, Wrap=True)  # -> flatten(Item), flatten(Item1)
num_bikes_available = Number(list_item.Item1)
station_ids = Number(list_item.Item)

# ----
list_item_2 = ListItem(List=trim_tree_2, Index=Slider(6, range=0..10), Wrap=True)
list_item_3 = ListItem(List=trim_tree_2, Index=Slider(2, range=0..10), Wrap=True)
# Right-click and set ‘Source’
data_input = DataInput(
    Destination="/Users/provolot/Dropbox/My Mac (Dan’s MacBook Air)/Desktop/test.ghdata",
    RelativePath="/Users/provolot/Dropbox/My Mac (Dan’s MacBook Air)/Desktop/test.ghdata|../../Dropbox/My Mac (Dan’s MacBook Air)/Desktop/test.ghdata",
    UpdateDelay=50000)  # -> somedata, somegeo
# In this example, we're simply converting latitude to X coordinates, and longitude to Y coordinates. This isn't accurate, but good enough for this example, just to visualize data.
construct_point = ConstructPoint(XCoordinate=list_item_3, YCoordinate=list_item_2, ZCoordinate=0)
panel_12 = Panel(data_input.somedata)
panel_13 = Panel(data_input.somegeo)
list_item_4 = ListItem(List=trim_tree_2, Index=Slider(14, range=0..100), Wrap=True)  # -> Item, Item1
number = Number(deserialize_json_5.Station_id)
decimal_degrees_to_xy = DecimalDegreesToXY(Latitude=deserialize_json_5.Lat, Longitude=deserialize_json_5.Lon)  # -> flatten(XyPoint), Transform
cone = Cone(Base=construct_point, Radius=Slider(0.003, range=0..0.1), Length=Slider(0.007, range=0..0.01))  # -> Cone, Tip
member_index = MemberIndex(Set=station_ids, Member=number)  # -> Index, Count
power_of_10 = PowerOf10(Value=Slider(6, range=0..10))
list_item_5 = ListItem(List=num_bikes_available, Index=member_index.Index, Wrap=True)  # -> flatten(Item)
custom_preview = CustomPreview(Geometry=cone.Cone, Material=ColourSwatch(SwatchColor=RGB(103, 221, 235)))
division = Division(A=decimal_degrees_to_xy.XyPoint, B=power_of_10)
panel_14 = Panel(division)
panel_15 = Panel(trim_tree_2)
bounds = Bounds(Numbers=list_item_5)
deconstruct_domain = DeconstructDomain(Domain=bounds)  # -> Start, End
unit_z = UnitZ(Factor=Slider(0.127, range=0..0.2))
gradient = Gradient(
    LowerLimit=deconstruct_domain.Start,
    UpperLimit=deconstruct_domain.End,
    Parameter=list_item_5,
    stops=[0: RGB(255, 0, 157), 0.127: RGB(255, 217, 0), 0.302: RGB(0, 111, 196)])
move = Move(Geometry=division, Motion=unit_z)  # -> Geometry, Transform
xz_plane = XZPlane(Origin=move.Geometry)
text_tag_3d = TextTag3D(
    Location=xz_plane,
    Text=list_item_5,
    Size=Slider(0.1, range=0..1),
    Colour=ColourSwatch(SwatchColor=RGB(255, 254, 254)),
    Justification=8)
dot_display = DotDisplay(Point=division, Colour=gradient, Size=Slider(0.1, range=0..1))
