# Grasshopper definition GH_Tutorials_I_IntroToGHPython.ghx (Grasshopper 1.0.7)
# plug-ins: Human

# You can also do operations on geometry, just like in Grasshopper!
rectangle = Rectangle(Plane=PlaneXY(0, 0, 0), XSize=Domain(-1, 1), YSize=Domain(-2, 2), Radius=0)  # -> Rectangle, Length
# We can also specify the base point!
number_slider = Slider(7, range=0..10)
# You can have inputs!
number_slider_2 = Slider(6, range=0..10)
# You can add/delete inputs and outputs and change their names!
# This is a ZUI (Zoomable User Interface).
# Zoom in and notice the "+" and "-" signs. Click on them to add or remove inputs/outputs.
# Right-click on the outputs to change their names!
# 
# The input/output names will be tied automatically to variable names. I.E, if you create an input with name of "height", you will have a variable called "height" in Python.
number_slider_3 = Slider(6, range=0..10)
# Let's create a sphere with variable radius!
# This is what it's like in Grasshopper
number_slider_4 = Slider(9, range=0..10)
# Any Grasshopper component can be callable, including from plugins!
number_slider_5 = Slider(0, range=0..10)
# You can have iteration or recursion, which Python is especially well suited to do.
# 
# Here's a random walk in 3d!
number_slider_6 = Slider(7, range=0..10)
# Here it is in Python. Double click to see what's going on...
number_slider_7 = Slider(9, range=0..10)
# You can set the Python script to receive lists as.... lists.
series = Series(Start=0, Step=1, Count=10)
series_2 = Series(Start=0, Step=1, Count=10)
# Grasshopper deals with lists as a default by running the Python script multiple times.
series_3 = Series(Start=0, Step=1, Count=10)
construct_point = ConstructPoint(XCoordinate=number_slider, YCoordinate=Slider(10, range=0..10), ZCoordinate=Slider(10, range=0..10))
ghpython_script = GhPythonScript(x=number_slider_2)  # -> out, a
# ---------- ghpython_script: Python ----------
a = x * 2
# ---------- end ghpython_script ----------
ghpython_script_2 = GhPythonScript(foo=number_slider_3)  # -> out, bar
# ---------- ghpython_script_2: Python ----------
bar = foo * 2
# ---------- end ghpython_script_2 ----------
# You can have outputs!
ghpython_script_3 = GhPythonScript()  # -> out, a
# ---------- ghpython_script_3: Python ----------
a = "hello world!"
# ---------- end ghpython_script_3 ----------
# Intro to GHPython's Interface
# This runs python inside of it. Double-click on the component to edit some code.
ghpython_script_4 = GhPythonScript()  # -> out, a
# ---------- ghpython_script_4: Python ----------
print "hello world!"

# you can click the "test" button (or press F5) to run this code.
# ---------- end ghpython_script_4 ----------
sphere = Sphere(Base=PlaneXY(0, 0, 0), Radius=number_slider_4)
ghpython_script_5 = GhPythonScript(x=number_slider_7)  # -> out, magicresult
# ---------- ghpython_script_5: Python ----------
# this imports all the Grasshopper components 
import ghpythonlib.components as gc


# gc.Sphere is exactly the same component
# as the Grasshopper component that creates a sphere.

# You need to specify its inputs.
# If you don't give it an input, it will try to use the Grasshopper defaults.

# In this case, we don't specify the base, 
# so it uses the 0,0,0 point as a default base.

magicresult = gc.Sphere(radius=x)
# ---------- end ghpython_script_5 ----------
construct_point_2 = ConstructPoint(XCoordinate=number_slider_6, YCoordinate=Slider(10, range=0..10), ZCoordinate=number_slider_5)
# Right-click and notice how it "List access" is selected!
# This allows GhPython to receive data as a list.
panel = Panel(series)
series_4 = Series(Start=0, Step=1, Count=series_2)
# Lists / Trees with GHPython
panel_2 = Panel(series_3)
panel_3 = Panel(ghpython_script_3.a)
panel_4 = Panel(ghpython_script.a)
panel_5 = Panel(ghpython_script_2.bar)
panel_6 = Panel(sphere)
# But right click here.. and make sure that
# Type hint > GeometryBase is selected.
ghpython_script_6 = GhPythonScript(pt=construct_point, r=Slider(9, range=0..10))  # -> out, magicresult; inputs pt: GeometryBase
# ---------- ghpython_script_6: Python ----------
# this imports all the Grasshopper components 
import ghpythonlib.components as gc

# this imports treehelpers, 
# which contains two methods for converting between Grasshopper trees and Python lists
import ghpythonlib.components as treehelpers

magicresult = gc.Sphere(base=pt, radius=r)
# ---------- end ghpython_script_6 ----------
unit_z = UnitZ(Factor=Slider(17, range=0..100))
panel_7 = Panel(ghpython_script_5.magicresult)
# Open me up!
ghpython_script_7 = GhPythonScript(x=series_3)  # -> out, a
# ---------- ghpython_script_7: Python ----------
print x

a = x

"""

hit Test or F5 to run this.

You'll notice that in the output below, 
it will say something like:
"First implicit Grasshopper cycle"

This is because, by default, GHPython, when given a list of inputs,
will operate on each input, one at a time.

So: if you input 10 numbers,
by default, it will run the python script 10 times,
each on 1 number.

"""
# ---------- end ghpython_script_7 ----------
ghpython_script_8 = GhPythonScript(pt=construct_point_2, unit_size=Slider(10, range=0..10), iterations=Slider(0, range=0..2100))  # -> out, random_walk_points; inputs pt: GeometryBase, iterations: Int32
# ---------- ghpython_script_8: Python ----------
import random

# this imports all the Grasshopper components 
import ghpythonlib.components as gc

# this imports treehelpers, 
# which contains two methods for converting between Grasshopper trees and Python lists
import ghpythonlib.treehelpers as treehelpers

#magicresult = gc.Sphere(base=pt, radius=r)

this_point = [0, 0, 0] 
random_walk_points = []

for i in range(iterations):
    if(random.random() < 0.5):
        this_point[0] += unit_size
    else:
        this_point[0] -= unit_size
        
    if(random.random() < 0.5):
        this_point[1] += unit_size
    else:
        this_point[1] -= unit_size
        
    if(random.random() < 0.5):
        this_point[2] += unit_size
    else:
        this_point[2] -= unit_size
        
    print(this_point)
    p = gc.ConstructPoint(this_point[0], this_point[1], this_point[2])
    random_walk_points.append(p)
# ---------- end ghpython_script_8 ----------
# Right-click & "select one existing file"
# You can zoom in and change the names of the inputs.
# 
# Then, you can right-click to set the name of the file.
panel_8 = Panel(series_4)
integer = Integer()
# Open me up too!
ghpython_script_9 = GhPythonScript(x=series)  # -> out, a; inputs x: list
# ---------- ghpython_script_9: Python ----------
print x

a = x

"""

hit Test or F5 to run this.


You'll notice that in the output below, 
the output is different!

X is now a list, and the message about "First implicit Grasshopper cycle"
is now gone.

This is because we've set `x`, as an input, to be a list.

Exit this dialog and right-click on the x.

"""
# ---------- end ghpython_script_9 ----------
ghpython_script_10 = GhPythonScript(f=Slider(70, range=0..100), crv=rectangle.Rectangle)  # -> out, magicresult; inputs crv: Curve
# ---------- ghpython_script_10: Python ----------
# this imports all the Grasshopper components 
import ghpythonlib.components as gc

# this imports treehelpers, 
# which contains two methods for converting between Grasshopper trees and Python lists
import ghpythonlib.components as treehelpers



magicresult = gc.Extrude(base=crv,direction=gc.UnitZ(f))
# ---------- end ghpython_script_10 ----------
extrude = Extrude(Base=rectangle.Rectangle, Direction=unit_z)
panel_9 = Panel(ghpython_script_7.a)
ghpython_script_11 = GhPythonScript(x=series_4)  # -> out, a; inputs x: tree
# ---------- ghpython_script_11: Python ----------
from ghpythonlib import treehelpers



"""

hit Test or F5 to run this.

x is now a tree!

"""


a = x


"""
using this method, we're able to turn a tree 
into a series of nested lists!

If you ever want to turn a series of nested lists into a tree,
you can use `treehelpers.list_to_tree()`.
"""

print(treehelpers.tree_to_list(x))
# ---------- end ghpython_script_11 ----------
panel_10 = Panel(ghpython_script_6.magicresult)
# But.. the output doesn't change.
# x is now set to "Tree access".
panel_11 = Panel(ghpython_script_9.a)
polyline = PolyLine(Vertices=ghpython_script_8.random_walk_points, Closed=False)
custom_preview_lineweights = CustomPreviewLineweights(
    Geometry=polyline,
    Shader={diffuse=RGB(255, 105, 180), emission=RGB(76, 32, 54), shine=0.5, specular=RGB(255, 255, 255), transparency=0},
    Thickness=Slider(4, range=0..10),
    Absolute=False)
panel_12 = Panel(ghpython_script_8.random_walk_points)
# Numerically adding text strings together
# Grasshopper has data types -- numbers, strings, geometry, etc.
# 
# Grasshopper tries its best to convert from one to the other.
# 
# For example: it can autoconverts strings of numbers into numbers.
# 
# This can be helpful.. or horrible.. or horrible + helpful!
panel_13 = Panel("12345")

# ---- group: This 'forces' text into numbers
addition = Addition(A=panel_13, B="1")

# ----
# Concatenating numbers
concatenate = Concatenate(FragmentA=Slider(7, range=0..10), FragmentB=Slider(3, range=0..10))
panel_14 = Panel(addition)
panel_15 = Panel(concatenate)
# Notice how the "panel" converts output into text (!!!!!!)
# 
# So.. creating a sphere, measuring its volume, then showing it in the panel works.
# 
# Creating a sphere, showing it in the panel, and measuring its panel doesn't work!
# Okay
# 
# 
# 
# 
# 
# Not okay
# 
# 
# 
# 
# 
# Yay
sphere_2 = Sphere(Base=PlaneXY(0, 0, 0), Radius=1)
sphere_3 = Sphere(Base=PlaneXY(0, 0, 0), Radius=1)
sphere_4 = Sphere(Base=PlaneXY(0, 0, 0), Radius=1)
panel_16 = Panel(sphere_3)
panel_17 = Panel(sphere_4)
volume = Volume(Geometry=sphere_2)  # -> Volume, Centroid
volume_2 = Volume(Geometry=panel_16)  # -> Volume, Centroid
volume_3 = Volume(Geometry=sphere_4)  # -> Volume, Centroid
panel_18 = Panel(volume.Volume)
panel_19 = Panel(volume_2.Volume)
panel_20 = Panel(volume_3.Volume)
