# Grasshopper definition random_letter_drawing.ghx (Grasshopper 0.9.76)
# plug-ins: ClipperComponents, HDTReference

construct_point = ConstructPoint(XCoordinate=0, YCoordinate=0, ZCoordinate=0)
number_slider = Slider(10, range=0..10)
geometry = Geometry(construct_point)
number_slider_2 = Slider(5, range=0..20)
rectangle = Rectangle(Plane=PlaneXY(0, 0, 0), XSize=number_slider, YSize=number_slider, Radius=0)  # -> Rectangle, Length
rectangular_array = RectangularArray(Geometry=geometry, Cell=rectangle.Rectangle, XCount=number_slider_2, YCount=number_slider_2)  # -> Geometry, Transform
characters = Characters(Text="abcdefghijklmnopqrstuvwxyz")  # -> Result, Unicode
cluster = Cluster(number=Slider(3, range=0..10), B=Slider(44, range=0..100))
list_length = ListLength(List=characters.Result)
list_length_2 = ListLength(List=rectangular_array.Geometry)
construct_domain = ConstructDomain(DomainStart=Slider(-13, range=-20..20), DomainEnd=Slider(8, range=-20..20))
panel = Panel(cluster)
random = Random(Range=list_length, Number=list_length_2, Seed=2)
random_2 = Random(Range=construct_domain, Number=list_length_2, Seed=Slider(444, range=0..1000))
random_3 = Random(Range=construct_domain, Number=list_length_2, Seed=Slider(3434, range=0..10000))
list_item = ListItem(List=characters.Result, Index=random, Wrap=True)
vector_xyz = VectorXYZ(XComponent=random_3, YComponent=random_2, ZComponent=0)  # -> Vector, Length
point = Point(rectangular_array.Geometry)
panel_2 = Panel(list_item)
line_sdl = LineSDL(Start=point, Direction=vector_xyz.Vector, Length=vector_xyz.Length)
vector_display = VectorDisplay(Anchor=point, Vector=vector_xyz.Vector)
c_script = CSharpScript(face="Helvetica", bold=Toggle(True), italics=Toggle(False), size=Slider(18.35, range=0..21), content=panel_2, pl=point)  # -> out, A; inputs face: String, bold: Boolean, italics: Boolean, size: Double, content: String, pl: Plane
# ---------- c_script: C# ----------
    if(size == 0)
      size = 1;

    if(!string.IsNullOrEmpty(face) && size > 0 && !string.IsNullOrEmpty(content) &&
      pl.IsValid)
    {

      var te = RhinoDoc.ActiveDoc.Objects.AddText(content, pl, size, face, bold, italics);
      Rhino.DocObjects.TextObject txt = RhinoDoc.ActiveDoc.Objects.Find(te) as Rhino.DocObjects.TextObject;

      if(txt != null)
      {
        var tt = txt.Geometry as Rhino.Geometry.TextEntity;
        A = tt.Explode();
      }
      
      RhinoDoc.ActiveDoc.Objects.Delete(te, true);
    }
# ---------- end c_script ----------
graft_tree = GraftTree(Tree=line_sdl, IncludeEmptyLists=True, IncludeNullItems=True)
boundary_surfaces = BoundarySurfaces(Edges=c_script.A)
evaluate_length = EvaluateLength(Curve=graft_tree, Length=Slider(0.74, range=0..1), Normalized=True)  # -> Point, Tangent, Parameter
geometry_2 = Geometry(flatten(c_script.A))
shatter = Shatter(Curve=graft_tree, Parameters=evaluate_length.Parameter)
surface = Surface(flatten(boundary_surfaces))
end_points = EndPoints(Curve=graft_tree)  # -> Start, End
area = Area(Geometry=flatten(surface))  # -> Area, Centroid
point_2 = Point(point)
unit_z = UnitZ(Factor=1)
unit_z_2 = UnitZ(Factor=1)
list_item_2 = ListItem(List=shatter, Index=0, Wrap=True)
number_slider_3 = Slider(1.5, range=0..10)
vector_2pt = Vector2Pt(PointA=area.Centroid, PointB=point_2, Unitize=False)  # -> Vector, Length
rotate = Rotate(Vector=evaluate_length.Tangent, Axis=unit_z, Angle="Pi / 2")
rotate_2 = Rotate(Vector=evaluate_length.Tangent, Axis=unit_z_2, Angle="- Pi / 2")
move = Move(Geometry=surface, Motion=vector_2pt.Vector)  # -> Geometry, Transform
amplitude = Amplitude(Vector=rotate, Amplitude=number_slider_3)
amplitude_2 = Amplitude(Vector=rotate_2, Amplitude=number_slider_3)
move_2 = Move(Geometry=move.Geometry, Motion=vector_xyz.Vector)  # -> Geometry, Transform
move_3 = Move(Geometry=evaluate_length.Point, Motion=amplitude)  # -> Geometry, Transform
move_4 = Move(Geometry=evaluate_length.Point, Motion=amplitude_2)  # -> Geometry, Transform
vector_display_2 = VectorDisplay(Anchor=evaluate_length.Point, Vector=rotate)
merge = Merge(Data1=move_3.Geometry, Data2=move_4.Geometry, Data3=end_points.End)
geometry_3 = Geometry(simplify(graft(geometry_2)))
surface_2 = Surface(move_2.Geometry)
geometry_4 = Geometry(list_item_2)
geometry_5 = Geometry(geometry_3)
offset = Offset(Curve=geometry_3, Distance=Slider(0.5, range=0..1), Plane=PlaneXY(0, 0, 0), Corners=1)  # -> simplify(Curve)
polyline = PolyLine(Vertices=merge, Closed=Toggle(True))  # -> simplify(Polyline)
contour = Contour(Shape=graft(surface_2), Point=Point(0, 0, 0), Direction=graft(vector_xyz.Vector), Distance=Slider(1.36, range=0..4))
divide_length = DivideLength(Curve=geometry_4, Length=Slider(1.45, range=1..5))  # -> Points, Tangents, Parameters
merge_2 = Merge(Data1=geometry_3, Data2=offset)
colour_swatch = ColourSwatch(SwatchColor=RGBA(219, 101, 0, 136))
createhatch = CreateHatch(Bake=False, Curves=geometry_3, HatchPatternName="Solid", HatchScale=1, HatchRotation=0, Attributes=colour_swatch)
polyline_offset = PolylineOffset(
    Polylines=list_item_2,
    Distance=Slider(0.15, range=0..1),
    Plane=Plane(origin=(0, 0, 0), x=(0, 0, 0), y=(0, 0, 0)),
    Tolerance=0.01,
    ClosedFillet=1,
    OpenFillet=1,
    Miter=2)  # -> simplify(Contour), Holes
geometry_6 = Geometry(contour)
circle = Circle(Plane=divide_length.Points, Radius=Slider(0.5, range=0..1))  # -> simplify(Circle)
polyline_offset_2 = PolylineOffset(
    Polylines=geometry_6,
    Distance=Slider(0.2, range=0..1),
    Plane=Plane(origin=(0, 0, 0), x=(0, 0, 0), y=(0, 0, 0)),
    Tolerance=0.01,
    ClosedFillet=1,
    OpenFillet=1,
    Miter=2)  # -> Contour, Holes
custom_preview = CustomPreview(Geometry=createhatch, Shader=colour_swatch)
hatch_table = HatchTable(Update=True)
boolean_toggle = BooleanToggle(False)
colour_swatch_2 = ColourSwatch(SwatchColor=RGBA(89, 185, 172, 69))
colour_swatch_3 = ColourSwatch(SwatchColor=RGB(253, 242, 255))
geometry_7 = Geometry([circle, polyline])
panel_3 = Panel(createhatch)
material_table = MaterialTable(Update=True)  # -> MaterialName, Shader, Diffuse, Specular, Emission, Alpha, Gloss
createattributes = CreateAttributes(LayerName="letters", Color=colour_swatch_2, enableFullPath=False)
createattributes_2 = CreateAttributes(LayerName="arrows", Color=colour_swatch_3, enableFullPath=False)
createhatch_2 = CreateHatch(
    Bake=boolean_toggle,
    Curves=geometry_7,
    HatchPatternName="Solid",
    HatchScale=1,
    HatchRotation=0,
    Attributes=createattributes_2)
createhatch_3 = CreateHatch(
    Bake=boolean_toggle,
    Curves=polyline_offset_2.Contour,
    HatchPatternName="Solid",
    HatchScale=1,
    HatchRotation=0,
    Attributes=createattributes)
custom_preview_2 = CustomPreview(Geometry=polyline_offset_2.Contour, Shader=colour_swatch_2)
custom_preview_3 = CustomPreview(Geometry=createhatch_2, Shader=colour_swatch_3)

# ==== cluster Cluster
number = ClusterInput()
B = ClusterInput()
number_2 = Number(number)
addition = Addition(A=number_2, B=B)
division = Division(A=number_2, B=addition)
result = ClusterOutput(division)
